# Grasshopper definition TestRenders.gh (Grasshopper 1.0.7)
# Copyright: 2021
# Copyright: 2022-22-28
# plug-ins: MantaRay, LadybugGrasshopper, Human, HDTTreeUtils, Bombyx 2

# ----
# Setup globals
panel = Panel("""<LinuxHome>
simulation""")
# export PATH=$PATH:/usr/local/radiance/bin:/usr/local/accelerad/bin;export RAYPATH=.:/usr/local/accelerad/lib:/usr/local/radiance/lib;export DISPLAY=$(ip route list default | awk '{print $3}'):0;export LIBGL_ALWAYS_INDIRECT=1;export LD_LIBRARY_PATH=/usr/local/accelerad/bin:$LD_LIBRARY_PATH
panel_2 = Panel("""proj
projname""")
global_overrides = GlobalOverrides(Keys=panel_2, Values=panel)
panel_3 = Panel(global_overrides)

# ----
# Local Connect
python = GhPythonScript()  # -> username
# ---------- python: Python ----------
__author__ = "mm1013"
__version__ = "2022.09.25"

import rhinoscriptsyntax as rs

import System

username = System.Environment.UserName

if username == "mm1013":
    username = "mss"
# ---------- end python ----------
panel_4 = Panel("127.0.0.1")
panel_5 = Panel(python)
connect = ConnectSSHFTP(User=panel_5, Ip="127.0.0.1", Password="_prompt", _port=22, Connect=Toggle(True))  # -> Status, Prefixes, Run
panel_6 = Panel(connect.Status)

panel_7 = Panel("""Mesh
Polysurface
Surface
Extrusion""")

od_outdated = ColourSwatch(SwatchColor=RGBA(97, 97, 97, 150))
u_updated = ColourSwatch(SwatchColor=RGBA(208, 115, 230, 112))
toggle = BooleanToggle(False)
g_general = ColourSwatch(SwatchColor=RGBA(245, 243, 237, 156))
o_outputs = ColourSwatch(SwatchColor=RGBA(160, 218, 242, 203))
s_settings = ColourSwatch(SwatchColor=RGBA(224, 145, 81, 154))
cc_core2 = ColourSwatch(SwatchColor=RGBA(230, 216, 186, 208))
y_yellow = ColourSwatch(SwatchColor=RGBA(247, 244, 64, 188))
i_inputs = ColourSwatch(SwatchColor=RGBA(125, 217, 98, 150))
c_core = ColourSwatch(SwatchColor=RGBA(235, 227, 206, 203))
r_red = ColourSwatch(SwatchColor=RGBA(242, 63, 63, 203))

# ----
# Test connection
testconnection = TestConnection()  # -> Status, Errors
panel_8 = Panel(testconnection.Status)
panel_9 = Panel(testconnection.Errors)

colorgroups = CSharpScript(
    Colors=[i_inputs, s_settings, g_general, c_core, o_outputs, r_red, y_yellow, u_updated, od_outdated, cc_core2],
    Enable=toggle,
    Rename=Toggle(False),
    RunOnce=Button(),
    Debug=Toggle(False))  # -> out; inputs Colors: list of Color, Enable: Boolean, Rename: Boolean, RunOnce: Boolean, Debug: Boolean
# ---------- colorgroups: C# usings ----------
using System.Linq;
using System.Text;
using System.Reflection;
# ---------- colorgroups: C# ----------
    msg.Clear();


    this.Component.Message = "id: " + id.ToString();

    _debug = Debug; //Set to true to have all events printed in rhino log
    _rename = Rename;

    if (Enable)
    {
      msg.AppendFormat("Set up events on ID {0}\n", id);
      SetupDict(); // Create a dictionary of the input swatches
      SetEventHandlers(); // This would do the job.


    }
    else
    {
      RemoveEventHandlers();
    }
    if (RunOnce)
    {
      foreach(Grasshopper.Kernel.Special.GH_Group grp in Grasshopper.Instances.ActiveCanvas.Document.Objects.OfType<Grasshopper.Kernel.Special.GH_Group>())
      {
        ColorGroup(grp, null); // You decide if it should run once on all existing groups

      }
    }

    Print(msg.ToString());


    // Component setup
    Component.Description = "Set up event handlers to color groups based on prefixes such as 'in_' and 'out_'.\n"
      + "Please insert only swatcheds directly into the Colors input\n\n"
      + "MIT License. Copyright Mathias Sønderskov Schaltz 2022";
    Component.Params.Input[0].Description = "Please insert only swatcheds directly into the Colors input.\nRemember to rename them";
    Component.Params.Input[1].Description = "Toggle to run...";
    Component.Params.Input[2].Description = "Set to true if you want to automatically rename the groups and remove prefix. Default is false.";
    Component.Params.Input[3].Description = "Set to true to run it once and color all existing groups.";
    Component.Params.Input[Component.Params.Input.Count - 1].Description = "Set debug to true to get all the events printed in the rhino log";
# ---------- colorgroups: C# additional code ----------
  public static Random rnd = new Random();
  public int id = rnd.Next(0, 1000);
  StringBuilder msg = new StringBuilder();
  Dictionary<string, System.Drawing.Color> colorDict = new Dictionary<string, System.Drawing.Color>();

  bool _debug = false;
  bool _rename = false;

  public bool IdExists(int id)
  {
    IList<IGH_DocumentObject> objs = Grasshopper.Instances.ActiveCanvas.Document.Objects;
    return objs
      .OfType<IGH_Component>()
      .Where(ob => ob.NickName == this.Component.NickName)
      .Where(ob => ob.GetType().ToString() == "ScriptComponents.Component_CSNET_Script")
      .Where(ob => ob.Message == "id: " + id.ToString()).Any();

  }


  public void SetupDict()
  {
    colorDict.Clear();
    // Get all inputs to "Colors"
    IList<IGH_Param> colorSources = this.Component.Params.Input[0].Sources;
    if (colorSources.Count == 0)
    {
      throw new Exception("You forgot to setup the colors. Please input swatch components and rename them");
    }
    foreach(IGH_Param source in colorSources)
    {
      //if (source.Type.ToString() == "Grasshopper.Kernel.Types.GH_Colour")
      if (source is Grasshopper.Kernel.Special.GH_ColourSwatch)
      {
        string nickName = source.NickName.Split('_')[0].Trim() + "_";
        if(!colorDict.ContainsKey(nickName))
        {
          Grasshopper.Kernel.Special.GH_ColourSwatch swatch = (Grasshopper.Kernel.Special.GH_ColourSwatch) source;
          colorDict.Add(nickName, swatch.SwatchColour);
        }
        else
        {
          throw new Exception("Multiple swatches using the same name detected. Please rename");
        }
      }
      else
      {
        throw new Exception("Whacko! Why did you input a non-swatch into the Colors? " + source.Type.ToString());
      }

    }

    msg.AppendFormat("Set up the dictionaries with {0} colors\n", colorDict.Count);
    foreach(var pairs in colorDict)
    {
      msg.AppendFormat("{0} -> {1}\n", ("\"" + pairs.Key + "\"").PadRight(5 + colorDict.Keys.Select(k => k.Length).Max()), pairs.Value);
    }
  }

  public void SetEventHandlers()
  {

    // Always remove events first to avoid duplicates
    GrasshopperDocument.ObjectsAdded -= OnObjectsAdded;
    GrasshopperDocument.ObjectsDeleted -= OnObjectsRemoved;
    GrasshopperDocument.ObjectsDeleted -= OnDeleteThisComponent;

    // Attach events
    GrasshopperDocument.ObjectsAdded += OnObjectsAdded;
    GrasshopperDocument.ObjectsDeleted += OnObjectsRemoved;
    GrasshopperDocument.ObjectsDeleted += OnDeleteThisComponent;


    foreach(Grasshopper.Kernel.Special.GH_Group grp in GrasshopperDocument.Objects.OfType<Grasshopper.Kernel.Special.GH_Group>())
    {
      grp.ObjectChanged -= ColorGroup;
      grp.ObjectChanged += ColorGroup;

      //ColorGroup(grp, null); // Make sure to run it once
    }
    msg.AppendFormat("Added the eventhandlers on {0} existing groups and on future created groups\n", GrasshopperDocument.Objects.OfType<Grasshopper.Kernel.Special.GH_Group>().Count());
  }

  public void OnObjectsAdded(object sender, GH_DocObjectEventArgs e)
  {
    bool any = false;
    foreach (Grasshopper.Kernel.Special.GH_Group grp in e.Objects.OfType<Grasshopper.Kernel.Special.GH_Group>())
    {
      grp.ObjectChanged -= ColorGroup;
      grp.ObjectChanged += ColorGroup;
      any = true;
    }

    DebugWrite(any ? "Group Objects Added: Attaching Events to ObjectChanged" : "Objects Added - but no groups");
  }

  //Same but reversed
  public void OnObjectsRemoved(object sender, GH_DocObjectEventArgs e)
  {
    bool any = false;
    foreach (Grasshopper.Kernel.Special.GH_Group grp in e.Objects.OfType<Grasshopper.Kernel.Special.GH_Group>())
    {
      grp.ObjectChanged -= ColorGroup;
      any = true;
    }

    DebugWrite(any ? "Group Objects Removed, removing event" : "Objects Removed - although not a group");

  }



  public void RemoveEventHandlers()
  {
    GrasshopperDocument.ObjectsAdded -= OnObjectsAdded;
    GrasshopperDocument.ObjectsDeleted -= OnObjectsRemoved;


    foreach(Grasshopper.Kernel.Special.GH_Group grp in GrasshopperDocument.Objects.OfType<Grasshopper.Kernel.Special.GH_Group>())
    {
      grp.ObjectChanged -= ColorGroup;

    }
    msg.AppendFormat("Removed event handlers on document and on {0} groups\n", GrasshopperDocument.Objects.OfType<Grasshopper.Kernel.Special.GH_Group>().Count());

  }

  public void ColorGroup(object sender, EventArgs e)
  {
    if (!IdExists(id))
    {
      DebugWrite("Component not relevant. Disabling old id + " + id.ToString());
      RemoveEventHandlers();
      return;
    }

    Grasshopper.Kernel.Special.GH_Group grp = sender as Grasshopper.Kernel.Special.GH_Group;
    if (grp == null) return; //not type GH_Group
    //if (!grp.NickName.EndsWith("_")) return;

    string[] nameParts = grp.NickName.Split('_');
    if (nameParts.Length <= 1)
      return;
    string prefix = grp.NickName.Split('_')[0].Trim() + '_';

    string prefixes = String.Join(", ", colorDict.Keys.Select(k => "\"" + k + "\""));

    msg.Append("prefix " + prefix + "\n");
    if (colorDict.ContainsKey(prefix))
    {
      //if (grp.NickName.EndsWith("_"))
      grp.Colour = colorDict[prefix];
      if (_rename)
      {
        grp.NickName = grp.NickName.Replace(prefix, "");
      }

      DebugWrite("Colored " + grp.NickName);

    }
    else
    {
      DebugWrite("Group changed but not relevant: prefix " + prefix + " is not among " + prefixes);
    }

  }
  public void DebugWrite(string msg)
  {
    if (_debug)
    {
      Rhino.RhinoApp.WriteLine(String.Format("[ColGrps {0}]: {1}", id, msg));
    }
  }

  public void OnDeleteThisComponent(object sender, GH_DocObjectEventArgs e)
  {

    if (e.Objects.OfType<Grasshopper.Kernel.GH_Component>().Where(o => o.NickName == this.Component.NickName).Any())
    {
      DebugWrite("Removed template component. Removing all the eventhandlers");
      RemoveEventHandlers();
    }

  }
# ---------- end colorgroups ----------

fixparams = CSharpScript(FixOnce=Button(), Enable=toggle, Debug=Toggle(False))  # -> out; inputs FixOnce: Boolean, Enable: Boolean, Debug: Boolean
# ---------- fixparams: C# usings ----------
using System.Text;
using System.Linq;
using Grasshopper.Kernel.Special;
# ---------- fixparams: C# ----------
    _debug = Debug;
    _enable = Enable;
    msg.Clear();
    this.Component.Message = "id: " + id.ToString();




    if (Enable)
    {
      SetEventHandlers();
    }
    else
    {
      RemoveEventHandlers();
    }


    if (FixOnce)
    {
      FixAll();
    }

    Print(msg.ToString());

    // Component setup
    Component.Description = "Set up event handlers to change params to show nickname and not icon"
      + "\n\n"
      + "MIT License. Copyright Mathias Sønderskov Schaltz 2022";
    Component.Params.Input[0].Description = "Run me once on the document";
    Component.Params.Input[1].Description = "Toggle to enable event listener";
    Component.Params.Input[Component.Params.Input.Count - 1].Description = "Set debug to true to get all the events printed in the rhino log";
# ---------- fixparams: C# additional code ----------
  public static Random rnd = new Random();
  public int id = rnd.Next(0, 1000);
  StringBuilder msg = new StringBuilder();
  bool _debug = false;
  bool _enable = false;

  public Dictionary<IGH_ActiveObject, HashSet<GH_Group>> groupsPerObject = new Dictionary<IGH_ActiveObject, HashSet<GH_Group>>();


  public void OnObjectsAdded(object sender, GH_DocObjectEventArgs e)
  {
    if (!IdExists(id))
    {
      DebugWrite("[FixParam] Component not relevant. Disabling old id " + id.ToString());
      RemoveEventHandlers();
      return;
    }


    if(_enable)
    {
      foreach(IGH_Param par in e.Objects.OfType<IGH_Param>())
      {
        FixInputs(par);
      }
    }


  }

  public void FixAll()
  {
    //DebugWrite("Fixing all?");
    foreach(IGH_Param par in GrasshopperDocument.Objects.OfType<IGH_Param>())
    {

      FixInputs(par);
    }
  }




  public void FixInputs(IGH_ActiveObject obj)
  {



    IGH_Param par = obj as IGH_Param;
    if (par != null)
    {

      par.IconDisplayMode = GH_IconDisplayMode.name;


    }

  }


  public void SetEventHandlers()
  {

    GrasshopperDocument.ObjectsAdded -= OnObjectsAdded;
    GrasshopperDocument.ObjectsAdded += OnObjectsAdded;
    GrasshopperDocument.ObjectsDeleted -= OnDeleteThisComponent;
    GrasshopperDocument.ObjectsDeleted += OnDeleteThisComponent;
    msg.AppendFormat("Added the eventhandlers to OnObjectsAdded\n", GrasshopperDocument.Objects.OfType<Grasshopper.Kernel.Special.GH_Group>().Count());
  }

  public void RemoveEventHandlers()
  {
    GrasshopperDocument.ObjectsAdded -= OnObjectsAdded;
    GrasshopperDocument.ObjectsDeleted -= OnDeleteThisComponent;

    msg.AppendFormat("Removed wire event handlers on document\n", GrasshopperDocument.Objects.OfType<Grasshopper.Kernel.Special.GH_Group>().Count());

  }

  public void OnDeleteThisComponent(object sender, GH_DocObjectEventArgs e)
  {

    if (e.Objects.OfType<Grasshopper.Kernel.GH_Component>().Where(o => o.NickName == this.Component.NickName).Any())
    {
      DebugWrite("Removed template component. Removing all the eventhandlers");
      RemoveEventHandlers();
    }

  }

  public bool IdExists(int id)
  {
    IList<IGH_DocumentObject> objs = Grasshopper.Instances.ActiveCanvas.Document.Objects;
    return objs
      .OfType<IGH_Component>()
      .Where(ob => ob.NickName == this.Component.NickName)
      .Where(ob => ob.GetType().ToString() == "ScriptComponents.Component_CSNET_Script")
      .Where(ob => ob.Message == "id: " + id.ToString()).Any();

  }

  public void DebugWrite(string msg)
  {
    if (_debug)
    {
      Rhino.RhinoApp.WriteLine(String.Format("[FixParams {0}]: {1}", id, msg));
    }
  }
# ---------- end fixparams ----------

fixwires = CSharpScript(FixOnce=Button(), Enable=toggle, Debug=Toggle(False))  # -> out; inputs FixOnce: Boolean, Enable: Boolean, Debug: Boolean
# ---------- fixwires: C# ----------
    _debug = Debug;
    _enable = Enable;
    msg.Clear();
    this.Component.Message = "id: " + id.ToString();


    SetDictionary();

    if (Enable)
    {
      SetEventHandlers();
    }
    else
    {
      RemoveEventHandlers();
    }


    if (FixOnce)
    {
      FixAll();
    }

    Print(msg.ToString());
    
    // Component setup
    Component.Description = "Set up event handlers to change all wire types across groups to faint"
      + "\n\n"
      + "MIT License. Copyright Mathias Sønderskov Schaltz 2022";
    Component.Params.Input[0].Description = "Run me once on the document";
    Component.Params.Input[1].Description = "Toggle to enable event listener";
    Component.Params.Input[Component.Params.Input.Count - 1].Description = "Set debug to true to get all the events printed in the rhino log";
# ---------- fixwires: C# additional code ----------
  public static Random rnd = new Random();
  public int id = rnd.Next(0, 1000);
  StringBuilder msg = new StringBuilder();
  bool _debug = false;
  bool _enable = false;

  public Dictionary<IGH_ActiveObject, HashSet<GH_Group>> groupsPerObject = new Dictionary<IGH_ActiveObject, HashSet<GH_Group>>();


  public void OnSolutionExpired(object sender, GH_DocUndoEventArgs e)
  {
    if(_enable)
      FixAll();
  }

  public void FixAll()
  {
    //DebugWrite("Fixing all?");
    foreach(IGH_ActiveObject key in groupsPerObject.Keys.Where(k => groupsPerObject[k].Count() > 0))
    {

      FixInputs(key);
    }
  }



  public bool HasGroup(IGH_ActiveObject obj)
  {
    return groupsPerObject[obj].Count > 0;
  }


  public void FixInputs(IGH_ActiveObject obj)
  {

    if (!IdExists(id))
    {
      DebugWrite("Component not relevant. Disabling old id " + id.ToString());
      RemoveEventHandlers();
      return;
    }

    //List<List<IGH_ActiveObject>> parents = new List<List<IGH_ActiveObject>>();
    IGH_Param par = obj as IGH_Param;
    if (par != null && par.Sources != null)
    {


      IEnumerable<IGH_ActiveObject> p = par.Sources.Select(s => s.Attributes.GetTopLevel.DocObject as IGH_ActiveObject);
      //parents.Add(p);
      if(HasGroup(obj) && p.All(o => !HasGroupsInCommon(o, obj)) && par.WireDisplay != GH_ParamWireDisplay.faint)
      {
        DebugWrite("Fixing " + par.Attributes.GetTopLevel.DocObject.NickName);
        par.WireDisplay = GH_ParamWireDisplay.faint;
      }

    }

    IGH_Component comp = obj as IGH_Component;
    if (comp != null)
    {
      foreach(IGH_Param inp in comp.Params.Input)
      {

        IEnumerable<IGH_ActiveObject> p = inp.Sources.Select(i => i.Attributes.GetTopLevel.DocObject as IGH_ActiveObject);

        if(HasGroup(obj) && p.All(o => !HasGroupsInCommon(o, obj)) && inp.WireDisplay != GH_ParamWireDisplay.faint)
        {
          DebugWrite("Fixing " + inp.Attributes.GetTopLevel.DocObject.NickName);
          inp.WireDisplay = GH_ParamWireDisplay.faint;
        }
      }

    }



  }





  public void SetDictionary()
  {
    IList<IGH_DocumentObject> objects = Grasshopper.Instances.ActiveCanvas.Document.Objects.ToList();
    //Print(String.Join(", ", objects.Select(o => o.NickName)));

    groupsPerObject = objects
      .Where(o => o.GetType() != typeof(GH_Group))
      .OfType<IGH_ActiveObject>()
      .ToDictionary(o => o, o => new HashSet<GH_Group>());

    foreach(GH_Group grp in objects.OfType<GH_Group>())
    {

      foreach(IGH_ActiveObject obj in grp.ObjectsRecursive().OfType<IGH_ActiveObject>())
      {
        groupsPerObject[obj].Add(grp);

      }
    }



  }

  public bool HasGroupsInCommon(IGH_ActiveObject obj1, IGH_ActiveObject obj2)
  {
    HashSet<GH_Group> set1 = groupsPerObject[obj1];
    HashSet<GH_Group> set2 = groupsPerObject[obj2];

    set1.IntersectWith(set2);

    return set1.Any();
  }

  public void SetEventHandlers()
  {

    GrasshopperDocument.UndoStateChanged -= OnSolutionExpired;
    GrasshopperDocument.UndoStateChanged += OnSolutionExpired;
    GrasshopperDocument.ObjectsDeleted -= OnDeleteThisComponent;
    GrasshopperDocument.ObjectsDeleted += OnDeleteThisComponent;
    msg.AppendFormat("Added the eventhandlers to UndoStateChanged\n", GrasshopperDocument.Objects.OfType<Grasshopper.Kernel.Special.GH_Group>().Count());
  }

  public void RemoveEventHandlers()
  {
    GrasshopperDocument.UndoStateChanged -= OnSolutionExpired;
    GrasshopperDocument.ObjectsDeleted -= OnDeleteThisComponent;

    msg.AppendFormat("Removed wire event handlers on document\n", GrasshopperDocument.Objects.OfType<Grasshopper.Kernel.Special.GH_Group>().Count());

  }

  public void OnDeleteThisComponent(object sender, GH_DocObjectEventArgs e)
  {

    if (e.Objects.OfType<Grasshopper.Kernel.GH_Component>().Where(o => o.NickName == this.Component.NickName).Any())
    {
      DebugWrite("Removed template component. Removing all the eventhandlers");
      RemoveEventHandlers();
    }

  }

  public bool IdExists(int id)
  {
    IList<IGH_DocumentObject> objs = Grasshopper.Instances.ActiveCanvas.Document.Objects;
    return objs
      .OfType<IGH_Component>()
      .Where(ob => ob.NickName == this.Component.NickName)
      .Where(ob => ob.GetType().ToString() == "ScriptComponents.Component_CSNET_Script")
      .Where(ob => ob.Message == "id: " + id.ToString()).Any();

  }

  public void DebugWrite(string msg)
  {
    if (_debug)
    {
      Rhino.RhinoApp.WriteLine(String.Format("[FixWire {0}]: {1}", id, msg));
    }
  }
# ---------- end fixwires ----------

# ----
# processes to kill
panel_10 = Panel("""dctimestep
rcontrib
rtrace
oconv
rvu
rmtxop""")
kill = LBFalseStartToggle(False)

nickname = GH_TestComponentColor(Color=ColourSwatch(SwatchColor=RGB(188, 118, 194)), SelColor=ColourSwatch(SwatchColor=RGB(191, 128, 128)))

# ----
# importing from rhino layers
dpipeline = DynamicGeometryPipeline(
    LayerFilter="Daylight_Inputs::*",
    TypeFilter=panel_7,
    NameFilter="*",
    GroupByLayer=False,
    GroupByType=False,
    IncludeHidden=True,
    IncludeLocked=True,
    enableFullPath=True,
    listenToAttributes=True)
dam = DataDam(DataA=dpipeline, BufferDelay=10000000, BufferMode=0)
objatts = ObjectAttributes(ObjectOrAttributes=dam)  # -> Name, LayerName, LayerFullPath, Color, MaterialName, LinetypeName, GroupIndices, PlotWeight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
cset = CreateSet(List=objatts.LayerName)  # -> Set, Map
assign_paths = AssignPaths(InputData=flatten(dam), PathsToAssign=flatten(cset.Map))
python_2 = GhPythonScript(layer_name=graft(cset.Set))  # -> is_opaque, is_transparent, is_grid, is_HB_Room, is_HB_Window
# ---------- python_2: Python ----------
__author__ = "mm1013"
__version__ = "2022.01.16"

import rhinoscriptsyntax as rs

is_grid = layer_name == "Grids"

if layer_name.startswith("HB_"):
    is_opaque = is_transparent = is_grid = False
    
    is_HB_Window = layer_name.endswith("%")
    is_HB_Room = layer_name == "HB_Rooms"
    
    
else:
    if is_grid:
        is_opaque = False
        is_transparent = False
    else:
        is_transparent = layer_name.endswith("%")
        if is_transparent:
            transmittance = layer_name.split("_")[-1].replace("%","")
        is_opaque = not is_transparent
# ---------- end python_2 ----------
layer_name = Text(cset.Set)
geo = Geometry(assign_paths)

# ----
# Template methods
# By Mathias Sønderskov Schaltz 2022
# Check for updates here https://github.com/Sonderwoods/GrasshopperScribbles
panel_11 = Panel(colorgroups)
panel_12 = Panel(fixwires)
panel_13 = Panel(fixparams)

# ----
# Glass geometries
cull = CullPattern(List=graft(layer_name), CullPattern=graft(python_2.is_transparent))  # -> simplify(List)
cull_2 = CullPattern(List=geo, CullPattern=python_2.is_transparent)
python_3 = GhPythonScript(layer_name=cull)  # -> out, transmittance, name
# ---------- python_3: Python ----------
__author__ = "mm1013"
__version__ = "2022.01.16"

import rhinoscriptsyntax as rs

try:
    transmittance = layer_name.split("_")[-1].replace("%","")
    name = layer_name.replace("%","")
except:
    transmittance = None
    name = None
# ---------- end python_3 ----------
clean = CleanTree(
    RemoveNulls=True,
    RemoveInvalid=True,
    RemoveEmpty=True,
    Tree=simplify(cull_2),
    SynchronousTree1=simplify(python_3.name),
    SynchronousTree2=simplify(python_3.transmittance))  # -> Tree, SynchronousTree1, SynchronousTree2
python_4 = GhPythonScript(x=clean.SynchronousTree1)  # -> a
# ---------- python_4: Python ----------
__author__ = "mm1013"
__version__ = "2022.09.02"

import rhinoscriptsyntax as rs

a = x[1:]
# ---------- end python_4 ----------
meshit2 = MeshIt2(mesh_brep=graft(clean.Tree))
name = Text(python_4)
panel_14 = Panel(name)
unflatten = UnflattenTree(Tree=meshit2, Guide=clean.Tree)
geo_2 = Geometry(unflatten)
transmittance = Number(expr("x/100", clean.SynchronousTree2))
concat = Concatenate(FragmentA=panel_14, FragmentB="_mat")
mesh = Mesh(geo_2)

# ----
# opaque geometries
cull_3 = CullPattern(List=graft(layer_name), CullPattern=graft(python_2.is_opaque))  # -> simplify(List)
cull_4 = CullPattern(List=geo, CullPattern=graft(python_2.is_opaque))  # -> simplify(List)
python_5 = GhPythonScript(layer_name=cull_3)  # -> out, reflectance
# ---------- python_5: Python ----------
__author__ = "mm1013"
__version__ = "2022.01.16"

import rhinoscriptsyntax as rs
try:
    reflectance = layer_name.split("_")[-1]
    
except:
    reflectance = None
# ---------- end python_5 ----------
clean_2 = CleanTree(
    RemoveNulls=True,
    RemoveInvalid=True,
    RemoveEmpty=True,
    Tree=cull_3,
    SynchronousTree1=cull_4,
    SynchronousTree2=python_5.reflectance)  # -> Tree, SynchronousTree1, SynchronousTree2
name_2 = Text(clean_2.Tree)
geo_3 = Geometry(clean_2.SynchronousTree1)
refl = Number(clean_2.SynchronousTree2)
python_6 = GhPythonScript(x=name_2)  # -> a
# ---------- python_6: Python ----------
__author__ = "mm1013"
__version__ = "2022.09.02"

import rhinoscriptsyntax as rs

a = x[1:].replace(".","_")
# ---------- end python_6 ----------
meshit2_2 = MeshIt2(mesh_brep=geo_3)
concat_2 = Concatenate(FragmentA=python_6, FragmentB="_mat")

# ----
# Grid
cull_5 = CullPattern(List=graft(layer_name), CullPattern=graft(python_2.is_grid))  # -> simplify(List)
cull_6 = CullPattern(List=geo, CullPattern=python_2.is_grid)
clean_3 = CleanTree(RemoveNulls=True, RemoveInvalid=True, RemoveEmpty=True, Tree=cull_5, SynchronousTree1=simplify(cull_6))  # -> Tree, SynchronousTree1
geo_4 = Geometry(graft(clean_3.SynchronousTree1))

# ----
# Read more
# 
# 
# Ambient cache
# https://discourse.radiance-online.org/t/what-data-does-ambfile-store/4785/2
# Vertex order (and normal)
# 
# source : https://www.radiance-online.org/learning/tutorials/Tutorial-ThreePhaseMethod.pdf
# FILE NAMES: *.vmx - view matrix (data)
# *.hdr - view matrix (renderings)
# *.dmx - daylight matrix
# *.skv - sky vector
# *.smx – sky matrix
# *.xml - transmission matrix (the file is xml format)
# 
# *.rad - radiance scene data
# *.oct - octree file
# *.vf - view file
# *.dat - data
# 
# source : https://www.radiance-online.org/learning/tutorials/Tutorial-ThreePhaseMethod.pdf
image = ImageSampler(Filter="Colour", Interpolate=True, Umax=1, Umin=0, Vmax=1, Vmin=0, Wrap=1)  # disabled
logviewer = LogViewer(Number=10)  # -> CurrentTasks, Logs
largest_brep = LargestBREP(window_breps=[<geometry referenced from the Rhino model> x224])
# Log of latest(10) SSH Commands
panel_15 = Panel(logviewer.Logs)
panel_16 = Panel("/C:/MantaRayLinux/TestingRemote/README.md")

overrides = ApplyOverrides(Input="<LinuxHome>")
overrides_2 = ApplyOverrides(Input="<LinuxHome>/radFiles")

panel_17 = Panel("/C:/MantaRayLinux/TestingRemote")

# ----
# Create working folder
panel_18 = Panel("""mkdir -p <LinuxHome>
mkdir -p <LinuxHome>/radFiles
mkdir -p <LinuxHome>/objFiles
echo <LinuxHome>""")
prep_octrees = LBFalseStartToggle(True)
overrides_3 = ApplyOverrides(Input=panel_18)  # -> Output, DynamicOutput
executessh = ExecuteSSH(
    _SSHCommands_=overrides_3.DynamicOutput,
    Run=prep_octrees,
    addPrefix=True,
    description="""mkdir -p ~/MantaRay/UnnamedProject
mkdir -p ~/MantaRay/UnnamedProject/radFiles
mkdir -p ~/MantaRay/UnnamedProject/objFiles
echo ~/MantaRay/UnnamedProject""",
    fireLogs=False,
    lastRunTime=8.7,
    name="Create working dir",
    suppressWarnings=False,
    results="/home/mss/MantaRay/UnnamedProject",
    commands="""mkdir -p ~/MantaRay/UnnamedProject
mkdir -p ~/MantaRay/UnnamedProject/radFiles
mkdir -p ~/MantaRay/UnnamedProject/objFiles
echo ~/MantaRay/UnnamedProject""")  # -> Stdout, Stderr_, Ran

convertpaths = ConvertPaths(I="/C:/MantaRayLinux/TestingRemote")  # -> Linux, Windows
falsestart = LBFalseStartToggle(False)
falsestart_2 = LBFalseStartToggle(False)
path = FilePath("C:\Users\mm1013\source\repos\MantaRay\Examples\README.md")
overrides_4 = ApplyOverrides(Input="<SftpHome>\<Project>\radFiles")
executessh_2 = ExecuteSSH(
    _SSHCommands_="whoami",
    Run=Toggle(True),
    addPrefix=True,
    fireLogs=False,
    lastRunTime=9.5838,
    suppressWarnings=False,
    results="lio",
    commands="whoami")  # -> Stdout, Stderr_, Ran
upload = Upload(LocalFilePaths=path, Run=falsestart_2, stdouts="C:\Users\mm1013\README.md")  # -> Status, FilePaths, Ran
download = Download(Run=falsestart, stdouts="C:\Users\mm1013\MantaRay\TestingRemote\README.md")  # -> FilePaths, Status, Ran
convertpaths_2 = ConvertPaths(I=overrides_2)  # -> Linux, Windows, Sftp
panel_19 = Panel(executessh_2.Stdout)
panel_20 = Panel(download.FilePaths)
convertpaths_3 = ConvertPaths(I=upload.FilePaths)  # -> Linux, Windows

# ----
# glass geometry
panel_21 = Panel("<Project>\objFiles")
modnames = Text(concat)
names = Text(panel_14)
mesh_2 = Mesh(mesh)
mesh2obj = MeshToObj(
    Mesh=mesh_2,
    Name=graft(names),
    MapFileName="mapping_glass",
    ModifierName=graft(modnames),
    SubfolderOverride=panel_21,
    Run=executessh.Ran)  # -> ObjFiles, MapFile, Run
overrides_5 = ApplyOverrides(Input="<SftpHome>\objFiles")
entwine = Entwine(Branch00=mesh2obj.ObjFiles, Branch01=mesh2obj.MapFile, FlattenInputs=True)
convertpaths_4 = ConvertPaths(I=overrides_5)  # -> Linux, Windows, Sftp
upload_2 = Upload(
    LocalFilePaths=flatten(entwine),
    TargetFolder=convertpaths_4.Sftp,
    Run=executessh.Ran,
    stdouts="/home/mss/Glass_70.obj>JOIN</home/mss/mapping_glass.map")  # -> Status, FilePaths, Ran
panel_22 = Panel("""obj2rad -m <mapfile> -f <objFile> > <LinuxHome>/radFiles/<name>.rad
echo <LinuxHome>/radFiles/<name>.rad""")
convertpaths_5 = ConvertPaths(I=upload_2.FilePaths)  # -> Linux, Windows, Sftp
item = ListItem(List=convertpaths_5.Linux, Index=-1, Wrap=True)
shift = ShiftList(List=convertpaths_5.Linux, Shift=-1, Wrap=False)
overrides_6 = ApplyOverrides(Input=panel_22, Mapfile=graft(item), ObjFile=graft(shift), Name=graft(names))  # -> Output, DynamicOutput
executessh_3 = ExecuteSSH(
    _SSHCommands_=overrides_6.DynamicOutput,
    Run=upload_2.Ran,
    addPrefix=True,
    description="""obj2rad -m /home/mss/mapping_glass.map -f /home/mss/Glass_70.obj > ~/MantaRay/UnnamedProject/radFiles/Glass_70.rad
echo ~/MantaRay/UnnamedProject/radFiles/Glass_70.rad""",
    fireLogs=False,
    lastRunTime=6.4026,
    suppressWarnings=False,
    results="/home/mss/MantaRay/UnnamedProject/radFiles/Glass_70.rad",
    commands="""obj2rad -m /home/mss/mapping_glass.map -f /home/mss/Glass_70.obj > ~/MantaRay/UnnamedProject/radFiles/Glass_70.rad
echo ~/MantaRay/UnnamedProject/radFiles/Glass_70.rad""")  # -> flatten(Stdout), Stderr_, Ran
window_rad = Text(executessh_3.Stdout)
panel_23 = Panel(executessh_3.Stdout)

# ----
# Opaque geometry
panel_24 = Panel("<Project>\objFiles")
modnames_2 = Text(concat_2)
names_2 = Text(python_6)
mesh_3 = Mesh(meshit2_2)
mesh2obj_2 = MeshToObj(
    Mesh=mesh_3,
    Name=graft(names_2),
    MapFileName="mapping_opaque",
    ModifierName=graft(modnames_2),
    SubfolderOverride=panel_24,
    Run=executessh.Ran)  # -> ObjFiles, MapFile, Run
overrides_7 = ApplyOverrides(Input="<SftpHome>\objFiles")
entwine_2 = Entwine(Branch00=mesh2obj_2.ObjFiles, Branch01=mesh2obj_2.MapFile, FlattenInputs=True)
convertpaths_6 = ConvertPaths(I=overrides_7)  # -> Linux, Windows, Sftp
upload_3 = Upload(
    LocalFilePaths=flatten(entwine_2),
    TargetFolder=convertpaths_6.Sftp,
    Run=executessh.Ran,
    stdouts="/home/mss/Frames_0_6.obj>JOIN</home/mss/FloorBox_0_75.obj>JOIN</home/mss/Pipes_0_03.obj>JOIN</home/mss/IntWalls_0_80.obj>JOIN</home/mss/IntWalls_0_9.obj>JOIN</home/mss/ConcreteWhite_0_8.obj>JOIN</home/mss/Floor_FloorMat_0_7.obj>JOIN</home/mss/Black_0_01.obj>JOIN</home/mss/ConcreteStructure_0_3.obj>JOIN</home/mss/Cladding_0_5.obj>JOIN</home/mss/ConcreteDarker_0_1.obj>JOIN</home/mss/ConcreteGrey_0_5.obj>JOIN</home/mss/CurvedCeiling_0_80.obj>JOIN</home/mss/mapping_opaque.map")  # -> Status, FilePaths, Ran
panel_25 = Panel("""obj2rad -m <mapfile> -f <objFile> > <LinuxHome>/radFiles/<name>.rad
echo <LinuxHome>/radFiles/<name>.rad""")
convertpaths_7 = ConvertPaths(I=upload_3.FilePaths)  # -> Linux, Windows, Sftp
item_2 = ListItem(List=convertpaths_7.Linux, Index=-1, Wrap=True)
shift_2 = ShiftList(List=convertpaths_7.Linux, Shift=-1, Wrap=False)
overrides_8 = ApplyOverrides(Input=panel_25, Mapfile=graft(item_2), ObjFile=graft(shift_2), Name=graft(names_2))  # -> Output, DynamicOutput
executessh_4 = ExecuteSSH(
    _SSHCommands_=overrides_8.DynamicOutput,
    Run=upload_3.Ran,
    addPrefix=True,
    description="""obj2rad -m /home/mss/mapping_opaque.map -f /home/mss/Frames_0_6.obj > ~/MantaRay/UnnamedProject/radFiles/Frames_0_6.rad
echo ~/MantaRay/UnnamedProject/radFiles/Frames_0_6.rad


- - -

obj2rad -m /home/mss/mapping_opaque.map -f /home/mss/FloorBox_0_75.obj > ~/MantaRay/UnnamedProject/radFiles/FloorBox_0_75.rad
echo ~/MantaRay/UnnamedProject/radFiles/FloorBox_0_75.rad


- - -

obj2rad -m /home/mss/mapping_opaque.map -f /home/mss/Pipes_0_03.obj > ~/MantaRay/UnnamedProject/radFiles/Pipes_0_03.rad
echo ~/MantaRay/UnnamedProject/radFiles/Pipes_0_03.rad


- - -

obj2rad -m /home/mss/mapping_opaque.map -f /home/mss/IntWalls_0_80.obj > ~/MantaRay/UnnamedProject/radFiles/IntWalls_0_80.rad
echo ~/MantaRay/UnnamedProject/radFiles/IntWalls_0_80.rad


- - -

obj2rad -m /home/mss/mapping_opaque.map -f /home/mss/IntWalls_0_9.obj > ~/MantaRay/UnnamedProject/radFiles/IntWalls_0_9.rad
echo ~/MantaRay/UnnamedProject/radFiles/IntWalls_0_9.rad


- - -

obj2rad -m /home/mss/mapping_opaque.map -f /home/mss/ConcreteWhite_0_8.obj > ~/MantaRay/UnnamedProject/radFiles/ConcreteWhite_0_8.rad
echo ~/MantaRay/UnnamedProject/radFiles/ConcreteWhite_0_8.rad


- - -

obj2rad -m /home/mss/mapping_opaque.map -f /home/mss/Floor_FloorMat_0_7.obj > ~/MantaRay/UnnamedProject/radFiles/Floor_FloorMat_0_7.rad
echo ~/MantaRay/UnnamedProject/radFiles/Floor_FloorMat_0_7.rad


- - -

obj2rad -m /home/mss/mapping_opaque.map -f /home/mss/Black_0_01.obj > ~/MantaRay/UnnamedProject/radFiles/Black_0_01.rad
echo ~/MantaRay/UnnamedProject/radFiles/Black_0_01.rad


- - -

obj2rad -m /home/mss/mapping_opaque.map -f /home/mss/ConcreteStructure_0_3.obj > ~/MantaRay/UnnamedProject/radFiles/ConcreteStructure_0_3.rad
echo ~/MantaRay/UnnamedProject/radFiles/ConcreteStructure_0_3.rad


- - -

obj2rad -m /home/mss/mapping_opaque.map -f /home/mss/Cladding_0_5.obj > ~/MantaRay/UnnamedProject/radFiles/Cladding_0_5.rad
echo ~/MantaRay/UnnamedProject/radFiles/Cladding_0_5.rad


- - -

obj2rad -m /home/mss/mapping_opaque.map -f /home/mss/ConcreteDarker_0_1.obj > ~/MantaRay/UnnamedProject/radFiles/ConcreteDarker_0_1.rad
echo ~/MantaRay/UnnamedProject/radFiles/ConcreteDarker_0_1.rad


- - -

obj2rad -m /home/mss/mapping_opaque.map -f /home/mss/ConcreteGrey_0_5.obj > ~/MantaRay/UnnamedProject/radFiles/ConcreteGrey_0_5.rad
echo ~/MantaRay/UnnamedProject/radFiles/ConcreteGrey_0_5.rad


- - -

obj2rad -m /home/mss/mapping_opaque.map -f /home/mss/CurvedCeiling_0_80.obj > ~/MantaRay/UnnamedProject/radFiles/CurvedCeiling_0_80.rad
echo ~/MantaRay/UnnamedProject/radFiles/CurvedCeiling_0_80.rad""",
    fireLogs=False,
    lastRunTime=2172.4502,
    suppressWarnings=False,
    results=["/home/mss/MantaRay/UnnamedProject/radFiles/Frames_0_6.rad", "/home/mss/MantaRay/UnnamedProject/radFiles/FloorBox_0_75.rad", "/home/mss/MantaRay/UnnamedProject/radFiles/Pipes_0_03.rad", "/home/mss/MantaRay/UnnamedProject/radFiles/IntWalls_0_80.rad", "/home/mss/MantaRay/UnnamedProject/radFiles/IntWalls_0_9.rad", "/home/mss/MantaRay/UnnamedProject/radFiles/ConcreteWhite_0_8.rad", "/home/mss/MantaRay/UnnamedProject/radFiles/Floor_FloorMat_0_7.rad", "/home/mss/MantaRay/UnnamedProject/radFiles/Black_0_01.rad", "/home/mss/MantaRay/UnnamedProject/radFiles/ConcreteStructure_0_3.rad", "/home/mss/MantaRay/UnnamedProject/radFiles/Cladding_0_5.rad", "/home/mss/MantaRay/UnnamedProject/radFiles/ConcreteDarker_0_1.rad", "/home/mss/MantaRay/UnnamedProject/radFiles/ConcreteGrey_0_5.rad", "/home/mss/MantaRay/UnnamedProject/radFiles/CurvedCeiling_0_80.rad"],
    commands=["""obj2rad -m /home/mss/mapping_opaque.map -f /home/mss/Frames_0_6.obj > ~/MantaRay/UnnamedProject/radFiles/Frames_0_6.rad
echo ~/MantaRay/UnnamedProject/radFiles/Frames_0_6.rad""", """obj2rad -m /home/mss/mapping_opaque.map -f /home/mss/Pipes_0_03.obj > ~/MantaRay/UnnamedProject/radFiles/Pipes_0_03.rad
echo ~/MantaRay/UnnamedProject/radFiles/Pipes_0_03.rad""", """obj2rad -m /home/mss/mapping_opaque.map -f /home/mss/FloorBox_0_75.obj > ~/MantaRay/UnnamedProject/radFiles/FloorBox_0_75.rad
echo ~/MantaRay/UnnamedProject/radFiles/FloorBox_0_75.rad""", """obj2rad -m /home/mss/mapping_opaque.map -f /home/mss/ConcreteWhite_0_8.obj > ~/MantaRay/UnnamedProject/radFiles/ConcreteWhite_0_8.rad
echo ~/MantaRay/UnnamedProject/radFiles/ConcreteWhite_0_8.rad""", """obj2rad -m /home/mss/mapping_opaque.map -f /home/mss/Floor_FloorMat_0_7.obj > ~/MantaRay/UnnamedProject/radFiles/Floor_FloorMat_0_7.rad
echo ~/MantaRay/UnnamedProject/radFiles/Floor_FloorMat_0_7.rad""", """obj2rad -m /home/mss/mapping_opaque.map -f /home/mss/IntWalls_0_80.obj > ~/MantaRay/UnnamedProject/radFiles/IntWalls_0_80.rad
echo ~/MantaRay/UnnamedProject/radFiles/IntWalls_0_80.rad""", """obj2rad -m /home/mss/mapping_opaque.map -f /home/mss/IntWalls_0_9.obj > ~/MantaRay/UnnamedProject/radFiles/IntWalls_0_9.rad
echo ~/MantaRay/UnnamedProject/radFiles/IntWalls_0_9.rad""", """obj2rad -m /home/mss/mapping_opaque.map -f /home/mss/Cladding_0_5.obj > ~/MantaRay/UnnamedProject/radFiles/Cladding_0_5.rad
echo ~/MantaRay/UnnamedProject/radFiles/Cladding_0_5.rad""", """obj2rad -m /home/mss/mapping_opaque.map -f /home/mss/ConcreteStructure_0_3.obj > ~/MantaRay/UnnamedProject/radFiles/ConcreteStructure_0_3.rad
echo ~/MantaRay/UnnamedProject/radFiles/ConcreteStructure_0_3.rad""", """obj2rad -m /home/mss/mapping_opaque.map -f /home/mss/ConcreteDarker_0_1.obj > ~/MantaRay/UnnamedProject/radFiles/ConcreteDarker_0_1.rad
echo ~/MantaRay/UnnamedProject/radFiles/ConcreteDarker_0_1.rad""", """obj2rad -m /home/mss/mapping_opaque.map -f /home/mss/Black_0_01.obj > ~/MantaRay/UnnamedProject/radFiles/Black_0_01.rad
echo ~/MantaRay/UnnamedProject/radFiles/Black_0_01.rad""", """obj2rad -m /home/mss/mapping_opaque.map -f /home/mss/ConcreteGrey_0_5.obj > ~/MantaRay/UnnamedProject/radFiles/ConcreteGrey_0_5.rad
echo ~/MantaRay/UnnamedProject/radFiles/ConcreteGrey_0_5.rad""", """obj2rad -m /home/mss/mapping_opaque.map -f /home/mss/CurvedCeiling_0_80.obj > ~/MantaRay/UnnamedProject/radFiles/CurvedCeiling_0_80.rad
echo ~/MantaRay/UnnamedProject/radFiles/CurvedCeiling_0_80.rad"""])  # -> flatten(Stdout), Stderr_, Ran
opaque_rad = Text(executessh_4.Stdout)
panel_26 = Panel(executessh_4.Stdout)

# ----
# opaque materials
panel_27 = Panel("echo \"<mats>\" > <LinuxHome>/radFiles/<target>;echo \"<LinuxHome>/radFiles/<target>\"")
opaquegreymat = OpaqueGreyMat(Name=concat_2, Reflectance_0_1=refl, Specularity=0, Roughness=0)  # -> flatten(RadMaterials), RadMaterialList
join = TextJoin(Text=opaquegreymat.RadMaterials)
overrides_9 = ApplyOverrides(Input=panel_27, Mats=graft(join), Target=graft("opaque_materials.mat"))  # -> Output, DynamicOutput
executessh_5 = ExecuteSSH(
    _SSHCommands_=overrides_9.DynamicOutput,
    Run=executessh_4.Ran,
    addPrefix=True,
    description="""echo "void plastic Frames_0_6_mat
0
0
5 0.600 0.600 0.600 0.000 0.000
void plastic FloorBox_0_75_mat
0
0
5 0.750 0.750 0.750 0.000 0.000
void plastic Pipes_0_03_mat
0
0
5 0.030 0.030 0.030 0.000 0.000
void plastic IntWalls_0_80_mat
0
0
5 0.800 0.800 0.800 0.000 0.000
void plastic IntWalls_0_9_mat
0
0
5 0.900 0.900 0.900 0.000 0.000
void plastic ConcreteWhite_0_8_mat
0
0
5 0.800 0.800 0.800 0.000 0.000
void plastic Floor_FloorMat_0_7_mat
0
0
5 0.700 0.700 0.700 0.000 0.000
void plastic Black_0_01_mat
0
0
5 0.010 0.010 0.010 0.000 0.000
void plastic ConcreteStructure_0_3_mat
0
0
5 0.300 0.300 0.300 0.000 0.000
void plastic Cladding_0_5_mat
0
0
5 0.500 0.500 0.500 0.000 0.000
void plastic ConcreteDarker_0_1_mat
0
0
5 0.100 0.100 0.100 0.000 0.000
void plastic ConcreteGrey_0_5_mat
0
0
5 0.500 0.500 0.500 0.000 0.000
void plastic CurvedCeiling_0_80_mat
0
0
5 0.800 0.800 0.800 0.000 0.000" > ~/MantaRay/UnnamedProject/radFiles/opaque_materials.mat;echo "~/MantaRay/UnnamedProject/radFiles/opaque_materials.mat"
""",
    fireLogs=False,
    lastRunTime=8.6143,
    name="opaqueMats",
    suppressWarnings=False,
    results="~/MantaRay/UnnamedProject/radFiles/opaque_materials.mat",
    commands="""echo "void plastic Frames_0_6_mat
0
0
5 0.600 0.600 0.600 0.000 0.000
void plastic FloorBox_0_75_mat
0
0
5 0.750 0.750 0.750 0.000 0.000
void plastic Pipes_0_03_mat
0
0
5 0.030 0.030 0.030 0.000 0.000
void plastic IntWalls_0_80_mat
0
0
5 0.800 0.800 0.800 0.000 0.000
void plastic IntWalls_0_9_mat
0
0
5 0.900 0.900 0.900 0.000 0.000
void plastic ConcreteWhite_0_8_mat
0
0
5 0.800 0.800 0.800 0.000 0.000
void plastic Floor_FloorMat_0_7_mat
0
0
5 0.700 0.700 0.700 0.000 0.000
void plastic Black_0_01_mat
0
0
5 0.010 0.010 0.010 0.000 0.000
void plastic ConcreteStructure_0_3_mat
0
0
5 0.300 0.300 0.300 0.000 0.000
void plastic Cladding_0_5_mat
0
0
5 0.500 0.500 0.500 0.000 0.000
void plastic ConcreteDarker_0_1_mat
0
0
5 0.100 0.100 0.100 0.000 0.000
void plastic ConcreteGrey_0_5_mat
0
0
5 0.500 0.500 0.500 0.000 0.000
void plastic CurvedCeiling_0_80_mat
0
0
5 0.800 0.800 0.800 0.000 0.000" > ~/MantaRay/UnnamedProject/radFiles/opaque_materials.mat;echo "~/MantaRay/UnnamedProject/radFiles/opaque_materials.mat"
""")  # -> Stdout, Stderr_, Ran
opaque_mat = Text(executessh_5.Stdout)

# ----
# Setup glass materials
glassmat = GlassMat(Name=concat, Transmittance_0_1=transmittance)  # -> RadMaterials, RadMaterialList
python_7 = GhPythonScript(matname=concat)  # -> filename
# ---------- python_7: Python ----------
__author__ = "mm1013"
__version__ = "2022.07.06"

import rhinoscriptsyntax as rs

filename = matname.replace(" ","_").replace(".","_")
# ---------- end python_7 ----------
# materials
panel_28 = Panel("echo \"<mats>\" > <LinuxHome>/radFiles/<target>;echo \"<LinuxHome>/radFiles/<target>\"")
overrides_10 = ApplyOverrides(Input="<mat>.mat", Mat=graft(python_7))
overrides_11 = ApplyOverrides(Input=panel_28, Mats=graft(glassmat.RadMaterials), Target=graft(overrides_10))  # -> Output, DynamicOutput
executessh_6 = ExecuteSSH(
    _SSHCommands_=overrides_11.DynamicOutput,
    Run=executessh_4.Ran,
    addPrefix=True,
    description="""echo "void glass Glass_70_mat
0
0
3 0.763 0.763 0.763" > ~/MantaRay/UnnamedProject/radFiles/Glass_70_mat.mat;echo "~/MantaRay/UnnamedProject/radFiles/Glass_70_mat.mat"
""",
    fireLogs=False,
    lastRunTime=7.8817,
    name="glassMats",
    suppressWarnings=False,
    results="~/MantaRay/UnnamedProject/radFiles/Glass_70_mat.mat",
    commands="""echo "void glass Glass_70_mat
0
0
3 0.763 0.763 0.763" > ~/MantaRay/UnnamedProject/radFiles/Glass_70_mat.mat;echo "~/MantaRay/UnnamedProject/radFiles/Glass_70_mat.mat"
""")  # -> Stdout, Stderr_, Ran
cluster = Cluster(L=glassmat.RadMaterials)
cull_7 = CullPattern(List=executessh_6.Stdout, CullPattern=cluster)
window_mat = Text(flatten(cull_7))

# ----
# Octrees
# STANDARD octree
window_mat_2 = Text(window_mat)
opaque_mat_2 = Text(opaque_mat)
window_rad_2 = Text(window_rad)
opaque_rad_2 = Text(opaque_rad)
entwine_3 = Entwine(Branch00=window_mat_2, Branch01=window_rad_2, Branch02=opaque_mat_2, Branch03=opaque_rad_2, FlattenInputs=True)  # -> flatten(Result)

# ----
# Preview a RAD file with objpict
# can also use ra_tiff/normtiff/pfilt
# gamma will vary
# 
# check axel jacobs radiance tutorial p26
panel_29 = Panel("""mkdir -p <proj>/images/
objpict <rad> > <proj>/images/<target-.>.hdr
normtiff <proj>/images/<target-.>.hdr <proj>/images/<target-.>.tif
convert <proj>/images/<target-.>.tif <proj>/images/<target>
echo <proj>/images/<target>""")  # disabled
falsestart_3 = LBFalseStartToggle(False)
radfile = Text(flatten(entwine_3))  # disabled
panel_30 = Panel("quickRender.png")  # disabled
item_3 = ListItem(List=radfile, Index=0, Wrap=True)
panel_31 = Panel("""rad
target""")  # disabled
applyglobals = ApplyGlobals(Input=panel_29, AdditionalKeys=panel_31, AdditionalValues=[item_3, panel_30])  # -> Output, Pairs; disabled
convertpaths_8 = ConvertPaths()  # -> Linux, Windows; disabled
imageviewer = LBImageViewer(ImagePath_=convertpaths_8.Windows, _scale_=1, DisableClickable=False, SaveImgWithCoords=False, scale=1)  # -> ImagePath, Values, GIF; disabled

entwine_4 = Entwine(Branch00=window_mat_2, Branch01=window_rad_2, FlattenInputs=True)
entwine_5 = Entwine(Branch00=opaque_mat_2, Branch01=opaque_rad_2, FlattenInputs=True)

falsestart_4 = LBFalseStartToggle(True)

resolution = ValueList({"750x330": 750, "1500x750": 1500, "3000x1500": 3000, "5000x2500": 5000, "7000x3500": 7000, "8000x4000": 8000, "16000x8000": 16000, "20000x12000": 20000}, selected="5000x2500")
x = Number(resolution)

view = CreateView(Viewport="Perspective")  # -> ViewfileContent, ImageRatio
# mkdir -p ~/MantaRay/TestingRemote/images/
# mkdir -p ~/MantaRay/TestingRemote/ambientFiles/
# vwrays -ff -x 500 -y 400 -vf /home/lio/MantaRay/TestingRemote/views/Perspective2.vf -pa 1 | rtrace -as 0 -ab 3 -aa 0.2 -ad 128 -af ~/MantaRay/TestingRemote/ambientFiles/ambfile2_2022_10_06_0844_38.af -w -n 63 `vwrays -d -ff -x 500 -y 400 -vf /home/lio/MantaRay/TestingRemote/views/Perspective2.vf -pa 1` -ffc /home/lio/MantaRay/TestingRemote/octrees/my_test_scene.oct > ~/MantaRay/TestingRemote/images/2022_10_06_0844_38_Perspective_render.hdr
# echo ~/MantaRay/TestingRemote/images/2022_10_06_0844_38_Perspective_render.hdr
panel_32 = Panel(view.ViewfileContent)
panel_33 = Panel("""mkdir -p <proj>/views/
echo "<vf>" > <proj>/views/<target>.vf
echo <proj>/views/<target>.vf""")
concat_3 = Concatenate(FragmentA="Perspective", FragmentB="2")
vf = Text(view.ViewfileContent)
overrides_12 = ApplyOverrides(Input=panel_33, Vf=graft(vf), Target=graft(concat_3))  # -> Output, DynamicOutput
executessh_7 = ExecuteSSH(
    _SSHCommands_=overrides_12.DynamicOutput,
    Run=Toggle(True),
    addPrefix=True,
    description="""mkdir -p ~/MantaRay/UnnamedProject/views/
echo "rvu -vtv -vp 70.3080577621952 15.2040748185406 2.20805241662206 -vd 0.140275907282774 0.985629897679823 0.0941083133185144 -vu -0.0132599772821468 -0.0931694565731314 0.99556196460308 -vh 44.293 -vv 26.991" > ~/MantaRay/UnnamedProject/views/Perspective2.vf
echo ~/MantaRay/UnnamedProject/views/Perspective2.vf""",
    fireLogs=False,
    lastRunTime=10.2356,
    suppressWarnings=False,
    results="/home/mss/MantaRay/UnnamedProject/views/Perspective2.vf",
    commands="""mkdir -p ~/MantaRay/UnnamedProject/views/
echo "rvu -vtv -vp 70.3080577621952 15.2040748185406 2.20805241662206 -vd 0.140275907282774 0.985629897679823 0.0941083133185144 -vu -0.0132599772821468 -0.0931694565731314 0.99556196460308 -vh 44.293 -vv 26.991" > ~/MantaRay/UnnamedProject/views/Perspective2.vf
echo ~/MantaRay/UnnamedProject/views/Perspective2.vf""")  # -> Stdout, Stderr_, Ran

# ----
# Set focus zone to RAD
# to calculate parameters
type = ValueList({"Interior": "I", "Exterior": "E"}, selected="Interior")
zone = Box({Plane=PlaneXY(67.34687306, 14.8177948, 0), X=Domain(0, 14.49025655), Y=Domain(0, 18.20965901), Z=Domain(0, 13.53214381)})
zone_2 = GhPythonScript(zoneBox=zone, type=type)  # -> out, zone; inputs zoneBox: Box
# ---------- zone_2: Python ----------
__author__ = "mm1013"
__version__ = "2022.10.06"

import rhinoscriptsyntax as rs
import Rhino.Geometry as rg

import Grasshopper.Kernel as gh

#e = gh.GH_RuntimeMessageLevel.Error
w = gh.GH_RuntimeMessageLevel.Warning

zone =""

testPlane = rg.Plane(rg.Point3d(0,0,0), zoneBox.Plane.XAxis, zoneBox.Plane.YAxis)
if testPlane != rg.Plane.WorldXY:
    ghenv.Component.AddRuntimeMessage(w, "Bounding box must have XY as base plane")
else:
    zone = "ZONE={type} {Xmin:.2f} {Xmax:.2f} {Ymin:.2f} {Ymax:.2f} {Zmin:.2f} {Zmax:.2f}\n".format( \
    type=type, Xmin = zoneBox.X.Min, Xmax = zoneBox.X.Max, Ymin = zoneBox.Y.Min, Ymax = zoneBox.Y.Max, Zmin = zoneBox.Z.Min, Zmax = zoneBox.Z.Max)
# ---------- end zone_2 ----------

panel_34 = Panel("""mkdir -p <LinuxHome>/images/
vwrays -ff -x <x> -y <y> -vf <vf> -pa 1""")
panel_35 = Panel("<time>_<view>_render.hdr")
panel_36 = Panel("-ab 3 -ad 2048")

resolution_2 = ValueList({"750x330": 750, "1500x750": 1500, "3000x1500": 3000, "5000x2500": 5000, "7000x3500": 7000, "8000x4000": 8000, "16000x8000": 16000, "20000x12000": 20000}, selected="1500x750")
x_2 = Number(resolution_2)

# ----
# attempt to do overcast discretized sky (rtcontrib tutorial p20)
panel_38 = Panel("gensky 3 21 10 -c -a 51 -o 0 -m 0 -b 22.86")
falsestart_5 = LBFalseStartToggle(False)
panel_39 = Panel("""gensky 3 21 10 -c -a 51 -o 0 -m 0 -b 22.86 \
|rcalc -i '3 2 <zenithbr> <groundbr>' \
-e '$1=<groundbr>'""")
executessh_8 = ExecuteSSH(
    _SSHCommands_=panel_38,
    Run=falsestart_5,
    addPrefix=True,
    fireLogs=False,
    lastRunTime=5,
    suppressWarnings=False,
    results="""# gensky 3 21 10 -c -a 51 -o 0 -m 0 -b 22.86
# Local solar time: 9.88
# Solar altitude and azimuth: 31.9 -38.5
# Ground ambient level: 17.8

void brightfunc skyfunc
2 skybr skybright.cal
0
3 2 2.29e+01 3.56e+00""",
    commands="gensky 3 21 10 -c -a 51 -o 0 -m 0 -b 22.86")  # -> Stdout, Stderr_, Ran
python_8 = GhPythonScript(x=executessh_8.Stdout)  # -> a
# ---------- python_8: Python ----------
__author__ = "mm1013"
__version__ = "2022.09.27"

import rhinoscriptsyntax as rs

a = float(x.split("\n")[3].split(" ")[-1])
# ---------- end python_8 ----------
python_9 = GhPythonScript(x=executessh_8.Stdout)  # -> a
# ---------- python_9: Python ----------
__author__ = "mm1013"
__version__ = "2022.09.27"

import rhinoscriptsyntax as rs

a = float(x.split(" ")[-2])
# ---------- end python_9 ----------
panel_40 = Panel(executessh_8.Stdout)
overrides_13 = ApplyOverrides(Input=panel_39, Zenithbr=graft(python_9), Groundbr=graft(python_8))  # -> Output, DynamicOutput
executessh_9 = ExecuteSSH(
    _SSHCommands_=overrides_13.Output,
    Run=executessh_8.Ran,
    addPrefix=True,
    fireLogs=False,
    lastRunTime=6,
    suppressWarnings=False,
    stderr="3 2 22.9 17.8: cannot open",
    commands="""gensky 3 21 10 -c -a 51 -o 0 -m 0 -b 22.86 \
|rcalc -i '3 2 22.9 17.8' \
-e '$1=17.8'""")  # -> Stdout, Stderr_, Ran
panel_41 = Panel(executessh_9.Stderr_)

panel_42 = Panel("C:\MantaRayLinux\TestingRemote\images\2022_10_04_1601_04_Perspective1_render.hdr")
falsestart_6 = LBFalseStartToggle(False)
falsestart_7 = LBFalseStartToggle(False)

executessh_10 = ExecuteSSH(
    _SSHCommands_="pkill rtrace",
    Run=Button(),
    addPrefix=True,
    fireLogs=False,
    lastRunTime=21,
    suppressWarnings=False,
    commands="pkill rtrace")  # -> Stdout, Stderr_, Ran

falsestart_8 = LBFalseStartToggle(True)
falsestart_9 = LBFalseStartToggle(True)
download_2 = Download(
    SftpPaths=panel_42,
    Run=falsestart_7,
    stdouts="C:\Users\mm1013\MantaRay\TestingRemote\2022_10_04_1601_04_Perspective1_render.hdr")  # -> FilePaths, Status, Ran

panel_43 = Panel("""pkill rtpict
pkill rtrace""")
executessh_11 = ExecuteSSH(
    _SSHCommands_=panel_43,
    Run=Button(),
    addPrefix=True,
    fireLogs=False,
    lastRunTime=4.8128,
    suppressWarnings=False,
    commands="""pkill rtpict
pkill rtrace""")  # -> Stdout, Stderr_, Ran

falsestart_10 = LBFalseStartToggle(False)
panel_44 = Panel("/home/mss/MantaRay/UnnamedProject/myRenderX.hdr")

# ----
# Using pfilt to downscale image
# radius per Mark Stock:
# http://markjstock.org/radmisc/aa0_test/final.html
panel_45 = Panel("pfilt -x /2 -y /2 -1 -r 0.7 <file> > <file-.>_filtered.hdr;echo <file-.>_filtered.hdr")

# ---- group: Extracted Coordinates
pt = Point()

# ----
panel_46 = Panel("falsecolor -lw 0 -s 50 -n 10 -m 1.79 -l DF -p <rad-.>_exposed.hdr -i <irrad> -cp > <rad-.>_fc4_lw0.hdr;echo <rad-.>_fc4_lw0.hdr")
panel_47 = Panel("""pcond -h <rad> <rad-.>_exposed2.hdr
pcomb <rad-.>_exposed2.hdr -s 0.2 <fc> > <rad-.>_overlay.hdr
echo <rad-.>_overlay.hdr""")
panel_48 = Panel("pcomb -o <hdr> | pcompos -x 2 -y 2 - -<x> -<y> | pvalue -h -H -df | total -if3 -m | sed -r 's/[\t]+/1/g'")

# ---- group: Extracted Coordinates
pt_2 = Point([Point(811, 630, 0), Point(812, 668, 0), Point(814, 715, 0), Point(816, 753, 0), Point(816, 798, 0), Point(1312, 468, 0), Point(1308, 506, 0), Point(1305, 547, 0), Point(1305, 574, 0), Point(1299, 606, 0), Point(1627, 410, 0), Point(1619, 440, 0), Point(1614, 468, 0), Point(1608, 500, 0), Point(132, 21, 0)])

# ----
item_4 = ListItem(List=pt_2, Index=0, Wrap=True)
pdecon = Deconstruct(Point=pt_2)  # -> XComponent, YComponent, ZComponent

# ----
# Remote Connect
panel_49 = Panel("10.71.5.181")

connect_2 = ConnectSSHFTP(
    User="mm1013",
    Ip=panel_49,
    SftpDir="C:\MantaRayLinux",
    ProjectName="TestingRemote",
    Password="_prompt",
    _port=22,
    Connect=Toggle(False),
    Prefixes=". /etc/profile")  # -> Status, Prefixes, Run; disabled

panel_50 = Panel(connect_2.Status)

# ----
# Overview of all running tasks in linux
panel_51 = Panel("ps -aux | grep '<AllRadProgs>'")
logviewer_2 = LogViewer(Number=10)  # -> CurrentTasks, Logs
default = DefaultMSS(data=flatten(panel_51), default_value_flattened=flatten(logviewer_2.CurrentTasks))
panel_52 = Panel(logviewer_2.Logs)

executessh_12 = ExecuteSSH(
    _SSHCommands_=default,
    Run=Toggle(True),
    addPrefix=True,
    fireLogs=False,
    lastRunTime=14.8784,
    suppressWarnings=False,
    results="""lio      14383  0.0  0.0   7888  3580 pts/2    Ss+  08:43   0:00 /bin/bash -c . /etc/profile;ps -aux | grep 'arch2rad\|bgraph\|bsdf2klems\|bsdf2rad\|bsdf2ttree\|bsdfview\|cnt\|compamb\|cv\|dayfact\|dcglare\|dctimestep\|dgraph\|epw2wea\|ev\|fieldcomb\|findglare\|gcomp\|genBSDF\|genblinds\|genbox\|genclock\|gendaymtx\|genklemsamp\|genprism\|genrev\|gensky\|genskyvec\|gensurf\|genworm\|getbbox\|getinfo\|glare\|glarendx\|glrad\|histo\|icalc\|igraph\|lampcolor\|libmeta.a\|lookamb\|macbethcal\|meta\|meta2bmp\|meta2tga\|metafile\|mgf2meta\|mgf2rad\|mkillum\|mkpmap\|mksource\|neaten\|normpat\|normtiff\|obj2mesh\|obj2rad\|objline\|objview\|oconv\|pabopto2bsdf\|pabopto2xyz\|pcomb\|pcompos\|pcond\|pdfblur\|pexpand\|pextrem\|pfilt\|pflip\|phisto\|pinterp\|pkgBSDF\|plotin\|pmapdump\|pmblur\|pmblur2\|pmdblur\|protate\|psign\|psketch\|psmeta\|psort\|pvalue\|ra_bmp\|ra_gif\|ra_pict\|ra_ppm\|ra_ps\|ra_rgbe\|ra_t16\|ra_t8\|ra_tiff\|ra_xyze\|rad\|rad2mgf\|raddepend\|ran2tiff\|ranimate\|ranimove\|rcalc\|rcode2bmp\|rcode_depth\|rcode_ident\|rcode_norm\|rcollate\|rcontrib\|rcrop\|replmarks\|rfluxmtx\|rhcopy\|rhinfo\|rholo\|rhoptimize\|rhpict\|rlam\|rmtxop\|robjutil\|rpict\|rpiece\|rsensor\|rsplit\|rtpict\|rtrace\|rvu\|tabfunc\|tmesh2rad\|total\|trad\|ttyimage\|vwrays\|vwright\|wrapBSDF\|x11meta\|xform\|xglaresrc\|ximage\|xshowtrace\|falsecolor'
lio      14394  0.0  0.0   7556  2752 pts/2    S+   08:43   0:00 grep arch2rad\|bgraph\|bsdf2klems\|bsdf2rad\|bsdf2ttree\|bsdfview\|cnt\|compamb\|cv\|dayfact\|dcglare\|dctimestep\|dgraph\|epw2wea\|ev\|fieldcomb\|findglare\|gcomp\|genBSDF\|genblinds\|genbox\|genclock\|gendaymtx\|genklemsamp\|genprism\|genrev\|gensky\|genskyvec\|gensurf\|genworm\|getbbox\|getinfo\|glare\|glarendx\|glrad\|histo\|icalc\|igraph\|lampcolor\|libmeta.a\|lookamb\|macbethcal\|meta\|meta2bmp\|meta2tga\|metafile\|mgf2meta\|mgf2rad\|mkillum\|mkpmap\|mksource\|neaten\|normpat\|normtiff\|obj2mesh\|obj2rad\|objline\|objview\|oconv\|pabopto2bsdf\|pabopto2xyz\|pcomb\|pcompos\|pcond\|pdfblur\|pexpand\|pextrem\|pfilt\|pflip\|phisto\|pinterp\|pkgBSDF\|plotin\|pmapdump\|pmblur\|pmblur2\|pmdblur\|protate\|psign\|psketch\|psmeta\|psort\|pvalue\|ra_bmp\|ra_gif\|ra_pict\|ra_ppm\|ra_ps\|ra_rgbe\|ra_t16\|ra_t8\|ra_tiff\|ra_xyze\|rad\|rad2mgf\|raddepend\|ran2tiff\|ranimate\|ranimove\|rcalc\|rcode2bmp\|rcode_depth\|rcode_ident\|rcode_norm\|rcollate\|rcontrib\|rcrop\|replmarks\|rfluxmtx\|rhcopy\|rhinfo\|rholo\|rhoptimize\|rhpict\|rlam\|rmtxop\|robjutil\|rpict\|rpiece\|rsensor\|rsplit\|rtpict\|rtrace\|rvu\|tabfunc\|tmesh2rad\|total\|trad\|ttyimage\|vwrays\|vwright\|wrapBSDF\|x11meta\|xform\|xglaresrc\|ximage\|xshowtrace\|falsecolor""",
    stderr="""your 131072x1 screen size is bogus. expect trouble
your 131072x1 screen size is bogus. expect trouble""",
    commands="ps -aux | grep 'arch2rad\|bgraph\|bsdf2klems\|bsdf2rad\|bsdf2ttree\|bsdfview\|cnt\|compamb\|cv\|dayfact\|dcglare\|dctimestep\|dgraph\|epw2wea\|ev\|fieldcomb\|findglare\|gcomp\|genBSDF\|genblinds\|genbox\|genclock\|gendaymtx\|genklemsamp\|genprism\|genrev\|gensky\|genskyvec\|gensurf\|genworm\|getbbox\|getinfo\|glare\|glarendx\|glrad\|histo\|icalc\|igraph\|lampcolor\|libmeta.a\|lookamb\|macbethcal\|meta\|meta2bmp\|meta2tga\|metafile\|mgf2meta\|mgf2rad\|mkillum\|mkpmap\|mksource\|neaten\|normpat\|normtiff\|obj2mesh\|obj2rad\|objline\|objview\|oconv\|pabopto2bsdf\|pabopto2xyz\|pcomb\|pcompos\|pcond\|pdfblur\|pexpand\|pextrem\|pfilt\|pflip\|phisto\|pinterp\|pkgBSDF\|plotin\|pmapdump\|pmblur\|pmblur2\|pmdblur\|protate\|psign\|psketch\|psmeta\|psort\|pvalue\|ra_bmp\|ra_gif\|ra_pict\|ra_ppm\|ra_ps\|ra_rgbe\|ra_t16\|ra_t8\|ra_tiff\|ra_xyze\|rad\|rad2mgf\|raddepend\|ran2tiff\|ranimate\|ranimove\|rcalc\|rcode2bmp\|rcode_depth\|rcode_ident\|rcode_norm\|rcollate\|rcontrib\|rcrop\|replmarks\|rfluxmtx\|rhcopy\|rhinfo\|rholo\|rhoptimize\|rhpict\|rlam\|rmtxop\|robjutil\|rpict\|rpiece\|rsensor\|rsplit\|rtpict\|rtrace\|rvu\|tabfunc\|tmesh2rad\|total\|trad\|ttyimage\|vwrays\|vwright\|wrapBSDF\|x11meta\|xform\|xglaresrc\|ximage\|xshowtrace\|falsecolor'")  # -> Stdout, Stderr_, Ran

python_10 = GhPythonScript(x=executessh_12.Stdout)  # -> a
# ---------- python_10: Python ----------
__author__ = "mm1013"
__version__ = "2022.08.30"

import rhinoscriptsyntax as rs

a = [l for l in x.split("\n") if "grep" not in l]
# ---------- end python_10 ----------
panel_53 = Panel(python_10)

# ----
# Kill processes running on linux
panel_54 = Panel("pkill -f <instance>")

overrides_14 = ApplyOverrides(Input=panel_54, Instance=graft(panel_10))  # -> Output, DynamicOutput

join_2 = TextJoin(Text=flatten(overrides_14.Output), Join=";")

executessh_13 = ExecuteSSH(_SSHCommands_=join_2, Run=kill, addPrefix=True, fireLogs=False, lastRunTime=0, suppressWarnings=False)  # -> Stdout, Stderr_, Ran

# ----
# Colored skies! Why not?
# from https://discourse.radiance-online.org/t/new-tool-for-generating-colored-sky/5891
panel_55 = Panel(executessh_13.Stderr_)

# ----
# 10klx overcast sky (RwR p357)
# # start of sky definition for daylighting studies
# # location name: COPENHAGEN_DNK LAT: 55.63
# !gensky 5 14 14.0 -c -a 55.63 -o -12.67 -m -15.0 | xform -rz 0.0
# skyfunc glow sky_mat
# 0
# 0
# 4
# 1 1 1 0
# sky_mat source sky
# 0
# 0
# 4
# 0 0 1 180
# skyfunc glow ground_glow
# 0
# 0
# 4
# 1 .8 .5 0
# ground_glow source ground
# 0
# 0
# 4
# 0 0 -1 180
# # end of sky definition for daylighting studies
falsestart_11 = LBFalseStartToggle(True)
bool = Boolean(falsestart_11)
and_append_the_ground = Panel("""##The 1 will be multiplie with brightfunc
skyfunc glow sky_glow
0
0
4 1 1 1 0

##Set to 1 as it will be multiplied with the gensky result
sky_glow source sky
0
0
4 0 0 1 180

##Set to 1 as it will be multiplied with the gensky result
skyfunc glow ground_glow
0
0
4 1 1 1 0

##The ground pane
ground_glow source ground
0
0
4 0 0 -1 180""")
panel_56 = Panel("""mkdir -p <proj>/skies/
echo "<sky>" > <proj>/skies/<target>
echo "<proj>/skies/<target>"
""")

executessh_14 = ExecuteSSH(
    _SSHCommands_="gensky -ang 45 0 -c -B 55.866",
    Run=bool,
    addPrefix=True,
    fireLogs=False,
    lastRunTime=5.0589,
    suppressWarnings=False,
    results="""# gensky -ang 45 0 -c -B 55.866
# Ground ambient level: 17.8

void brightfunc skyfunc
2 skybr skybright.cal
0
3 2 2.29e+01 3.56e+00""",
    commands="gensky -ang 45 0 -c -B 55.866")  # -> Stdout, Stderr_, Ran

concat_4 = Concatenate(FragmentC="##Will control the gradient of the sky", FragmentA=executessh_14.Stdout, FragmentB=and_append_the_ground)
panel_57 = Panel(concat_4)
overrides_15 = ApplyOverrides(Input=panel_56, Sky=graft(panel_57), Target=graft("overcast_sky.rad"))  # -> Output, DynamicOutput
executessh_15 = ExecuteSSH(
    _SSHCommands_=overrides_15.DynamicOutput,
    Run=executessh_14.Ran,
    addPrefix=True,
    description="""mkdir -p ~/MantaRay/UnnamedProject/skies/
echo "##Will control the gradient of the sky
# gensky -ang 45 0 -c -B 55.866
# Ground ambient level: 17.8

void brightfunc skyfunc
2 skybr skybright.cal
0
3 2 2.29e+01 3.56e+00

##The 1 will be multiplie with brightfunc
skyfunc glow sky_glow
0
0
4 1 1 1 0

##Set to 1 as it will be multiplied with the gensky result
sky_glow source sky
0
0
4 0 0 1 180

##Set to 1 as it will be multiplied with the gensky result
skyfunc glow ground_glow
0
0
4 1 1 1 0

##The ground pane
ground_glow source ground
0
0
4 0 0 -1 180" > ~/MantaRay/UnnamedProject/skies/overcast_sky.rad
echo "~/MantaRay/UnnamedProject/skies/overcast_sky.rad"
""",
    fireLogs=False,
    lastRunTime=5.1198,
    suppressWarnings=False,
    results="""_JOIN_
_JOIN_
~/MantaRay/UnnamedProject/skies/overcast_sky.rad""",
    commands="""mkdir -p ~/MantaRay/UnnamedProject/skies/
_JOIN_
echo "##Will control the gradient of the sky
# gensky -ang 45 0 -c -B 55.866
# Ground ambient level: 17.8

void brightfunc skyfunc
2 skybr skybright.cal
0
3 2 2.29e+01 3.56e+00

##The 1 will be multiplie with brightfunc
skyfunc glow sky_glow
0
0
4 1 1 1 0

##Set to 1 as it will be multiplied with the gensky result
sky_glow source sky
0
0
4 0 0 1 180

##Set to 1 as it will be multiplied with the gensky result
skyfunc glow ground_glow
0
0
4 1 1 1 0

##The ground pane
ground_glow source ground
0
0
4 0 0 -1 180" > ~/MantaRay/UnnamedProject/skies/overcast_sky.rad
_JOIN_
echo "~/MantaRay/UnnamedProject/skies/overcast_sky.rad"
""")  # -> Stdout, Stderr_, Ran
panel_58 = Panel(overrides_15.DynamicOutput)
sky_ovc = Text(executessh_15.Stdout)

overrides_16 = ApplyOverrides(Input="cat <target>", Target=graft(executessh_15.Stdout))  # -> Output, DynamicOutput
executessh_16 = ExecuteSSH(
    _SSHCommands_=overrides_16.Output,
    Run=False,
    addPrefix=True,
    fireLogs=False,
    lastRunTime=0,
    suppressWarnings=False,
    results="""##Will control the gradient of the sky
# gensky -ang 45 0 -c -B 55.866
# Ground ambient level: 17.8

void brightfunc skyfunc
2 skybr skybright.cal
0
3 2 2.29e+01 3.56e+00

##The 1 will be multiplie with brightfunc
skyfunc glow sky_glow
0
0
4 1 1 1 0

##Set to 1 as it will be multiplied with the gensky result
sky_glow source sky
0
0
4 0 0 1 180

##Set to 1 as it will be multiplied with the gensky result
skyfunc glow ground_glow
0
0
4 1 1 1 0

##The ground pane
ground_glow source ground
0
0
4 0 0 -1 180""",
    commands="cat ~/MantaRay/UnnamedProject/skies/overcast_sky.rad")  # -> Stdout, Stderr_, Ran
panel_59 = Panel(executessh_16.Stdout)

panel_60 = Panel(executessh_15.Stderr_)

# ----
# OCTREE (overcast)
scene_rads = Text(entwine_3)
sky_ovc_2 = Text(sky_ovc)
python_11 = GhPythonScript(x=flatten(scene_rads))  # -> a; inputs x: list
# ---------- python_11: Python ----------
__author__ = "mm1013"
__version__ = "2022.06.15"

import rhinoscriptsyntax as rs

a = None not in x
# ---------- end python_11 ----------
entwine_6 = Entwine(Branch01=sky_ovc_2, Branch02=scene_rads, FlattenInputs=True)  # -> flatten(Radfiles)
panel_61 = Panel("""mkdir -p <proj>/octrees/
oconv -r 2048 -w -f <rads> > <proj>/octrees/<target>
echo <proj>/octrees/<target>""")
and = GateAnd(A=python_11, B=falsestart_4)
join_3 = TextJoin(Text=entwine_6, Join=" ")
overrides_17 = ApplyOverrides(Input=panel_61, Rads=graft(join_3), Target=graft("my_test_scene.oct"))  # -> Output, DynamicOutput
executessh_17 = ExecuteSSH(
    _SSHCommands=overrides_17.DynamicOutput,
    Run=and,
    addPrefix=True,
    description="""mkdir -p ~/MantaRay/UnnamedProject/octrees/
oconv -r 2048 -w -f ~/MantaRay/UnnamedProject/skies/overcast_sky.rad ~/MantaRay/UnnamedProject/radFiles/Glass_70_mat.mat /home/mss/MantaRay/UnnamedProject/radFiles/Glass_70.rad ~/MantaRay/UnnamedProject/radFiles/opaque_materials.mat /home/mss/MantaRay/UnnamedProject/radFiles/Frames_0_6.rad /home/mss/MantaRay/UnnamedProject/radFiles/FloorBox_0_75.rad /home/mss/MantaRay/UnnamedProject/radFiles/Pipes_0_03.rad /home/mss/MantaRay/UnnamedProject/radFiles/IntWalls_0_80.rad /home/mss/MantaRay/UnnamedProject/radFiles/IntWalls_0_9.rad /home/mss/MantaRay/UnnamedProject/radFiles/ConcreteWhite_0_8.rad /home/mss/MantaRay/UnnamedProject/radFiles/Floor_FloorMat_0_7.rad /home/mss/MantaRay/UnnamedProject/radFiles/Black_0_01.rad /home/mss/MantaRay/UnnamedProject/radFiles/ConcreteStructure_0_3.rad /home/mss/MantaRay/UnnamedProject/radFiles/Cladding_0_5.rad /home/mss/MantaRay/UnnamedProject/radFiles/ConcreteDarker_0_1.rad /home/mss/MantaRay/UnnamedProject/radFiles/ConcreteGrey_0_5.rad /home/mss/MantaRay/UnnamedProject/radFiles/CurvedCeiling_0_80.rad > ~/MantaRay/UnnamedProject/octrees/my_test_scene.oct
echo ~/MantaRay/UnnamedProject/octrees/my_test_scene.oct""",
    fireLogs=False,
    lastRunTime=6335.5822,
    suppressWarnings=False,
    results="/home/mss/MantaRay/UnnamedProject/octrees/my_test_scene.oct",
    commands="""mkdir -p ~/MantaRay/UnnamedProject/octrees/
oconv -r 2048 -w -f ~/MantaRay/UnnamedProject/skies/overcast_sky.rad ~/MantaRay/UnnamedProject/radFiles/Glass_70_mat.mat /home/mss/MantaRay/UnnamedProject/radFiles/Glass_70.rad ~/MantaRay/UnnamedProject/radFiles/opaque_materials.mat /home/mss/MantaRay/UnnamedProject/radFiles/Frames_0_6.rad /home/mss/MantaRay/UnnamedProject/radFiles/FloorBox_0_75.rad /home/mss/MantaRay/UnnamedProject/radFiles/Pipes_0_03.rad /home/mss/MantaRay/UnnamedProject/radFiles/IntWalls_0_80.rad /home/mss/MantaRay/UnnamedProject/radFiles/IntWalls_0_9.rad /home/mss/MantaRay/UnnamedProject/radFiles/ConcreteWhite_0_8.rad /home/mss/MantaRay/UnnamedProject/radFiles/Floor_FloorMat_0_7.rad /home/mss/MantaRay/UnnamedProject/radFiles/Black_0_01.rad /home/mss/MantaRay/UnnamedProject/radFiles/ConcreteStructure_0_3.rad /home/mss/MantaRay/UnnamedProject/radFiles/Cladding_0_5.rad /home/mss/MantaRay/UnnamedProject/radFiles/ConcreteDarker_0_1.rad /home/mss/MantaRay/UnnamedProject/radFiles/ConcreteGrey_0_5.rad /home/mss/MantaRay/UnnamedProject/radFiles/CurvedCeiling_0_80.rad > ~/MantaRay/UnnamedProject/octrees/my_test_scene.oct
echo ~/MantaRay/UnnamedProject/octrees/my_test_scene.oct""")  # -> Stdout, Stderr_, Ran
panel_62 = Panel(executessh_17.Stderr_)
octree_overcast = Text(executessh_17.Stdout)

panel_63 = Panel(overrides_17.Output)

# ----
# Download and preview rad files
panel_64 = Panel("<WinHome>\Downloads")
falsestart_12 = LBFalseStartToggle(False)
overrides_18 = ApplyOverrides(Input=panel_64)
falsestart_13 = LBFalseStartToggle(False)

download_3 = Download(LinuxFilePaths=flatten(entwine_4), TargetLocalFolder=overrides_18, Run=falsestart_13)  # -> FilePaths, Status, Ran
download_4 = Download(LinuxFilePaths=entwine_5, TargetLocalFolder=overrides_18, Run=falsestart_12)  # -> FilePaths, Status, Ran

cull_8 = CullPattern(List=download_3.FilePaths, CullPattern=falsestart_13)
cull_9 = CullPattern(List=download_4.FilePaths, CullPattern=falsestart_12)
radviewer = RadViewer(
    RadFiles=flatten(cull_8),
    IsTwoSided=False,
    Polychromatic=True,
    ShowEdges=True,
    Transparent=True,
    ColorNames=["GlassTak_70_mat", "GlassInt_74_mat", "GlassFacade_74_mat", "GlassBSDF_70_mat", "SkylightWall_70_mat", "SlabCeiling_80_mat", "SlabFloor_30_mat", "SlabWall_50_mat", "SlabJ_50_mat", "WallExterior_50_mat", "Roofs_50_mat", "Doors_50_mat", "FramesCW_50_mat", "FacadeBright_70_mat", "ContextBright_70_mat", "WallInterior_70_mat", "FacadeDark_30_mat", "Frames_50_mat", "Terrain_20_mat", "Buildings_50_mat", "Glass_70_mat"],
    Colors=[RGB(177, 203, 218), RGB(149, 243, 118), RGB(218, 247, 105), RGB(165, 199, 252), RGB(100, 251, 165), RGB(203, 230, 172), RGB(169, 243, 224), RGB(238, 176, 232), RGB(242, 222, 239), RGB(146, 222, 239), RGB(144, 119, 233), RGB(174, 245, 124), RGB(120, 214, 159), RGB(156, 153, 225), RGB(117, 221, 150), RGB(184, 150, 138), RGB(158, 205, 172), RGB(189, 132, 143), RGB(106, 135, 236), RGB(102, 168, 232), RGB(245, 194, 251)])  # -> Geo, ModifierNames, Modifiers, FailedWireFrame
radviewer_2 = RadViewer(
    RadFiles=flatten(cull_9),
    IsTwoSided=False,
    Polychromatic=True,
    ShowEdges=True,
    Transparent=True,
    ColorNames=["GlassTak_70_mat", "GlassInt_74_mat", "GlassFacade_74_mat", "GlassBSDF_70_mat", "SkylightWall_70_mat", "SlabCeiling_80_mat", "SlabFloor_30_mat", "SlabWall_50_mat", "SlabJ_50_mat", "WallExterior_50_mat", "Roofs_50_mat", "Doors_50_mat", "FramesCW_50_mat", "FacadeBright_70_mat", "ContextBright_70_mat", "WallInterior_70_mat", "FacadeDark_30_mat", "Frames_50_mat", "Terrain_20_mat", "Buildings_50_mat", "CurvedCeiling_0.80_mat", "ConcreteGrey_0.5_mat", "ConcreteDarker_0.1_mat", "Cladding_0.5_mat", "ConcreteStructure_0.3_mat", "Black_0.01_mat", "Floor_FloorMat_0.7_mat", "ConcreteWhite_0.8_mat", "IntWalls_0.9_mat", "IntWalls_0.80_mat", "Pipes_0.03_mat", "FloorBox_0.75_mat", "Frames_0.6_mat"],
    Colors=[RGB(177, 203, 218), RGB(149, 243, 118), RGB(218, 247, 105), RGB(165, 199, 252), RGB(100, 251, 165), RGB(203, 230, 172), RGB(169, 243, 224), RGB(238, 176, 232), RGB(242, 222, 239), RGB(146, 222, 239)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])  # -> Geo, ModifierNames, Modifiers, FailedWireFrame

# ----
# sunny sky (SET LAT AND LON)
panel_65 = Panel("gensky 7 4 <h>:00CEST +s -a <lat> -o <lon>")
falsestart_14 = LBFalseStartToggle(False)
series = Series(Start=8, Step=1, Count=10)
bool_2 = Boolean(falsestart_14)
and_append_the_ground_2 = Panel("""##The 1 will be multiplie with brightfunc
skyfunc glow sky_glow
0
0
4 1 1 1 0

##Set to 1 as it will be multiplied with the gensky result
sky_glow source sky
0
0
4 0 0 1 180

##Set to 1 as it will be multiplied with the gensky result
skyfunc glow ground_glow
0
0
4 1 1 1 0

##The ground pane
ground_glow source ground
0
0
4 0 0 -1 180""")
panel_66 = Panel("""mkdir -p <proj>/skies/
echo "<sky>" > <proj>/skies/<target>
echo "<proj>/skies/<target>"
""")
python_12 = GhPythonScript(x=series)  # -> a; inputs x: Int32
# ---------- python_12: Python ----------
__author__ = "mm1013"
__version__ = "2022.08.30"

import rhinoscriptsyntax as rs

a = "%02d00" % x
# ---------- end python_12 ----------
hours = Number(python_12)
hours_2 = Text(python_12)

overrides_19 = ApplyOverrides(Input=panel_65, H=graft(series), Lat=graft("59.9"), Lon=graft("10.7"))  # -> Output, DynamicOutput
executessh_18 = ExecuteSSH(
    _SSHCommands_=overrides_19.DynamicOutput,
    Run=bool_2,
    addPrefix=True,
    description="""gensky 7 4 8:00CEST +s -a 59.9 -o 10.7


- - -

gensky 7 4 9:00CEST +s -a 59.9 -o 10.7


- - -

gensky 7 4 10:00CEST +s -a 59.9 -o 10.7


- - -

gensky 7 4 11:00CEST +s -a 59.9 -o 10.7


- - -

gensky 7 4 12:00CEST +s -a 59.9 -o 10.7


- - -

gensky 7 4 13:00CEST +s -a 59.9 -o 10.7


- - -

gensky 7 4 14:00CEST +s -a 59.9 -o 10.7


- - -

gensky 7 4 15:00CEST +s -a 59.9 -o 10.7


- - -

gensky 7 4 16:00CEST +s -a 59.9 -o 10.7


- - -

gensky 7 4 17:00CEST +s -a 59.9 -o 10.7""",
    fireLogs=False,
    lastRunTime=0,
    suppressWarnings=False)  # -> Stdout, Stderr_, Ran

panel_67 = Panel(executessh_18.Stdout)
concat_5 = Concatenate(FragmentC="##Will control the gradient of the sky", FragmentA=executessh_18.Stdout, FragmentB=and_append_the_ground_2)

overrides_20 = ApplyOverrides(Input=panel_66, Sky=graft(concat_5), Target=graft("sunny_sky_<h>.rad"), H=graft(series))  # -> Output, DynamicOutput
executessh_19 = ExecuteSSH(
    _SSHCommands_=overrides_20.DynamicOutput,
    Run=executessh_18.Ran,
    addPrefix=True,
    description="""mkdir -p ~/MantaRay/TestingRemote/skies/
echo "##Will control the gradient of the sky


##The 1 will be multiplie with brightfunc
skyfunc glow sky_glow
0
0
4 1 1 1 0

##Set to 1 as it will be multiplied with the gensky result
sky_glow source sky
0
0
4 0 0 1 180

##Set to 1 as it will be multiplied with the gensky result
skyfunc glow ground_glow
0
0
4 1 1 1 0

##The ground pane
ground_glow source ground
0
0
4 0 0 -1 180" > ~/MantaRay/TestingRemote/skies/sunny_sky_8.rad
echo "~/MantaRay/TestingRemote/skies/sunny_sky_8.rad"


- - -

mkdir -p ~/MantaRay/TestingRemote/skies/
echo "##Will control the gradient of the sky


##The 1 will be multiplie with brightfunc
skyfunc glow sky_glow
0
0
4 1 1 1 0

##Set to 1 as it will be multiplied with the gensky result
sky_glow source sky
0
0
4 0 0 1 180

##Set to 1 as it will be multiplied with the gensky result
skyfunc glow ground_glow
0
0
4 1 1 1 0

##The ground pane
ground_glow source ground
0
0
4 0 0 -1 180" > ~/MantaRay/TestingRemote/skies/sunny_sky_9.rad
echo "~/MantaRay/TestingRemote/skies/sunny_sky_9.rad"


- - -

mkdir -p ~/MantaRay/TestingRemote/skies/
echo "##Will control the gradient of the sky


##The 1 will be multiplie with brightfunc
skyfunc glow sky_glow
0
0
4 1 1 1 0

##Set to 1 as it will be multiplied with the gensky result
sky_glow source sky
0
0
4 0 0 1 180

##Set to 1 as it will be multiplied with the gensky result
skyfunc glow ground_glow
0
0
4 1 1 1 0

##The ground pane
ground_glow source ground
0
0
4 0 0 -1 180" > ~/MantaRay/TestingRemote/skies/sunny_sky_10.rad
echo "~/MantaRay/TestingRemote/skies/sunny_sky_10.rad"


- - -

mkdir -p ~/MantaRay/TestingRemote/skies/
echo "##Will control the gradient of the sky


##The 1 will be multiplie with brightfunc
skyfunc glow sky_glow
0
0
4 1 1 1 0

##Set to 1 as it will be multiplied with the gensky result
sky_glow source sky
0
0
4 0 0 1 180

##Set to 1 as it will be multiplied with the gensky result
skyfunc glow ground_glow
0
0
4 1 1 1 0

##The ground pane
ground_glow source ground
0
0
4 0 0 -1 180" > ~/MantaRay/TestingRemote/skies/sunny_sky_11.rad
echo "~/MantaRay/TestingRemote/skies/sunny_sky_11.rad"


- - -

mkdir -p ~/MantaRay/TestingRemote/skies/
echo "##Will control the gradient of the sky


##The 1 will be multiplie with brightfunc
skyfunc glow sky_glow
0
0
4 1 1 1 0

##Set to 1 as it will be multiplied with the gensky result
sky_glow source sky
0
0
4 0 0 1 180

##Set to 1 as it will be multiplied with the gensky result
skyfunc glow ground_glow
0
0
4 1 1 1 0

##The ground pane
ground_glow source ground
0
0
4 0 0 -1 180" > ~/MantaRay/TestingRemote/skies/sunny_sky_12.rad
echo "~/MantaRay/TestingRemote/skies/sunny_sky_12.rad"


- - -

mkdir -p ~/MantaRay/TestingRemote/skies/
echo "##Will control the gradient of the sky


##The 1 will be multiplie with brightfunc
skyfunc glow sky_glow
0
0
4 1 1 1 0

##Set to 1 as it will be multiplied with the gensky result
sky_glow source sky
0
0
4 0 0 1 180

##Set to 1 as it will be multiplied with the gensky result
skyfunc glow ground_glow
0
0
4 1 1 1 0

##The ground pane
ground_glow source ground
0
0
4 0 0 -1 180" > ~/MantaRay/TestingRemote/skies/sunny_sky_13.rad
echo "~/MantaRay/TestingRemote/skies/sunny_sky_13.rad"


- - -

mkdir -p ~/MantaRay/TestingRemote/skies/
echo "##Will control the gradient of the sky


##The 1 will be multiplie with brightfunc
skyfunc glow sky_glow
0
0
4 1 1 1 0

##Set to 1 as it will be multiplied with the gensky result
sky_glow source sky
0
0
4 0 0 1 180

##Set to 1 as it will be multiplied with the gensky result
skyfunc glow ground_glow
0
0
4 1 1 1 0

##The ground pane
ground_glow source ground
0
0
4 0 0 -1 180" > ~/MantaRay/TestingRemote/skies/sunny_sky_14.rad
echo "~/MantaRay/TestingRemote/skies/sunny_sky_14.rad"


- - -

mkdir -p ~/MantaRay/TestingRemote/skies/
echo "##Will control the gradient of the sky


##The 1 will be multiplie with brightfunc
skyfunc glow sky_glow
0
0
4 1 1 1 0

##Set to 1 as it will be multiplied with the gensky result
sky_glow source sky
0
0
4 0 0 1 180

##Set to 1 as it will be multiplied with the gensky result
skyfunc glow ground_glow
0
0
4 1 1 1 0

##The ground pane
ground_glow source ground
0
0
4 0 0 -1 180" > ~/MantaRay/TestingRemote/skies/sunny_sky_15.rad
echo "~/MantaRay/TestingRemote/skies/sunny_sky_15.rad"


- - -

mkdir -p ~/MantaRay/TestingRemote/skies/
echo "##Will control the gradient of the sky


##The 1 will be multiplie with brightfunc
skyfunc glow sky_glow
0
0
4 1 1 1 0

##Set to 1 as it will be multiplied with the gensky result
sky_glow source sky
0
0
4 0 0 1 180

##Set to 1 as it will be multiplied with the gensky result
skyfunc glow ground_glow
0
0
4 1 1 1 0

##The ground pane
ground_glow source ground
0
0
4 0 0 -1 180" > ~/MantaRay/TestingRemote/skies/sunny_sky_16.rad
echo "~/MantaRay/TestingRemote/skies/sunny_sky_16.rad"


- - -

mkdir -p ~/MantaRay/TestingRemote/skies/
echo "##Will control the gradient of the sky


##The 1 will be multiplie with brightfunc
skyfunc glow sky_glow
0
0
4 1 1 1 0

##Set to 1 as it will be multiplied with the gensky result
sky_glow source sky
0
0
4 0 0 1 180

##Set to 1 as it will be multiplied with the gensky result
skyfunc glow ground_glow
0
0
4 1 1 1 0

##The ground pane
ground_glow source ground
0
0
4 0 0 -1 180" > ~/MantaRay/TestingRemote/skies/sunny_sky_17.rad
echo "~/MantaRay/TestingRemote/skies/sunny_sky_17.rad"
""",
    fireLogs=False,
    lastRunTime=0,
    suppressWarnings=False)  # -> Stdout, Stderr_, Ran

item_5 = ListItem(List=executessh_19.Stdout, Index=0, Wrap=True)  # -> Item1, Item

overrides_21 = ApplyOverrides(Input="head <target>", Target=graft(item_5.Item1))  # -> Output, DynamicOutput
executessh_20 = ExecuteSSH(
    _SSHCommands_=overrides_21.DynamicOutput,
    Run=executessh_19.Ran,
    addPrefix=True,
    description="""head <target>


- - -

head <target>


- - -

head <target>


- - -

head <target>


- - -

head <target>


- - -

head <target>


- - -

head <target>


- - -

head <target>


- - -

head <target>


- - -

head <target>""",
    fireLogs=False,
    lastRunTime=0,
    suppressWarnings=False)  # -> Stdout, Stderr_, Ran

panel_68 = Panel(executessh_20.Stdout)

panel_69 = Panel("""mkdir -p <proj>/views/
echo "<vf>" > <proj>/views/<target>.vf
echo <proj>/views/<target>.vf""")
concat_6 = Concatenate(FragmentA="Perspective", FragmentB="1")

# ----
# Doubleclick Me To update view
view_2 = CreateView(Viewport="Perspective")  # -> ViewfileContent, ImageRatio

panel_70 = Panel(view_2.ViewfileContent)
vf_2 = Text(view_2.ViewfileContent)
overrides_22 = ApplyOverrides(Input=panel_69, Vf=graft(vf_2), Target=graft(concat_6))  # -> Output, DynamicOutput
executessh_21 = ExecuteSSH(
    _SSHCommands_=overrides_22.DynamicOutput,
    Run=Toggle(True),
    addPrefix=True,
    description="""mkdir -p ~/MantaRay/TestingRemote/views/
echo "rvu -vtv -vp 124.500262783948 -29.9167556101307 24.6332558398559 -vd -0.455802345852353 0.850067782601755 -0.263873049965373 -vu -0.124693411589467 0.232552229841401 0.964557418457798 -vh 44.293 -vv 26.991" > ~/MantaRay/TestingRemote/views/Perspective1.vf
echo ~/MantaRay/TestingRemote/views/Perspective1.vf""",
    fireLogs=False,
    lastRunTime=26.6771,
    suppressWarnings=False,
    results="/home/lio/MantaRay/TestingRemote/views/Perspective1.vf",
    commands="""mkdir -p ~/MantaRay/TestingRemote/views/
echo "rvu -vtv -vp 124.500262783948 -29.9167556101307 24.6332558398559 -vd -0.455802345852353 0.850067782601755 -0.263873049965373 -vu -0.124693411589467 0.232552229841401 0.964557418457798 -vh 44.293 -vv 26.991" > ~/MantaRay/TestingRemote/views/Perspective1.vf
echo ~/MantaRay/TestingRemote/views/Perspective1.vf""")  # -> Stdout, Stderr_, Ran

# ----
# VIEW
file_exists = Panel("[ -f <out> ] && echo \"1\" || echo \"0\"")
item_6 = ListItem(List=flatten(executessh_21.Stdout), Index=0, Wrap=True)
panel_71 = Panel(executessh_21.Stdout)
overrides_23 = ApplyOverrides(Input=file_exists, Out=graft(item_6))  # -> Output, DynamicOutput
executessh_22 = ExecuteSSH(
    _SSHCommands_=overrides_23.DynamicOutput,
    Run=executessh_17.Ran,
    addPrefix=True,
    description="[ -f /home/lio/MantaRay/TestingRemote/views/Perspective1.vf ] && echo \"1\" || echo \"0\"",
    fireLogs=False,
    lastRunTime=4.9261,
    suppressWarnings=False,
    results="0",
    commands="[ -f /home/lio/MantaRay/TestingRemote/views/Perspective1.vf ] && echo \"1\" || echo \"0\"")  # -> Stdout, Stderr_, Ran

# ----
# Parallel ACCELERAD RTRACE render
# echo "rvu -vtv -vp 0.5 4.5 1.6 -vd 0.830824 -1.13002 -0.181063 -vu 0 0 1 -vh 98.2132 -vv 79.2785 -vo 0 -va 0 -vs 0 -vl 0" > <proj>/views/myview.vf;echo <proj>/views/myview.vf
run = LBFalseStartToggle(False)
octree = Text(executessh_17.Stdout)
viewfile = Text(executessh_21.Stdout)
panel_72 = Panel("""mkdir -p <proj>/images/
vwrays -ff -x <x> -y <y> -vf <vf> -pa 1 | accelerad_rtrace <radOptions> -w `vwrays -d -ff -x <x> -y <y> -vf <vf> -pa 1` -ffc <oct> > <proj>/images/<target-.>.hdr
echo <proj>/images/<target-.>.hdr""")
overrides_24 = ApplyOverrides(
    Input=panel_72,
    X=graft("600"),
    Y=graft("300"),
    Vf=graft(viewfile),
    RadOptions=graft("-as 0 -ab 3 -aa 0.2 -ad 128"),
    Oct=graft(octree),
    Target=graft("accelerad_rtrace_rendering.png"),
    Af=graft("ambfile2_<time>.af"))  # -> Output, DynamicOutput
executessh_23 = ExecuteSSH(
    _SSHCommands_=overrides_24.DynamicOutput,
    Run=run,
    addPrefix=True,
    description="""mkdir -p ~/MantaRay/UnnamedProject/images/
vwrays -ff -x 600 -y 300 -vf /home/lio/MantaRay/TestingRemote/views/Perspective1.vf -pa 1 | accelerad_rtrace -as 0 -ab 3 -aa 0.2 -ad 128 -w `vwrays -d -ff -x 600 -y 300 -vf /home/lio/MantaRay/TestingRemote/views/Perspective1.vf -pa 1` -ffc /home/mss/MantaRay/UnnamedProject/octrees/my_test_scene.oct > ~/MantaRay/UnnamedProject/images/accelerad_rtrace_rendering.hdr
echo ~/MantaRay/UnnamedProject/images/accelerad_rtrace_rendering.hdr""",
    fireLogs=False,
    lastRunTime=535,
    suppressWarnings=False,
    results="/home/mss/simulation/Boston_Skylights/images/accelerad_rtrace_rendering.hdr",
    stderr="""accelerad_rtrace: internal - A supported NVIDIA GPU could not be found
(/media/nathaniel/DATA/Accelerad/src/rt/optix_radiance.c:255)""",
    commands="""mkdir -p ~/simulation/Boston_Skylights/images/
vwrays -ff -x 600 -y 300 -vf /home/mss/MantaRay/UnnamedProject/views/Perspective1.vf -pa 1 | accelerad_rtrace -as 0 -ab 3 -aa 0.2 -ad 128 -w `vwrays -d -ff -x 600 -y 300 -vf /home/mss/MantaRay/UnnamedProject/views/Perspective1.vf -pa 1` -ffc /home/mss/MantaRay/UnnamedProject/octrees/my_test_scene.oct > ~/simulation/Boston_Skylights/images/accelerad_rtrace_rendering.hdr
echo ~/simulation/Boston_Skylights/images/accelerad_rtrace_rendering.hdr""")  # -> Stdout, Stderr_, Ran

panel_73 = Panel(overrides_24.Output)

# ----
# Using PCOND to set automatic exposure
# and convert to PNG
panel_74 = Panel("""pcond -h <hdr> <hdr-.>_exposed.hdr
ra_tiff <hdr-.>_exposed.hdr <hdr-.>_exposed.tif
convert <hdr-.>_exposed.tif <hdr-.>_exposed.png
echo <hdr-.>_exposed.png""")
overrides_25 = ApplyOverrides(Input=panel_74, Hdr=graft(executessh_23.Stdout))  # -> Output, DynamicOutput
executessh_24 = ExecuteSSH(
    _SSHCommands_=overrides_25.DynamicOutput,
    Run=executessh_23.Ran,
    addPrefix=True,
    description="""pcond -h /home/mss/simulation/Boston_Skylights/images/accelerad_rtrace_rendering.hdr /home/mss/simulation/Boston_Skylights/images/accelerad_rtrace_rendering_exposed.hdr
ra_tiff /home/mss/simulation/Boston_Skylights/images/accelerad_rtrace_rendering_exposed.hdr /home/mss/simulation/Boston_Skylights/images/accelerad_rtrace_rendering_exposed.tif
convert /home/mss/simulation/Boston_Skylights/images/accelerad_rtrace_rendering_exposed.tif /home/mss/simulation/Boston_Skylights/images/accelerad_rtrace_rendering_exposed.png
echo /home/mss/simulation/Boston_Skylights/images/accelerad_rtrace_rendering_exposed.png""",
    fireLogs=False,
    lastRunTime=546,
    suppressWarnings=False,
    results="/home/mss/MantaRay/UnnamedProject/images/rtrace_rendering_exposed.png",
    commands="""pcond -h /home/mss/MantaRay/UnnamedProject/images/rtrace_rendering.hdr /home/mss/MantaRay/UnnamedProject/images/rtrace_rendering_exposed.hdr
ra_tiff /home/mss/MantaRay/UnnamedProject/images/rtrace_rendering_exposed.hdr /home/mss/MantaRay/UnnamedProject/images/rtrace_rendering_exposed.tif
convert /home/mss/MantaRay/UnnamedProject/images/rtrace_rendering_exposed.tif /home/mss/MantaRay/UnnamedProject/images/rtrace_rendering_exposed.png
echo /home/mss/MantaRay/UnnamedProject/images/rtrace_rendering_exposed.png""")  # -> Stdout, Stderr_, Ran
download_5 = Download(
    LinuxFilePaths=executessh_24.Stdout,
    Run=executessh_24.Ran,
    stdouts="C:\Users\mm1013\MantaRay\UnnamedProject\rtrace_rendering_exposed.png")  # -> FilePaths, Status, Ran
imageviewer_2 = LBImageViewer(ImagePath_=download_5.FilePaths, _scale_="1.5", DisableClickable=False, SaveImgWithCoords=False, scale=1.5)  # -> ImagePath, Values, GIF

panel_75 = Panel(executessh_23.Stderr_)

# ----
# OCTREE (Sunny - 10 hourly skies!)
scene_rads_2 = Text(entwine_3)
falsestart_15 = LBFalseStartToggle(False)
python_13 = GhPythonScript(x=flatten(scene_rads_2))  # -> a; inputs x: list; same code as python_11
entwine_7 = Entwine(Branch02=scene_rads_2, FlattenInputs=True)  # -> flatten(Radfiles)
panel_76 = Panel("""mkdir -p <proj>/octrees/
oconv -r 2048 -f -w <rads> > <proj>/octrees/<target>
echo <proj>/octrees/<target>""")
join_4 = TextJoin(Text=entwine_7, Join=" ")
panel_77 = Panel("oconv -r 2048 -i <oldOct> -f <newRads> > <proj>/octrees/<target>_<h>.oct;echo <proj>/octrees/<target>_<h>.oct")
sky_sunny = Text(graft(item_5.Item1))
hours_3 = Text(hours_2)

overrides_26 = ApplyOverrides(Input=panel_76, Rads=graft(join_4), Target=graft("my_test_scene_NOSKY.oct"))  # -> Output, DynamicOutput
executessh_25 = ExecuteSSH(
    _SSHCommands_=overrides_26.DynamicOutput,
    Run=[python_13, falsestart_15],
    addPrefix=True,
    description="""mkdir -p ~/MantaRay/UnnamedProject/octrees/
oconv -r 2048 -f -w ~/MantaRay/UnnamedProject/radFiles/Glass_70_mat.mat /home/mss/MantaRay/UnnamedProject/radFiles/Glass_70.rad ~/MantaRay/UnnamedProject/radFiles/opaque_materials.mat /home/mss/MantaRay/UnnamedProject/radFiles/Frames_0_6.rad /home/mss/MantaRay/UnnamedProject/radFiles/FloorBox_0_75.rad /home/mss/MantaRay/UnnamedProject/radFiles/Pipes_0_03.rad /home/mss/MantaRay/UnnamedProject/radFiles/IntWalls_0_80.rad /home/mss/MantaRay/UnnamedProject/radFiles/IntWalls_0_9.rad /home/mss/MantaRay/UnnamedProject/radFiles/ConcreteWhite_0_8.rad /home/mss/MantaRay/UnnamedProject/radFiles/Floor_FloorMat_0_7.rad /home/mss/MantaRay/UnnamedProject/radFiles/Black_0_01.rad /home/mss/MantaRay/UnnamedProject/radFiles/ConcreteStructure_0_3.rad /home/mss/MantaRay/UnnamedProject/radFiles/Cladding_0_5.rad /home/mss/MantaRay/UnnamedProject/radFiles/ConcreteDarker_0_1.rad /home/mss/MantaRay/UnnamedProject/radFiles/ConcreteGrey_0_5.rad /home/mss/MantaRay/UnnamedProject/radFiles/CurvedCeiling_0_80.rad > ~/MantaRay/UnnamedProject/octrees/my_test_scene_NOSKY.oct
echo ~/MantaRay/UnnamedProject/octrees/my_test_scene_NOSKY.oct""",
    fireLogs=False,
    lastRunTime=0,
    suppressWarnings=False,
    commands="""mkdir -p ~/MantaRay/UnnamedProject/octrees/
oconv -r 2048 -f -w ~/MantaRay/UnnamedProject/radFiles/Glass_70_mat.mat ~/MantaRay/UnnamedProject/radFiles/Glass_70.rad ~/MantaRay/UnnamedProject/radFiles/opaque_materials.mat ~/MantaRay/UnnamedProject/radFiles/CurvedCeiling_0.80.rad ~/MantaRay/UnnamedProject/radFiles/ConcreteGrey_0.5.rad ~/MantaRay/UnnamedProject/radFiles/ConcreteDarker_0.1.rad ~/MantaRay/UnnamedProject/radFiles/Cladding_0.5.rad ~/MantaRay/UnnamedProject/radFiles/ConcreteStructure_0.3.rad ~/MantaRay/UnnamedProject/radFiles/Black_0.01.rad ~/MantaRay/UnnamedProject/radFiles/Floor_FloorMat_0.7.rad ~/MantaRay/UnnamedProject/radFiles/ConcreteWhite_0.8.rad ~/MantaRay/UnnamedProject/radFiles/IntWalls_0.9.rad ~/MantaRay/UnnamedProject/radFiles/IntWalls_0.80.rad ~/MantaRay/UnnamedProject/radFiles/Pipes_0.03.rad ~/MantaRay/UnnamedProject/radFiles/FloorBox_0.75.rad ~/MantaRay/UnnamedProject/radFiles/Frames_0.6.rad > ~/MantaRay/UnnamedProject/octrees/my_test_scene_NOSKY.oct
echo ~/MantaRay/UnnamedProject/octrees/my_test_scene_NOSKY.oct""")  # -> Stdout, Stderr_, Ran
overrides_27 = ApplyOverrides(
    Input=panel_77,
    OldOct=graft(executessh_25.Stdout),
    NewRads=graft(sky_sunny),
    Target=graft("my_test_scene"),
    H=graft(hours_3))  # -> Output, DynamicOutput

panel_78 = Panel(executessh_25.Stdout)

executessh_26 = ExecuteSSH(
    _SSHCommands_=overrides_27.DynamicOutput,
    Run=executessh_25.Ran,
    addPrefix=True,
    description="""oconv -r 2048 -i  -f <newRads> > ~/MantaRay/UnnamedProject/octrees/my_test_scene_0800.oct;echo ~/MantaRay/UnnamedProject/octrees/my_test_scene_0800.oct


- - -

oconv -r 2048 -i  -f <newRads> > ~/MantaRay/UnnamedProject/octrees/my_test_scene_0900.oct;echo ~/MantaRay/UnnamedProject/octrees/my_test_scene_0900.oct


- - -

oconv -r 2048 -i  -f <newRads> > ~/MantaRay/UnnamedProject/octrees/my_test_scene_1000.oct;echo ~/MantaRay/UnnamedProject/octrees/my_test_scene_1000.oct


- - -

oconv -r 2048 -i  -f <newRads> > ~/MantaRay/UnnamedProject/octrees/my_test_scene_1100.oct;echo ~/MantaRay/UnnamedProject/octrees/my_test_scene_1100.oct


- - -

oconv -r 2048 -i  -f <newRads> > ~/MantaRay/UnnamedProject/octrees/my_test_scene_1200.oct;echo ~/MantaRay/UnnamedProject/octrees/my_test_scene_1200.oct


- - -

oconv -r 2048 -i  -f <newRads> > ~/MantaRay/UnnamedProject/octrees/my_test_scene_1300.oct;echo ~/MantaRay/UnnamedProject/octrees/my_test_scene_1300.oct


- - -

oconv -r 2048 -i  -f <newRads> > ~/MantaRay/UnnamedProject/octrees/my_test_scene_1400.oct;echo ~/MantaRay/UnnamedProject/octrees/my_test_scene_1400.oct


- - -

oconv -r 2048 -i  -f <newRads> > ~/MantaRay/UnnamedProject/octrees/my_test_scene_1500.oct;echo ~/MantaRay/UnnamedProject/octrees/my_test_scene_1500.oct


- - -

oconv -r 2048 -i  -f <newRads> > ~/MantaRay/UnnamedProject/octrees/my_test_scene_1600.oct;echo ~/MantaRay/UnnamedProject/octrees/my_test_scene_1600.oct


- - -

oconv -r 2048 -i  -f <newRads> > ~/MantaRay/UnnamedProject/octrees/my_test_scene_1700.oct;echo ~/MantaRay/UnnamedProject/octrees/my_test_scene_1700.oct""",
    fireLogs=False,
    lastRunTime=0,
    suppressWarnings=False)  # -> Stdout, Stderr_, Ran

# ----
# Parallel RTPICT render (luminance)
viewfile_2 = Text(executessh_21.Stdout)
octree_2 = Text(executessh_26.Stdout)
panel_79 = Panel("""mkdir -p <proj>/images/
rtpict -n 11 -vf <vf> -x <x> -y <y> -o <proj>/images/<target> <radOptions> <oct>;echo <proj>/images/<target>""")
resolution_3 = ValueList({"750x330": 750, "1500x750": 1500, "3000x1500": 3000, "5000x2500": 5000, "7000x3500": 7000, "8000x4000": 8000}, selected="1500x750")
division = Division(A=resolution_3, B=2)
run_2 = LBFalseStartToggle(False)
python_14 = GhPythonScript(update=run_2)  # -> time; inputs update: tree
# ---------- python_14: Python ----------
__author__ = "mm1013"
__version__ = "2022.08.30"

import rhinoscriptsyntax as rs

from datetime import datetime
dt = datetime.now()

time = "%02d_%02d_%02d_%02d%02d" % (dt.year, dt.month, dt.day, dt.hour, dt.minute)
# ---------- end python_14 ----------
hours_4 = Number(hours)

overrides_28 = ApplyOverrides(
    Input=panel_79,
    Vf=graft(viewfile_2),
    X=graft(resolution_3),
    Y=graft(division),
    Target=graft("<time>_rtpict_rendering_aa0_<x>_sunny_ad32_<h>.hdr"),
    RadOptions=graft("-ab 3 -ad 32 -aa 0"),
    Oct=graft(octree_2),
    Time=graft(python_14),
    H=graft(hours_4))  # -> Output, DynamicOutput
executessh_27 = ExecuteSSH(
    _SSHCommands_=overrides_28.DynamicOutput,
    Run=run_2,
    addPrefix=True,
    description="""mkdir -p ~/MantaRay/UnnamedProject/images/
rtpict -n 11 -vf /home/lio/MantaRay/TestingRemote/views/Perspective1.vf -x 1500 -y 750 -o ~/MantaRay/UnnamedProject/images/2022_10_06_0843_rtpict_rendering_aa0_1500_sunny_ad32_800.hdr -ab 3 -ad 32 -aa 0 <oct>;echo ~/MantaRay/UnnamedProject/images/2022_10_06_0843_rtpict_rendering_aa0_1500_sunny_ad32_800.hdr


- - -

mkdir -p ~/MantaRay/UnnamedProject/images/
rtpict -n 11 -vf /home/lio/MantaRay/TestingRemote/views/Perspective1.vf -x 1500 -y 750 -o ~/MantaRay/UnnamedProject/images/2022_10_06_0843_rtpict_rendering_aa0_1500_sunny_ad32_900.hdr -ab 3 -ad 32 -aa 0 <oct>;echo ~/MantaRay/UnnamedProject/images/2022_10_06_0843_rtpict_rendering_aa0_1500_sunny_ad32_900.hdr


- - -

mkdir -p ~/MantaRay/UnnamedProject/images/
rtpict -n 11 -vf /home/lio/MantaRay/TestingRemote/views/Perspective1.vf -x 1500 -y 750 -o ~/MantaRay/UnnamedProject/images/2022_10_06_0843_rtpict_rendering_aa0_1500_sunny_ad32_1000.hdr -ab 3 -ad 32 -aa 0 <oct>;echo ~/MantaRay/UnnamedProject/images/2022_10_06_0843_rtpict_rendering_aa0_1500_sunny_ad32_1000.hdr


- - -

mkdir -p ~/MantaRay/UnnamedProject/images/
rtpict -n 11 -vf /home/lio/MantaRay/TestingRemote/views/Perspective1.vf -x 1500 -y 750 -o ~/MantaRay/UnnamedProject/images/2022_10_06_0843_rtpict_rendering_aa0_1500_sunny_ad32_1100.hdr -ab 3 -ad 32 -aa 0 <oct>;echo ~/MantaRay/UnnamedProject/images/2022_10_06_0843_rtpict_rendering_aa0_1500_sunny_ad32_1100.hdr


- - -

mkdir -p ~/MantaRay/UnnamedProject/images/
rtpict -n 11 -vf /home/lio/MantaRay/TestingRemote/views/Perspective1.vf -x 1500 -y 750 -o ~/MantaRay/UnnamedProject/images/2022_10_06_0843_rtpict_rendering_aa0_1500_sunny_ad32_1200.hdr -ab 3 -ad 32 -aa 0 <oct>;echo ~/MantaRay/UnnamedProject/images/2022_10_06_0843_rtpict_rendering_aa0_1500_sunny_ad32_1200.hdr


- - -

mkdir -p ~/MantaRay/UnnamedProject/images/
rtpict -n 11 -vf /home/lio/MantaRay/TestingRemote/views/Perspective1.vf -x 1500 -y 750 -o ~/MantaRay/UnnamedProject/images/2022_10_06_0843_rtpict_rendering_aa0_1500_sunny_ad32_1300.hdr -ab 3 -ad 32 -aa 0 <oct>;echo ~/MantaRay/UnnamedProject/images/2022_10_06_0843_rtpict_rendering_aa0_1500_sunny_ad32_1300.hdr


- - -

mkdir -p ~/MantaRay/UnnamedProject/images/
rtpict -n 11 -vf /home/lio/MantaRay/TestingRemote/views/Perspective1.vf -x 1500 -y 750 -o ~/MantaRay/UnnamedProject/images/2022_10_06_0843_rtpict_rendering_aa0_1500_sunny_ad32_1400.hdr -ab 3 -ad 32 -aa 0 <oct>;echo ~/MantaRay/UnnamedProject/images/2022_10_06_0843_rtpict_rendering_aa0_1500_sunny_ad32_1400.hdr


- - -

mkdir -p ~/MantaRay/UnnamedProject/images/
rtpict -n 11 -vf /home/lio/MantaRay/TestingRemote/views/Perspective1.vf -x 1500 -y 750 -o ~/MantaRay/UnnamedProject/images/2022_10_06_0843_rtpict_rendering_aa0_1500_sunny_ad32_1500.hdr -ab 3 -ad 32 -aa 0 <oct>;echo ~/MantaRay/UnnamedProject/images/2022_10_06_0843_rtpict_rendering_aa0_1500_sunny_ad32_1500.hdr


- - -

mkdir -p ~/MantaRay/UnnamedProject/images/
rtpict -n 11 -vf /home/lio/MantaRay/TestingRemote/views/Perspective1.vf -x 1500 -y 750 -o ~/MantaRay/UnnamedProject/images/2022_10_06_0843_rtpict_rendering_aa0_1500_sunny_ad32_1600.hdr -ab 3 -ad 32 -aa 0 <oct>;echo ~/MantaRay/UnnamedProject/images/2022_10_06_0843_rtpict_rendering_aa0_1500_sunny_ad32_1600.hdr


- - -

mkdir -p ~/MantaRay/UnnamedProject/images/
rtpict -n 11 -vf /home/lio/MantaRay/TestingRemote/views/Perspective1.vf -x 1500 -y 750 -o ~/MantaRay/UnnamedProject/images/2022_10_06_0843_rtpict_rendering_aa0_1500_sunny_ad32_1700.hdr -ab 3 -ad 32 -aa 0 <oct>;echo ~/MantaRay/UnnamedProject/images/2022_10_06_0843_rtpict_rendering_aa0_1500_sunny_ad32_1700.hdr""",
    fireLogs=False,
    lastRunTime=0,
    suppressWarnings=False)  # -> Stdout, Stderr_, Ran
overrides_29 = ApplyOverrides(Input=panel_45, File=graft(executessh_27.Stdout))  # -> Output, DynamicOutput
executessh_28 = ExecuteSSH(
    _SSHCommands_=overrides_29.DynamicOutput,
    Run=executessh_27.Ran,
    addPrefix=True,
    description="""pfilt -x /2 -y /2 -1 -r 0.7 <file> > <file>_filtered.hdr;echo <file>_filtered.hdr


- - -

pfilt -x /2 -y /2 -1 -r 0.7 <file> > <file>_filtered.hdr;echo <file>_filtered.hdr


- - -

pfilt -x /2 -y /2 -1 -r 0.7 <file> > <file>_filtered.hdr;echo <file>_filtered.hdr


- - -

pfilt -x /2 -y /2 -1 -r 0.7 <file> > <file>_filtered.hdr;echo <file>_filtered.hdr


- - -

pfilt -x /2 -y /2 -1 -r 0.7 <file> > <file>_filtered.hdr;echo <file>_filtered.hdr


- - -

pfilt -x /2 -y /2 -1 -r 0.7 <file> > <file>_filtered.hdr;echo <file>_filtered.hdr


- - -

pfilt -x /2 -y /2 -1 -r 0.7 <file> > <file>_filtered.hdr;echo <file>_filtered.hdr


- - -

pfilt -x /2 -y /2 -1 -r 0.7 <file> > <file>_filtered.hdr;echo <file>_filtered.hdr


- - -

pfilt -x /2 -y /2 -1 -r 0.7 <file> > <file>_filtered.hdr;echo <file>_filtered.hdr


- - -

pfilt -x /2 -y /2 -1 -r 0.7 <file> > <file>_filtered.hdr;echo <file>_filtered.hdr""",
    fireLogs=False,
    lastRunTime=0,
    suppressWarnings=False)  # -> Stdout, Stderr_, Ran

# ----
# overture should now automatically be included in rtpict
# Parallel RTPICT render with ambient cache
viewfile_3 = Text(executessh_21.Stdout)
octree_3 = Text(executessh_26.Stdout)
modifierlist = Text(flatten(concat_2))
octree_overcast_2 = Text(octree_overcast)
entwine_8 = Entwine(Branch00=octree_overcast_2, Branch01=octree_3, FlattenInputs=True)  # -> flatten(Result)
division_2 = Division(A=resolution, B=1.5)
octree_4 = Text(graft(entwine_8))
list = ItemSelector(
    octree_4,
    {"/home/mss/MantaRay/UnnamedProject/octrees/my_test_scene.oct"}, selected="/home/mss/MantaRay/UnnamedProject/octrees/my_test_scene.oct")
y = Number(division_2)
eval = Evaluate(F="x=y", x=octree_4, y=list)
panel_80 = Panel("-ab 3 -ad 4096 -lw 0.0003 -aa 0.1 -ar 256 -as 1024")
panel_81 = Panel("""mkdir -p <proj>/images/
rtpict -n <cpus-1> -w -vf <vf> -x 400 -y 300 <radOptions> -af <ambFile> <oct> > /dev/null
rtpict -n <cpus-1> -w -vf <vf> -x <x> -y <y> <radOptions> -af <ambFile> <oct> | pfilt -x /2 -y /2 > <proj>/images/<target>;echo <proj>/images/<target>""")
x_3 = Number(x)
y_2 = Number(y)
run_3 = LBFalseStartToggle(False)
python_15 = GhPythonScript()  # -> time; inputs update: tree
# ---------- python_15: Python ----------
#if not update:
#    return self.time
"""Provides a scripting component.
    Inputs:
        x: The x script variable
        y: The y script variable
    Output:
        a: The a output variable"""
        
__author__ = "mm1013"
__version__ = "2022.08.30"
        
import rhinoscriptsyntax as rs
        
from datetime import datetime
dt = datetime.now()
        
time = "%02d_%02d_%02d_%02d%02d_%02d" % (dt.year, dt.month, dt.day, dt.hour, dt.minute, dt.second)
# ---------- end python_15 ----------

# ----
# exclude frames
panel_82 = Panel("frames")
python_16 = GhPythonScript(opaqueModifiers=modifierlist, search=panel_82)  # -> a; inputs opaqueModifiers: list, search: list
# ---------- python_16: Python ----------
__author__ = "mm1013"
__version__ = "2022.09.05"

import rhinoscriptsyntax as rs
#import Grasshopper.DataTree as dt
import ghpythonlib.treehelpers as th


o = []
for l in search:
    o.append([s for s in opaqueModifiers if l.lower() in s.lower()])
    

a = th.list_to_tree(o)
# ---------- end python_16 ----------
overrides_30 = ApplyOverrides(Input="-ae <modifier>", Modifier=graft(python_16))  # -> Output, DynamicOutput
join_5 = TextJoin(Text=flatten(overrides_30.Output), Join=" ")

hours_5 = Text(hours_2)
entwine_9 = Entwine(Branch00="ovc", Branch01=hours_5, FlattenInputs=True)  # -> flatten(Result)
cull_10 = CullPattern(List=graft(entwine_9), CullPattern=eval)  # -> flatten(List)
hours_6 = Text(cull_10)

# ----
# Parallel RTRACE render (illuminance)
# echo "rvu -vtv -vp 0.5 4.5 1.6 -vd 0.830824 -1.13002 -0.181063 -vu 0 0 1 -vh 98.2132 -vv 79.2785 -vo 0 -va 0 -vs 0 -vl 0" > <proj>/views/myview.vf;echo <proj>/views/myview.vf
run_4 = LBFalseStartToggle(False)
panel_83 = Panel("""mkdir -p <proj>/images/
vwrays -ff -x <x> -y <y> -vf <vf> -pa 1 | rtrace -i <radOptions> -af <af> -w -n 11 `vwrays -d -ff -x <x> -y <y> -vf <vf> -pa 1` -ffc <oct> > <proj>/images/<target-.>.hdr
echo <proj>/images/<target-.>.hdr""")
octree_5 = Text(executessh_17.Stdout)
viewfile_4 = Text(executessh_21.Stdout)

python_17 = GhPythonScript(x=viewfile_4)  # -> a
# ---------- python_17: Python ----------
__author__ = "mm1013"
__version__ = "2022.09.13"

import rhinoscriptsyntax as rs

a = x.split("/")[-1].split(".")[0]
# ---------- end python_17 ----------

# ----
# Parallel RTRACE render
# echo "rvu -vtv -vp 0.5 4.5 1.6 -vd 0.830824 -1.13002 -0.181063 -vu 0 0 1 -vh 98.2132 -vv 79.2785 -vo 0 -va 0 -vs 0 -vl 0" > <proj>/views/myview.vf;echo <proj>/views/myview.vf
run_5 = LBFalseStartToggle(True)
octree_6 = Text(executessh_17.Stdout)
viewfile_5 = Text(executessh_21.Stdout)
panel_84 = Panel("""mkdir -p <LinuxHome>/images/
mkdir -p <LinuxHome>/ambientFiles/
vwrays -ff -x <x> -y <y> -vf <vf> -pa 1 | rtrace <radOptions> -af <LinuxHome>/ambientFiles/<af> -w -n <cpus> `vwrays -d -ff -x <x> -y <y> -vf <vf> -pa 1` -ffc -e <LinuxHome>/ambientFiles/<target-.>.err <oct> > <LinuxHome>/images/<target-.>.hdr
echo <LinuxHome>/images/<target-.>.hdr""")
panel_85 = Panel("-as 0 -ab 3 -aa 0.0 -ad 128")
overrides_31 = ApplyOverrides(
    Input=panel_84,
    X=graft("2500"),
    Y=graft("2000"),
    Vf=graft("<vf>"),
    RadOptions=graft(panel_85),
    Oct=graft(octree_6),
    Target=graft(panel_35),
    Af=graft("<af>"),
    Time=graft("<time>"),
    View=graft("<view>"))  # -> Output, DynamicOutput

python_18 = GhPythonScript(x=viewfile_5)  # -> a; same code as python_17
overrides_32 = ApplyOverrides(
    Input=panel_34,
    X=graft("2500"),
    Y=graft("2000"),
    Vf=graft("<vf>"),
    RadOptions=graft(panel_85),
    Oct=graft(octree_6),
    Target=graft(panel_35),
    Af=graft("<af>"),
    Time=graft("<time>"),
    View=graft("<view>"))  # -> Output, DynamicOutput
panel_86 = Panel(overrides_31.Output)
python_19 = GhPythonScript(update=overrides_31.Output)  # -> time; inputs update: tree; same code as python_15

overrides_33 = ApplyOverrides(
    Input=panel_83,
    X=graft("2500"),
    Y=graft("2000"),
    Vf=graft(viewfile_4),
    RadOptions=graft(panel_85),
    Oct=graft(octree_5),
    Target=graft("<time>_<view>_render_illum.hdr"),
    Af=graft("ambfile2_<time>.af"),
    Time=graft(python_19),
    View=graft(python_17))  # -> Output, DynamicOutput
executessh_29 = ExecuteSSH(
    _SSHCommands_=overrides_33.DynamicOutput,
    Run=run_4,
    addPrefix=True,
    description="""mkdir -p ~/MantaRay/UnnamedProject/images/
vwrays -ff -x 2500 -y 2000 -vf /home/lio/MantaRay/TestingRemote/views/Perspective1.vf -pa 1 | rtrace -i -as 0 -ab 3 -aa 0.0 -ad 128 -af ambfile2_2022_10_06_1035_44.af -w -n 11 `vwrays -d -ff -x 2500 -y 2000 -vf /home/lio/MantaRay/TestingRemote/views/Perspective1.vf -pa 1` -ffc /home/mss/MantaRay/UnnamedProject/octrees/my_test_scene.oct > ~/MantaRay/UnnamedProject/images/2022_10_06_1035_44_Perspective1_render_illum.hdr
echo ~/MantaRay/UnnamedProject/images/2022_10_06_1035_44_Perspective1_render_illum.hdr""",
    fireLogs=False,
    lastRunTime=6403,
    suppressWarnings=False,
    results="/home/mss/MantaRay/UnnamedProject/images/2022_09_28_1341_29_Perspective1_render_illum.hdr",
    commands="""mkdir -p ~/MantaRay/UnnamedProject/images/
vwrays -ff -x 2000 -y 1100 -vf /home/mss/MantaRay/UnnamedProject/views/Perspective1.vf -pa 1 | rtrace -i -as 0 -ab 3 -aa 0.2 -ad 128 -af ambfile2_2022_09_28_1341_29.af -w -n 11 `vwrays -d -ff -x 2000 -y 1100 -vf /home/mss/MantaRay/UnnamedProject/views/Perspective1.vf -pa 1` -ffc /home/mss/MantaRay/UnnamedProject/octrees/my_test_scene.oct > ~/MantaRay/UnnamedProject/images/2022_09_28_1341_29_Perspective1_render_illum.hdr
echo ~/MantaRay/UnnamedProject/images/2022_09_28_1341_29_Perspective1_render_illum.hdr""")  # -> Stdout, Stderr_, Ran

overrides_34 = ApplyOverrides(
    Input=overrides_31.DynamicOutput,
    Time=graft(python_19),
    View=graft("Perspective"),
    Vf=graft(executessh_7.Stdout),
    Af=graft("ambfile2_<time>.af"))  # -> Output, DynamicOutput

executessh_30 = ExecuteSSH(
    _SSHCommands_=overrides_34.Output,
    Run=run_5,
    addPrefix=True,
    fireLogs=False,
    lastRunTime=686914.1922,
    suppressWarnings=False,
    results="/home/mss/MantaRay/UnnamedProject/images/2022_10_06_1035_44_Perspective_render.hdr",
    commands="""mkdir -p ~/MantaRay/UnnamedProject/images/
mkdir -p ~/MantaRay/UnnamedProject/ambientFiles/
vwrays -ff -x 2500 -y 2000 -vf /home/mss/MantaRay/UnnamedProject/views/Perspective2.vf -pa 1 | rtrace -as 0 -ab 3 -aa 0.0 -ad 128 -af ~/MantaRay/UnnamedProject/ambientFiles/ambfile2_2022_10_06_1035_44.af -w -n 11 `vwrays -d -ff -x 2500 -y 2000 -vf /home/mss/MantaRay/UnnamedProject/views/Perspective2.vf -pa 1` -ffc -e ~/MantaRay/UnnamedProject/ambientFiles/2022_10_06_1035_44_Perspective_render.err /home/mss/MantaRay/UnnamedProject/octrees/my_test_scene.oct > ~/MantaRay/UnnamedProject/images/2022_10_06_1035_44_Perspective_render.hdr
echo ~/MantaRay/UnnamedProject/images/2022_10_06_1035_44_Perspective_render.hdr""")  # -> Stdout, Stderr_, Ran

panel_87 = Panel(executessh_30.Stderr_)
convertpaths_9 = ConvertPaths(I=executessh_30.Stdout)  # -> Linux, Windows, Sftp
overrides_35 = ApplyOverrides(
    Input="cat <LinuxHome>/ambientFiles/<target-.>.err",
    target=graft(panel_35),
    time=graft(python_19),
    view=graft("Perspective"))  # -> Output, DynamicOutput
or = GateOr(A=falsestart_6, B=executessh_30.Ran)
panel_88 = Panel(convertpaths_9.Linux)
executessh_31 = ExecuteSSH(
    _SSHCommands_=overrides_35.Output,
    Run=falsestart_8,
    addPrefix=True,
    fireLogs=False,
    lastRunTime=8.1867,
    suppressWarnings=False,
    results="""**************
*** PID  1339: rtrace -as 0 -ab 3 -aa 0.0 -ad 128 -af /home/mss/MantaRay/UnnamedProject/ambientFiles/ambfile2_2022_10_06_1035_44.af -w -n 11 -x 2500 -y 1474 -ld- -ffc -e /home/mss/MantaRay/UnnamedProject/ambientFiles/2022_10_06_1035_44_Perspective_render.err /home/mss/MantaRay/UnnamedProject/octrees/my_test_scene.oct""",
    commands="cat ~/MantaRay/UnnamedProject/ambientFiles/2022_10_06_1035_44_Perspective_render.err")  # -> Stdout, Stderr_, Ran
python_20 = GhPythonScript(errIn=executessh_31.Stdout)  # -> pid, run
# ---------- python_20: Python ----------
__author__ = "mm1013"
__version__ = "2022.10.06"

import rhinoscriptsyntax as rs

start = errIn.split(":")[0].split(" ")[-1]
print(start)
try:
    pid = int(start)
    run = True
except:
    run = False
# ---------- end python_20 ----------
overrides_36 = ApplyOverrides(Input="kill <pid>", Text=graft(python_20.pid))  # -> Output, DynamicOutput
panel_89 = Panel(executessh_31.Stdout)

# ----
# Using PCOND to set automatic exposure
# and convert to PNG
panel_90 = Panel("""pcond -h <hdr> <hdr-.>_exposed.hdr
ra_tiff <hdr-.>_exposed.hdr <hdr-.>_exposed.tif
convert <hdr-.>_exposed.tif <hdr-.>_exposed.png
echo <hdr-.>_exposed.png""")
overrides_37 = ApplyOverrides(Input=panel_90, Hdr=graft(executessh_29.Stdout))  # -> Output, DynamicOutput
executessh_32 = ExecuteSSH(
    _SSHCommands_=overrides_37.DynamicOutput,
    Run=executessh_29.Ran,
    addPrefix=True,
    description="""pcond -h /home/mss/MantaRay/UnnamedProject/images/2022_09_28_1341_29_Perspective1_render_illum.hdr /home/mss/MantaRay/UnnamedProject/images/2022_09_28_1341_29_Perspective1_render_illum_exposed.hdr
ra_tiff /home/mss/MantaRay/UnnamedProject/images/2022_09_28_1341_29_Perspective1_render_illum_exposed.hdr /home/mss/MantaRay/UnnamedProject/images/2022_09_28_1341_29_Perspective1_render_illum_exposed.tif
convert /home/mss/MantaRay/UnnamedProject/images/2022_09_28_1341_29_Perspective1_render_illum_exposed.tif /home/mss/MantaRay/UnnamedProject/images/2022_09_28_1341_29_Perspective1_render_illum_exposed.png
echo /home/mss/MantaRay/UnnamedProject/images/2022_09_28_1341_29_Perspective1_render_illum_exposed.png""",
    fireLogs=False,
    lastRunTime=2680,
    suppressWarnings=False,
    results="/home/mss/MantaRay/UnnamedProject/images/2022_09_28_1341_29_Perspective1_render_illum_exposed.png",
    commands="""pcond -h /home/mss/MantaRay/UnnamedProject/images/2022_09_28_1341_29_Perspective1_render_illum.hdr /home/mss/MantaRay/UnnamedProject/images/2022_09_28_1341_29_Perspective1_render_illum_exposed.hdr
ra_tiff /home/mss/MantaRay/UnnamedProject/images/2022_09_28_1341_29_Perspective1_render_illum_exposed.hdr /home/mss/MantaRay/UnnamedProject/images/2022_09_28_1341_29_Perspective1_render_illum_exposed.tif
convert /home/mss/MantaRay/UnnamedProject/images/2022_09_28_1341_29_Perspective1_render_illum_exposed.tif /home/mss/MantaRay/UnnamedProject/images/2022_09_28_1341_29_Perspective1_render_illum_exposed.png
echo /home/mss/MantaRay/UnnamedProject/images/2022_09_28_1341_29_Perspective1_render_illum_exposed.png""")  # -> Stdout, Stderr_, Ran
download_6 = Download(
    LinuxFilePaths=executessh_32.Stdout,
    Run=executessh_32.Ran,
    stdouts="C:\Users\mm1013\MantaRay\UnnamedProject\2022_09_28_1341_29_Perspective1_render_illum_exposed.png")  # -> FilePaths, Status, Ran
imageviewer_3 = LBImageViewer(ImagePath_=download_6.FilePaths, _scale_="1.5", DisableClickable=False, SaveImgWithCoords=False, scale=1.5)  # -> ImagePath, Values, GIF

# ----
# False color with illuminance curves
# on top of luminance picture
panel_91 = Panel("falsecolor -s 9000 -l lux -p <rad-.>_exposed.hdr -i <irrad> -cl -log 2 > <rad-.>_fc.hdr;echo <rad-.>_fc.hdr")
overrides_38 = ApplyOverrides(Input=panel_91, Rad=graft(executessh_30.Stdout), Irrad=graft(executessh_29.Stdout))  # -> Output, DynamicOutput
executessh_33 = ExecuteSSH(
    _SSHCommands_=overrides_38.DynamicOutput,
    Run=[or, executessh_29.Ran],
    addPrefix=True,
    description="falsecolor -s 9000 -l lux -p /home/mss/MantaRay/UnnamedProject/images/2022_10_06_1035_44_Perspective_render_exposed.hdr -i /home/mss/MantaRay/UnnamedProject/images/2022_09_28_1341_29_Perspective1_render_illum.hdr -cl -log 2 > /home/mss/MantaRay/UnnamedProject/images/2022_10_06_1035_44_Perspective_render_fc.hdr;echo /home/mss/MantaRay/UnnamedProject/images/2022_10_06_1035_44_Perspective_render_fc.hdr",
    fireLogs=False,
    lastRunTime=4829,
    suppressWarnings=False,
    results="/home/mss/MantaRay/UnnamedProject/images/2022_09_28_1341_29_Perspective1_render_fc.hdr",
    commands="falsecolor -s 9000 -l lux -p /home/mss/MantaRay/UnnamedProject/images/2022_09_28_1341_29_Perspective1_render_exposed.hdr -i /home/mss/MantaRay/UnnamedProject/images/2022_09_28_1341_29_Perspective1_render_illum.hdr -cl -log 2 > /home/mss/MantaRay/UnnamedProject/images/2022_09_28_1341_29_Perspective1_render_fc.hdr;echo /home/mss/MantaRay/UnnamedProject/images/2022_09_28_1341_29_Perspective1_render_fc.hdr")  # -> Stdout, Stderr_, Ran
download_7 = Download(
    LinuxFilePaths=executessh_33.Stdout,
    Run=executessh_33.Ran,
    stdouts="C:\Users\mm1013\MantaRay\UnnamedProject\2022_09_28_1341_29_Perspective1_render_fc.hdr")  # -> FilePaths, Status, Ran
imageviewer_4 = LBImageViewer(ImagePath_=download_7.FilePaths, _scale_="2", DisableClickable=False, SaveImgWithCoords=False, scale=2)  # -> ImagePath, Values, GIF

executessh_34 = ExecuteSSH(
    _SSHCommands_=overrides_36.Output,
    Run=flatten([python_20.run, falsestart_10]),
    addPrefix=True,
    fireLogs=False,
    lastRunTime=0,
    suppressWarnings=False)  # -> Stdout, Stderr_, Ran

# ----
# False color with illuminance curves
# on top of luminance picture
panel_92 = Panel("""pcond -h <irrad> <irrad-.>_exposed.hdr
falsecolor -s 9000 -d 0 -l lux -p <irrad-.>_exposed.hdr -i <irrad> -cl -log 2 > <rad-.>_fc.hdr;echo <rad-.>_fc.hdr""")
overrides_39 = ApplyOverrides(Input=panel_92, Rad=graft(executessh_30.Stdout), Irrad=graft(executessh_29.Stdout))  # -> Output, DynamicOutput
executessh_35 = ExecuteSSH(
    _SSHCommands_=overrides_39.DynamicOutput,
    Run=[or, executessh_29.Ran],
    addPrefix=True,
    description="""pcond -h /home/mss/MantaRay/UnnamedProject/images/2022_09_28_1341_29_Perspective1_render_illum.hdr /home/mss/MantaRay/UnnamedProject/images/2022_09_28_1341_29_Perspective1_render_illum_exposed.hdr
falsecolor -s 9000 -d 0 -l lux -p /home/mss/MantaRay/UnnamedProject/images/2022_09_28_1341_29_Perspective1_render_illum_exposed.hdr -i /home/mss/MantaRay/UnnamedProject/images/2022_09_28_1341_29_Perspective1_render_illum.hdr -cl -log 2 > /home/mss/MantaRay/UnnamedProject/images/2022_10_06_1035_44_Perspective_render_fc.hdr;echo /home/mss/MantaRay/UnnamedProject/images/2022_10_06_1035_44_Perspective_render_fc.hdr""",
    fireLogs=False,
    lastRunTime=5881,
    suppressWarnings=False,
    results="/home/mss/MantaRay/UnnamedProject/images/2022_09_28_1341_29_Perspective1_render_fc.hdr",
    commands="""pcond -h /home/mss/MantaRay/UnnamedProject/images/2022_09_28_1341_29_Perspective1_render_illum.hdr /home/mss/MantaRay/UnnamedProject/images/2022_09_28_1341_29_Perspective1_render_illum_exposed.hdr
falsecolor -s 9000 -d 0 -l lux -p /home/mss/MantaRay/UnnamedProject/images/2022_09_28_1341_29_Perspective1_render_illum_exposed.hdr -i /home/mss/MantaRay/UnnamedProject/images/2022_09_28_1341_29_Perspective1_render_illum.hdr -cl -log 2 > /home/mss/MantaRay/UnnamedProject/images/2022_09_28_1341_29_Perspective1_render_fc.hdr;echo /home/mss/MantaRay/UnnamedProject/images/2022_09_28_1341_29_Perspective1_render_fc.hdr""")  # -> Stdout, Stderr_, Ran
download_8 = Download(
    LinuxFilePaths=executessh_35.Stdout,
    Run=executessh_35.Ran,
    stdouts="C:\Users\mm1013\MantaRay\UnnamedProject\2022_09_28_1341_29_Perspective1_render_fc.hdr")  # -> FilePaths, Status, Ran
imageviewer_5 = LBImageViewer(ImagePath_=download_8.FilePaths, _scale_="2", DisableClickable=False, SaveImgWithCoords=False, scale=2)  # -> ImagePath, Values, GIF

# ----
# Using PCOND to set automatic exposure
# and convert to PNG
panel_93 = Panel("""pcond -h <hdr> <hdr-.>_exposed.hdr
ra_tiff <hdr-.>_exposed.hdr <hdr-.>_exposed.tif
convert <hdr-.>_exposed.tif <hdr-.>_exposed.png
echo <hdr-.>_exposed.png""")
overrides_40 = ApplyOverrides(Input=panel_93, Hdr=graft(executessh_30.Stdout))  # -> Output, DynamicOutput
executessh_36 = ExecuteSSH(
    _SSHCommands_=overrides_40.DynamicOutput,
    Run=or,
    addPrefix=True,
    description="""pcond -h /home/mss/MantaRay/UnnamedProject/images/2022_10_06_1035_44_Perspective_render.hdr /home/mss/MantaRay/UnnamedProject/images/2022_10_06_1035_44_Perspective_render_exposed.hdr
ra_tiff /home/mss/MantaRay/UnnamedProject/images/2022_10_06_1035_44_Perspective_render_exposed.hdr /home/mss/MantaRay/UnnamedProject/images/2022_10_06_1035_44_Perspective_render_exposed.tif
convert /home/mss/MantaRay/UnnamedProject/images/2022_10_06_1035_44_Perspective_render_exposed.tif /home/mss/MantaRay/UnnamedProject/images/2022_10_06_1035_44_Perspective_render_exposed.png
echo /home/mss/MantaRay/UnnamedProject/images/2022_10_06_1035_44_Perspective_render_exposed.png""",
    fireLogs=False,
    lastRunTime=5783.4014,
    suppressWarnings=False,
    results="/home/mss/MantaRay/UnnamedProject/images/2022_10_06_1035_44_Perspective_render_exposed.png",
    commands="""pcond -h /home/mss/MantaRay/UnnamedProject/images/2022_10_06_1035_44_Perspective_render.hdr /home/mss/MantaRay/UnnamedProject/images/2022_10_06_1035_44_Perspective_render_exposed.hdr
ra_tiff /home/mss/MantaRay/UnnamedProject/images/2022_10_06_1035_44_Perspective_render_exposed.hdr /home/mss/MantaRay/UnnamedProject/images/2022_10_06_1035_44_Perspective_render_exposed.tif
convert /home/mss/MantaRay/UnnamedProject/images/2022_10_06_1035_44_Perspective_render_exposed.tif /home/mss/MantaRay/UnnamedProject/images/2022_10_06_1035_44_Perspective_render_exposed.png
echo /home/mss/MantaRay/UnnamedProject/images/2022_10_06_1035_44_Perspective_render_exposed.png""")  # -> Stdout, Stderr_, Ran
download_9 = Download(
    LinuxFilePaths=executessh_36.Stdout,
    Run=executessh_36.Ran,
    stdouts="C:\Users\mm1013\MantaRay\UnnamedProject\2022_10_06_1035_44_Perspective_render_exposed.png")  # -> FilePaths, Status, Ran
imageviewer_6 = LBImageViewer(ImagePath_=download_9.FilePaths, _scale_="1.5", DisableClickable=False, SaveImgWithCoords=False, scale=1.5)  # -> ImagePath, Values, GIF

overrides_41 = ApplyOverrides(Input=panel_46, Rad=graft(executessh_30.Stdout), Irrad=graft(executessh_29.Stdout))  # -> Output, DynamicOutput
executessh_37 = ExecuteSSH(
    _SSHCommands_=overrides_41.DynamicOutput,
    Run=[or, executessh_29.Ran],
    addPrefix=True,
    description="falsecolor -lw 0 -s 50 -n 10 -m 1.79 -l DF -p /home/mss/MantaRay/UnnamedProject/images/2022_10_06_1035_44_Perspective_render_exposed.hdr -i /home/mss/MantaRay/UnnamedProject/images/2022_09_28_1341_29_Perspective1_render_illum.hdr -cp > /home/mss/MantaRay/UnnamedProject/images/2022_10_06_1035_44_Perspective_render_fc4_lw0.hdr;echo /home/mss/MantaRay/UnnamedProject/images/2022_10_06_1035_44_Perspective_render_fc4_lw0.hdr",
    fireLogs=False,
    lastRunTime=5356,
    suppressWarnings=False,
    results="/home/mss/MantaRay/UnnamedProject/images/2022_09_28_1341_29_Perspective1_render_fc4_lw0.hdr",
    commands="falsecolor -lw 0 -s 50 -n 10 -m 1.79 -l DF -p /home/mss/MantaRay/UnnamedProject/images/2022_09_28_1341_29_Perspective1_render_exposed.hdr -i /home/mss/MantaRay/UnnamedProject/images/2022_09_28_1341_29_Perspective1_render_illum.hdr -cp > /home/mss/MantaRay/UnnamedProject/images/2022_09_28_1341_29_Perspective1_render_fc4_lw0.hdr;echo /home/mss/MantaRay/UnnamedProject/images/2022_09_28_1341_29_Perspective1_render_fc4_lw0.hdr")  # -> Stdout, Stderr_, Ran
overrides_42 = ApplyOverrides(Input=panel_47, Rad=graft(executessh_29.Stdout), Fc=graft(executessh_37.Stdout))  # -> Output, DynamicOutput
subtraction = Subtraction(A="2000", B=pdecon.YComponent)
executessh_38 = ExecuteSSH(
    _SSHCommands_=overrides_42.DynamicOutput,
    Run=[or, executessh_29.Ran],
    addPrefix=True,
    description="""pcond -h /home/mss/MantaRay/UnnamedProject/images/2022_09_28_1341_29_Perspective1_render_illum.hdr /home/mss/MantaRay/UnnamedProject/images/2022_09_28_1341_29_Perspective1_render_illum_exposed2.hdr
pcomb /home/mss/MantaRay/UnnamedProject/images/2022_09_28_1341_29_Perspective1_render_illum_exposed2.hdr -s 0.2 /home/mss/MantaRay/UnnamedProject/images/2022_09_28_1341_29_Perspective1_render_fc4_lw0.hdr > /home/mss/MantaRay/UnnamedProject/images/2022_09_28_1341_29_Perspective1_render_illum_overlay.hdr
echo /home/mss/MantaRay/UnnamedProject/images/2022_09_28_1341_29_Perspective1_render_illum_overlay.hdr""",
    fireLogs=False,
    lastRunTime=1070,
    suppressWarnings=False,
    results="/home/mss/MantaRay/UnnamedProject/images/2022_09_28_1341_29_Perspective1_render_illum_overlay.hdr",
    commands="""pcond -h /home/mss/MantaRay/UnnamedProject/images/2022_09_28_1341_29_Perspective1_render_illum.hdr /home/mss/MantaRay/UnnamedProject/images/2022_09_28_1341_29_Perspective1_render_illum_exposed2.hdr
pcomb /home/mss/MantaRay/UnnamedProject/images/2022_09_28_1341_29_Perspective1_render_illum_exposed2.hdr -s 0.2 /home/mss/MantaRay/UnnamedProject/images/2022_09_28_1341_29_Perspective1_render_fc4_lw0.hdr > /home/mss/MantaRay/UnnamedProject/images/2022_09_28_1341_29_Perspective1_render_illum_overlay.hdr
echo /home/mss/MantaRay/UnnamedProject/images/2022_09_28_1341_29_Perspective1_render_illum_overlay.hdr""")  # -> Stdout, Stderr_, Ran
overrides_43 = ApplyOverrides(Input=panel_48, Hdr=graft(executessh_29.Stdout), X=graft(pdecon.XComponent), Y=graft(subtraction))  # -> Output, DynamicOutput
download_10 = Download(
    LinuxFilePaths=executessh_38.Stdout,
    Run=executessh_38.Ran,
    stdouts="C:\Users\mm1013\MantaRay\UnnamedProject\2022_09_28_1341_29_Perspective1_render_illum_overlay.hdr")  # -> FilePaths, Status, Ran
item_7 = ListItem(List=flatten(overrides_43.Output), Index=0, Wrap=True)
panel_94 = Panel(item_7)
imageviewer_7 = LBImageViewer(ImagePath_=download_10.FilePaths, _scale_="2", DisableClickable=False, SaveImgWithCoords=False, scale=2)  # -> ImagePath, Values, GIF

# ----
# https://discourse.radiance-online.org/t/rad-program-for-generating-parameters/6026
panel_95 = Panel("""rpict= rtpict -n <cpus>
RESOLUTION= 600
QUALITY= H
DETAIL= M
EXPOSURE= +0.1
UP= Z
INDIRECT= 2
VARIABILITY= M
REPORT= 1
<zone>
OCTREE=<oct>
view=<vn> -vf <v>""")
panel_96 = Panel("""echo "<RIF>" > <LinuxHome>/<target>
rad -n -s <LinuxHome>/<target> OPTFILE=<LinuxHome>/render.opt
echo <LinuxHome>/render.opt""")
falsestart_16 = LBFalseStartToggle(True)

# ----
# RENDER WITH RAD (rif files)
octree_7 = Data(octree_overcast, ParamAccess=0)
panel_97 = Panel("""rtpict -w -n <cpus> @<options> -x 500 -y 400 -vf <vf> -af <target-.>.amb <oct> > <LinuxHome>/<target-.>_overture.hdr
rtpict -w -n <cpus> @<options> -vf <vf> -af <target-.>.amb <oct> > <LinuxHome>/<target>
echo <LinuxHome>/<target>""")
panel_98 = Panel("""pcond -h <hdr> <hdr-.>_exposed.hdr
ra_tiff <hdr-.>_exposed.hdr <hdr-.>_exposed.tif
convert <hdr-.>_exposed.tif <hdr-.>_exposed.png
echo <hdr-.>_exposed.png""")

overrides_44 = ApplyOverrides(
    Input=panel_96,
    RIF=graft(panel_95),
    target=graft("scene.rif"),
    oct=graft(octree_7),
    zone=graft(zone_2.zone),
    vn=graft("Perspective"),
    v=graft(executessh_7.Stdout))  # -> Output, DynamicOutput
executessh_39 = ExecuteSSH(
    _SSHCommands_=overrides_44.Output,
    Run=falsestart_16,
    addPrefix=True,
    fireLogs=False,
    lastRunTime=5.108,
    suppressWarnings=False,
    results="/home/mss/MantaRay/UnnamedProject/render.opt",
    commands="""echo "rpict= rtpict -n 11
RESOLUTION= 600
QUALITY= H
DETAIL= M
EXPOSURE= +0.1
UP= Z
INDIRECT= 2
VARIABILITY= M
REPORT= 1
ZONE=I 0.00 14.49 0.00 18.21 0.00 13.53

OCTREE=/home/mss/MantaRay/UnnamedProject/octrees/my_test_scene.oct
view=Perspective -vf /home/mss/MantaRay/UnnamedProject/views/Perspective2.vf" > ~/MantaRay/UnnamedProject/scene.rif
rad -n -s ~/MantaRay/UnnamedProject/scene.rif OPTFILE=~/MantaRay/UnnamedProject/render.opt
echo ~/MantaRay/UnnamedProject/render.opt""")  # -> Stdout, Stderr_, Ran
overrides_45 = ApplyOverrides(Input="cat <target>", Target=graft(executessh_39.Stdout))  # -> Output, DynamicOutput
executessh_40 = ExecuteSSH(
    _SSHCommands_=overrides_45.Output,
    Run=executessh_39.Ran,
    addPrefix=True,
    fireLogs=False,
    lastRunTime=13.0424,
    suppressWarnings=False,
    results="""-dp 2048
-ar 200
-ms 0.19
-ds .2
-dt .05
-dc .75
-dr 3
-ss 16
-st .01
-ab 3
-aa .1
-ad 1536
-as 768
-av 0.47 0.47 0.47
-lr 12
-lw 1e-5""",
    commands="cat /home/mss/MantaRay/UnnamedProject/render.opt")  # -> Stdout, Stderr_, Ran
panel_99 = Panel(executessh_40.Stdout)

overrides_46 = ApplyOverrides(
    Input=panel_97,
    Oct=graft(octree_7),
    Target=graft("myRender.hdr"),
    Options=graft(executessh_39.Stdout),
    Vf=graft(executessh_7.Stdout))  # -> Output, DynamicOutput
executessh_41 = ExecuteSSH(
    _SSHCommands=overrides_46.Output,
    Run=falsestart_9,
    addPrefix=True,
    fireLogs=False,
    lastRunTime=1324742.068,
    suppressWarnings=False,
    results="/home/mss/MantaRay/UnnamedProject/myRender.hdr",
    commands="""rtpict -w -n 11 @/home/mss/MantaRay/UnnamedProject/render.opt -x 500 -y 400 -vf /home/mss/MantaRay/UnnamedProject/views/Perspective2.vf -af myRender.amb /home/mss/MantaRay/UnnamedProject/octrees/my_test_scene.oct > ~/MantaRay/UnnamedProject/myRender_overture.hdr
rtpict -w -n 11 @/home/mss/MantaRay/UnnamedProject/render.opt -vf /home/mss/MantaRay/UnnamedProject/views/Perspective2.vf -af myRender.amb /home/mss/MantaRay/UnnamedProject/octrees/my_test_scene.oct > ~/MantaRay/UnnamedProject/myRender.hdr
echo ~/MantaRay/UnnamedProject/myRender.hdr""")  # -> Stdout, Stderr_, Ran
overrides_47 = ApplyOverrides(Input=panel_98, Hdr=graft(executessh_41.Stdout))  # -> Output, DynamicOutput
executessh_42 = ExecuteSSH(
    _SSHCommands_=overrides_47.DynamicOutput,
    Run=executessh_41.Ran,
    addPrefix=True,
    description="""pcond -h /home/mss/MantaRay/UnnamedProject/myRender.hdr /home/mss/MantaRay/UnnamedProject/myRender_exposed.hdr
ra_tiff /home/mss/MantaRay/UnnamedProject/myRender_exposed.hdr /home/mss/MantaRay/UnnamedProject/myRender_exposed.tif
convert /home/mss/MantaRay/UnnamedProject/myRender_exposed.tif /home/mss/MantaRay/UnnamedProject/myRender_exposed.png
echo /home/mss/MantaRay/UnnamedProject/myRender_exposed.png""",
    fireLogs=False,
    lastRunTime=6.5491,
    suppressWarnings=False,
    results="/home/mss/MantaRay/UnnamedProject/myRender_exposed.png",
    commands="""pcond -h /home/mss/MantaRay/UnnamedProject/myRender.hdr /home/mss/MantaRay/UnnamedProject/myRender_exposed.hdr
ra_tiff /home/mss/MantaRay/UnnamedProject/myRender_exposed.hdr /home/mss/MantaRay/UnnamedProject/myRender_exposed.tif
convert /home/mss/MantaRay/UnnamedProject/myRender_exposed.tif /home/mss/MantaRay/UnnamedProject/myRender_exposed.png
echo /home/mss/MantaRay/UnnamedProject/myRender_exposed.png""")  # -> Stdout, Stderr_, Ran
download_11 = Download(
    LinuxFilePaths=executessh_42.Stdout,
    Run=executessh_42.Ran,
    stdouts="C:\Users\mm1013\MantaRay\UnnamedProject\myRender_exposed.png")  # -> FilePaths, Status, Ran
imageviewer_8 = LBImageViewer(ImagePath_=download_11.FilePaths, _scale_="1.5", DisableClickable=False, SaveImgWithCoords=False, scale=1.5)  # -> ImagePath, Values, GIF

panel_100 = Panel(overrides_46.Output)

# ----
# Parallel RTPICT render (luminance) no cache
viewfile_6 = Text(executessh_21.Stdout)
octree_8 = Text(executessh_26.Stdout)
octree_overcast_3 = Text(octree_overcast)
division_3 = Division(A=resolution_2, B=1.5)
entwine_10 = Entwine(Branch00=octree_overcast_3, Branch01=octree_8, FlattenInputs=True)  # -> flatten(Result)
octree_9 = Text(graft(entwine_10))
list_2 = ItemSelector(
    octree_9,
    {"/home/mss/MantaRay/UnnamedProject/octrees/my_test_scene.oct"}, selected="/home/mss/MantaRay/UnnamedProject/octrees/my_test_scene.oct")
panel_101 = Panel("""mkdir -p <proj>/images/
rtpict -n <cpus-1> -w -vf <vf> -x <x> -y <y> <radOptions> <oct> | pfilt -x /4 -y /4 -r 0.7 > <proj>/images/<target>;echo <proj>/images/<target>""")
eval_2 = Evaluate(F="x=y", x=octree_9, y=list_2)
x_4 = Number(x_2)
run_6 = LBFalseStartToggle(False)

y_3 = Number(division_3)

hours_7 = Text(hours_2)
entwine_11 = Entwine(Branch00="ovc", Branch01=hours_7, FlattenInputs=True)  # -> flatten(Result)
cull_11 = CullPattern(List=graft(entwine_11), CullPattern=eval_2)  # -> flatten(List)
hours_8 = Text(cull_11)

# ----
# Parallel RTPICT render (Illuminance)
# (takes 2.5X longer than above...)
# mkdir -p <proj>/images/
# rtpict -i -w -n 30 -vf <vf> -x <x> -y <y> <radOptions> <oct> | pfilt -x /4 -y /4 -r 0.7 > <proj>/images/<target>;echo <proj>/images/<target>
panel_102 = Panel("""mkdir -p <proj>/images/
rtpict -i -w -n <cpus-2> -vf <vf> -x <x> -y <y> <radOptions> <oct> | pfilt -x /4 -y /4 -r 0.7 > <proj>/images/<target>;echo <proj>/images/<target>""")
run_7 = LBFalseStartToggle(False)
x_5 = Number(x_2)
y_4 = Number(y_3)

merge = Merge(Data1=panel_80, Data2=list, Data3=join_5, Data4=Button())  # -> flatten(Result)
python_21 = GhPythonScript(update=merge)  # -> time; inputs update: tree; same code as python_15

overrides_48 = ApplyOverrides(Input="ambfile_<time>.af", Time=graft(python_21))  # -> Output, DynamicOutput
overrides_49 = ApplyOverrides(
    Input=panel_81,
    Vf=graft(viewfile_3),
    RadOptions=graft(panel_80),
    AmbFile=graft(overrides_48.DynamicOutput),
    Oct=graft(list),
    X=graft(x_3),
    Y=graft(y_2),
    Target=graft("<time>_rtpict_rendering_aa0.1_<x>_sunny_ad4096_<h>.hdr"),
    Time=graft("<time>"),
    H=graft(hours_6))  # -> Output, DynamicOutput

overrides_50 = ApplyOverrides(Input=overrides_49.DynamicOutput, Time=graft(python_15))  # -> Output, DynamicOutput
executessh_43 = ExecuteSSH(
    _SSHCommands_=overrides_50.DynamicOutput,
    Run=run_3,
    addPrefix=True,
    description="""mkdir -p ~/MantaRay/UnnamedProject/images/
rtpict -n 10 -w -vf /home/lio/MantaRay/TestingRemote/views/Perspective1.vf -x 400 -y 300 -ab 3 -ad 4096 -lw 0.0003 -aa 0.1 -ar 256 -as 1024 -af ambfile_2022_10_06_0849_29.af

# This is a MantaRay Dictionary
# Globals will be updated in Execute component
# Locals will not!
# This tail is ignored by the Execute component /home/mss/MantaRay/UnnamedProject/octrees/my_test_scene.oct > /dev/null
rtpict -n 10 -w -vf /home/lio/MantaRay/TestingRemote/views/Perspective1.vf -x 5000 -y 3333.333333 -ab 3 -ad 4096 -lw 0.0003 -aa 0.1 -ar 256 -as 1024 -af ambfile_2022_10_06_0849_29.af

# This is a MantaRay Dictionary
# Globals will be updated in Execute component
# Locals will not!
# This tail is ignored by the Execute component /home/mss/MantaRay/UnnamedProject/octrees/my_test_scene.oct | pfilt -x /2 -y /2 > ~/MantaRay/UnnamedProject/images/2022_10_06_0843_47_rtpict_rendering_aa0.1_5000_sunny_ad4096_ovc.hdr;echo ~/MantaRay/UnnamedProject/images/2022_10_06_0843_47_rtpict_rendering_aa0.1_5000_sunny_ad4096_ovc.hdr


- - -

mkdir -p ~/MantaRay/UnnamedProject/images/
rtpict -n 10 -w -vf /home/lio/MantaRay/TestingRemote/views/Perspective1.vf -x 400 -y 300 -ab 3 -ad 4096 -lw 0.0003 -aa 0.1 -ar 256 -as 1024 -af ambfile_2022_10_06_0849_29.af

# This is a MantaRay Dictionary
# Globals will be updated in Execute component
# Locals will not!
# This tail is ignored by the Execute component /home/mss/MantaRay/UnnamedProject/octrees/my_test_scene.oct > /dev/null
rtpict -n 10 -w -vf /home/lio/MantaRay/TestingRemote/views/Perspective1.vf -x 5000 -y 3333.333333 -ab 3 -ad 4096 -lw 0.0003 -aa 0.1 -ar 256 -as 1024 -af ambfile_2022_10_06_0849_29.af

# This is a MantaRay Dictionary
# Globals will be updated in Execute component
# Locals will not!
# This tail is ignored by the Execute component /home/mss/MantaRay/UnnamedProject/octrees/my_test_scene.oct | pfilt -x /2 -y /2 > ~/MantaRay/UnnamedProject/images/2022_10_06_0843_47_rtpict_rendering_aa0.1_5000_sunny_ad4096_0800.hdr;echo ~/MantaRay/UnnamedProject/images/2022_10_06_0843_47_rtpict_rendering_aa0.1_5000_sunny_ad4096_0800.hdr


- - -

mkdir -p ~/MantaRay/UnnamedProject/images/
rtpict -n 10 -w -vf /home/lio/MantaRay/TestingRemote/views/Perspective1.vf -x 400 -y 300 -ab 3 -ad 4096 -lw 0.0003 -aa 0.1 -ar 256 -as 1024 -af ambfile_2022_10_06_0849_29.af

# This is a MantaRay Dictionary
# Globals will be updated in Execute component
# Locals will not!
# This tail is ignored by the Execute component /home/mss/MantaRay/UnnamedProject/octrees/my_test_scene.oct > /dev/null
rtpict -n 10 -w -vf /home/lio/MantaRay/TestingRemote/views/Perspective1.vf -x 5000 -y 3333.333333 -ab 3 -ad 4096 -lw 0.0003 -aa 0.1 -ar 256 -as 1024 -af ambfile_2022_10_06_0849_29.af

# This is a MantaRay Dictionary
# Globals will be updated in Execute component
# Locals will not!
# This tail is ignored by the Execute component /home/mss/MantaRay/UnnamedProject/octrees/my_test_scene.oct | pfilt -x /2 -y /2 > ~/MantaRay/UnnamedProject/images/2022_10_06_0843_47_rtpict_rendering_aa0.1_5000_sunny_ad4096_0900.hdr;echo ~/MantaRay/UnnamedProject/images/2022_10_06_0843_47_rtpict_rendering_aa0.1_5000_sunny_ad4096_0900.hdr


- - -

mkdir -p ~/MantaRay/UnnamedProject/images/
rtpict -n 10 -w -vf /home/lio/MantaRay/TestingRemote/views/Perspective1.vf -x 400 -y 300 -ab 3 -ad 4096 -lw 0.0003 -aa 0.1 -ar 256 -as 1024 -af ambfile_2022_10_06_0849_29.af

# This is a MantaRay Dictionary
# Globals will be updated in Execute component
# Locals will not!
# This tail is ignored by the Execute component /home/mss/MantaRay/UnnamedProject/octrees/my_test_scene.oct > /dev/null
rtpict -n 10 -w -vf /home/lio/MantaRay/TestingRemote/views/Perspective1.vf -x 5000 -y 3333.333333 -ab 3 -ad 4096 -lw 0.0003 -aa 0.1 -ar 256 -as 1024 -af ambfile_2022_10_06_0849_29.af

# This is a MantaRay Dictionary
# Globals will be updated in Execute component
# Locals will not!
# This tail is ignored by the Execute component /home/mss/MantaRay/UnnamedProject/octrees/my_test_scene.oct | pfilt -x /2 -y /2 > ~/MantaRay/UnnamedProject/images/2022_10_06_0843_47_rtpict_rendering_aa0.1_5000_sunny_ad4096_1000.hdr;echo ~/MantaRay/UnnamedProject/images/2022_10_06_0843_47_rtpict_rendering_aa0.1_5000_sunny_ad4096_1000.hdr


- - -

mkdir -p ~/MantaRay/UnnamedProject/images/
rtpict -n 10 -w -vf /home/lio/MantaRay/TestingRemote/views/Perspective1.vf -x 400 -y 300 -ab 3 -ad 4096 -lw 0.0003 -aa 0.1 -ar 256 -as 1024 -af ambfile_2022_10_06_0849_29.af

# This is a MantaRay Dictionary
# Globals will be updated in Execute component
# Locals will not!
# This tail is ignored by the Execute component /home/mss/MantaRay/UnnamedProject/octrees/my_test_scene.oct > /dev/null
rtpict -n 10 -w -vf /home/lio/MantaRay/TestingRemote/views/Perspective1.vf -x 5000 -y 3333.333333 -ab 3 -ad 4096 -lw 0.0003 -aa 0.1 -ar 256 -as 1024 -af ambfile_2022_10_06_0849_29.af

# This is a MantaRay Dictionary
# Globals will be updated in Execute component
# Locals will not!
# This tail is ignored by the Execute component /home/mss/MantaRay/UnnamedProject/octrees/my_test_scene.oct | pfilt -x /2 -y /2 > ~/MantaRay/UnnamedProject/images/2022_10_06_0843_47_rtpict_rendering_aa0.1_5000_sunny_ad4096_1100.hdr;echo ~/MantaRay/UnnamedProject/images/2022_10_06_0843_47_rtpict_rendering_aa0.1_5000_sunny_ad4096_1100.hdr


- - -

mkdir -p ~/MantaRay/UnnamedProject/images/
rtpict -n 10 -w -vf /home/lio/MantaRay/TestingRemote/views/Perspective1.vf -x 400 -y 300 -ab 3 -ad 4096 -lw 0.0003 -aa 0.1 -ar 256 -as 1024 -af ambfile_2022_10_06_0849_29.af

# This is a MantaRay Dictionary
# Globals will be updated in Execute component
# Locals will not!
# This tail is ignored by the Execute component /home/mss/MantaRay/UnnamedProject/octrees/my_test_scene.oct > /dev/null
rtpict -n 10 -w -vf /home/lio/MantaRay/TestingRemote/views/Perspective1.vf -x 5000 -y 3333.333333 -ab 3 -ad 4096 -lw 0.0003 -aa 0.1 -ar 256 -as 1024 -af ambfile_2022_10_06_0849_29.af

# This is a MantaRay Dictionary
# Globals will be updated in Execute component
# Locals will not!
# This tail is ignored by the Execute component /home/mss/MantaRay/UnnamedProject/octrees/my_test_scene.oct | pfilt -x /2 -y /2 > ~/MantaRay/UnnamedProject/images/2022_10_06_0843_47_rtpict_rendering_aa0.1_5000_sunny_ad4096_1200.hdr;echo ~/MantaRay/UnnamedProject/images/2022_10_06_0843_47_rtpict_rendering_aa0.1_5000_sunny_ad4096_1200.hdr


- - -

mkdir -p ~/MantaRay/UnnamedProject/images/
rtpict -n 10 -w -vf /home/lio/MantaRay/TestingRemote/views/Perspective1.vf -x 400 -y 300 -ab 3 -ad 4096 -lw 0.0003 -aa 0.1 -ar 256 -as 1024 -af ambfile_2022_10_06_0849_29.af

# This is a MantaRay Dictionary
# Globals will be updated in Execute component
# Locals will not!
# This tail is ignored by the Execute component /home/mss/MantaRay/UnnamedProject/octrees/my_test_scene.oct > /dev/null
rtpict -n 10 -w -vf /home/lio/MantaRay/TestingRemote/views/Perspective1.vf -x 5000 -y 3333.333333 -ab 3 -ad 4096 -lw 0.0003 -aa 0.1 -ar 256 -as 1024 -af ambfile_2022_10_06_0849_29.af

# This is a MantaRay Dictionary
# Globals will be updated in Execute component
# Locals will not!
# This tail is ignored by the Execute component /home/mss/MantaRay/UnnamedProject/octrees/my_test_scene.oct | pfilt -x /2 -y /2 > ~/MantaRay/UnnamedProject/images/2022_10_06_0843_47_rtpict_rendering_aa0.1_5000_sunny_ad4096_1300.hdr;echo ~/MantaRay/UnnamedProject/images/2022_10_06_0843_47_rtpict_rendering_aa0.1_5000_sunny_ad4096_1300.hdr


- - -

mkdir -p ~/MantaRay/UnnamedProject/images/
rtpict -n 10 -w -vf /home/lio/MantaRay/TestingRemote/views/Perspective1.vf -x 400 -y 300 -ab 3 -ad 4096 -lw 0.0003 -aa 0.1 -ar 256 -as 1024 -af ambfile_2022_10_06_0849_29.af

# This is a MantaRay Dictionary
# Globals will be updated in Execute component
# Locals will not!
# This tail is ignored by the Execute component /home/mss/MantaRay/UnnamedProject/octrees/my_test_scene.oct > /dev/null
rtpict -n 10 -w -vf /home/lio/MantaRay/TestingRemote/views/Perspective1.vf -x 5000 -y 3333.333333 -ab 3 -ad 4096 -lw 0.0003 -aa 0.1 -ar 256 -as 1024 -af ambfile_2022_10_06_0849_29.af

# This is a MantaRay Dictionary
# Globals will be updated in Execute component
# Locals will not!
# This tail is ignored by the Execute component /home/mss/MantaRay/UnnamedProject/octrees/my_test_scene.oct | pfilt -x /2 -y /2 > ~/MantaRay/UnnamedProject/images/2022_10_06_0843_47_rtpict_rendering_aa0.1_5000_sunny_ad4096_1400.hdr;echo ~/MantaRay/UnnamedProject/images/2022_10_06_0843_47_rtpict_rendering_aa0.1_5000_sunny_ad4096_1400.hdr


- - -

mkdir -p ~/MantaRay/UnnamedProject/images/
rtpict -n 10 -w -vf /home/lio/MantaRay/TestingRemote/views/Perspective1.vf -x 400 -y 300 -ab 3 -ad 4096 -lw 0.0003 -aa 0.1 -ar 256 -as 1024 -af ambfile_2022_10_06_0849_29.af

# This is a MantaRay Dictionary
# Globals will be updated in Execute component
# Locals will not!
# This tail is ignored by the Execute component /home/mss/MantaRay/UnnamedProject/octrees/my_test_scene.oct > /dev/null
rtpict -n 10 -w -vf /home/lio/MantaRay/TestingRemote/views/Perspective1.vf -x 5000 -y 3333.333333 -ab 3 -ad 4096 -lw 0.0003 -aa 0.1 -ar 256 -as 1024 -af ambfile_2022_10_06_0849_29.af

# This is a MantaRay Dictionary
# Globals will be updated in Execute component
# Locals will not!
# This tail is ignored by the Execute component /home/mss/MantaRay/UnnamedProject/octrees/my_test_scene.oct | pfilt -x /2 -y /2 > ~/MantaRay/UnnamedProject/images/2022_10_06_0843_47_rtpict_rendering_aa0.1_5000_sunny_ad4096_1500.hdr;echo ~/MantaRay/UnnamedProject/images/2022_10_06_0843_47_rtpict_rendering_aa0.1_5000_sunny_ad4096_1500.hdr


- - -

mkdir -p ~/MantaRay/UnnamedProject/images/
rtpict -n 10 -w -vf /home/lio/MantaRay/TestingRemote/views/Perspective1.vf -x 400 -y 300 -ab 3 -ad 4096 -lw 0.0003 -aa 0.1 -ar 256 -as 1024 -af ambfile_2022_10_06_0849_29.af

# This is a MantaRay Dictionary
# Globals will be updated in Execute component
# Locals will not!
# This tail is ignored by the Execute component /home/mss/MantaRay/UnnamedProject/octrees/my_test_scene.oct > /dev/null
rtpict -n 10 -w -vf /home/lio/MantaRay/TestingRemote/views/Perspective1.vf -x 5000 -y 3333.333333 -ab 3 -ad 4096 -lw 0.0003 -aa 0.1 -ar 256 -as 1024 -af ambfile_2022_10_06_0849_29.af

# This is a MantaRay Dictionary
# Globals will be updated in Execute component
# Locals will not!
# This tail is ignored by the Execute component /home/mss/MantaRay/UnnamedProject/octrees/my_test_scene.oct | pfilt -x /2 -y /2 > ~/MantaRay/UnnamedProject/images/2022_10_06_0843_47_rtpict_rendering_aa0.1_5000_sunny_ad4096_1600.hdr;echo ~/MantaRay/UnnamedProject/images/2022_10_06_0843_47_rtpict_rendering_aa0.1_5000_sunny_ad4096_1600.hdr


- - -

mkdir -p ~/MantaRay/UnnamedProject/images/
rtpict -n 10 -w -vf /home/lio/MantaRay/TestingRemote/views/Perspective1.vf -x 400 -y 300 -ab 3 -ad 4096 -lw 0.0003 -aa 0.1 -ar 256 -as 1024 -af ambfile_2022_10_06_0849_29.af

# This is a MantaRay Dictionary
# Globals will be updated in Execute component
# Locals will not!
# This tail is ignored by the Execute component /home/mss/MantaRay/UnnamedProject/octrees/my_test_scene.oct > /dev/null
rtpict -n 10 -w -vf /home/lio/MantaRay/TestingRemote/views/Perspective1.vf -x 5000 -y 3333.333333 -ab 3 -ad 4096 -lw 0.0003 -aa 0.1 -ar 256 -as 1024 -af ambfile_2022_10_06_0849_29.af

# This is a MantaRay Dictionary
# Globals will be updated in Execute component
# Locals will not!
# This tail is ignored by the Execute component /home/mss/MantaRay/UnnamedProject/octrees/my_test_scene.oct | pfilt -x /2 -y /2 > ~/MantaRay/UnnamedProject/images/2022_10_06_0843_47_rtpict_rendering_aa0.1_5000_sunny_ad4096_1700.hdr;echo ~/MantaRay/UnnamedProject/images/2022_10_06_0843_47_rtpict_rendering_aa0.1_5000_sunny_ad4096_1700.hdr""",
    fireLogs=False,
    lastRunTime=0,
    suppressWarnings=False)  # -> Stdout, Stderr_, Ran
download_12 = Download(LinuxFilePaths=executessh_43.Stdout, Run=executessh_43.Ran)  # -> FilePaths, Status, Ran
imageviewer_9 = LBImageViewer(ImagePath_=download_12.FilePaths, _scale_=2, DisableClickable=False, SaveImgWithCoords=False, scale=2)  # -> ImagePath, Values, GIF

y_5 = Number(y_3)

overrides_51 = ApplyOverrides(
    Input=panel_101,
    Vf=graft(viewfile_6),
    X=graft(x_4),
    Y=graft(y_5),
    RadOptions=graft("-ab 3 -ad 16 -aa 0"),
    Oct=graft(list_2),
    Target=graft("<time>_rtpict_rendering_aa0_<x>_sunny_ad16_<h>.hdr"),
    Time=graft("<time>"),
    H=graft(hours_8))  # -> Output, DynamicOutput

python_22 = GhPythonScript(update=flatten(overrides_51.Output))  # -> time; inputs update: tree; same code as python_15

overrides_52 = ApplyOverrides(
    Input=panel_102,
    Vf=graft(viewfile_6),
    X=graft(x_5),
    Y=graft(y_4),
    RadOptions=graft("-ab 3 -ad 16 -aa 0"),
    Oct=graft(list_2),
    Target=graft("<time>_rtpict_rendering_aa0_<x>_sunny_ad8_<h>_illum.hdr"),
    Time=graft(python_22),
    H=graft(hours_8))  # -> Output, DynamicOutput
overrides_53 = ApplyOverrides(Input=overrides_51.DynamicOutput, Time=graft(python_22))  # -> Output, DynamicOutput
executessh_44 = ExecuteSSH(
    _SSHCommands_=flatten(overrides_52.DynamicOutput),
    Run=run_7,
    addPrefix=True,
    description="""mkdir -p ~/MantaRay/UnnamedProject/images/
rtpict -i -w -n 9 -vf /home/lio/MantaRay/TestingRemote/views/Perspective1.vf -x 1500 -y 1000 -ab 3 -ad 16 -aa 0 /home/mss/MantaRay/UnnamedProject/octrees/my_test_scene.oct | pfilt -x /4 -y /4 -r 0.7 > ~/MantaRay/UnnamedProject/images/2022_10_06_0849_29_rtpict_rendering_aa0_1500_sunny_ad8_ovc_illum.hdr;echo ~/MantaRay/UnnamedProject/images/2022_10_06_0849_29_rtpict_rendering_aa0_1500_sunny_ad8_ovc_illum.hdr
mkdir -p ~/MantaRay/UnnamedProject/images/
rtpict -i -w -n 9 -vf /home/lio/MantaRay/TestingRemote/views/Perspective1.vf -x 1500 -y 1000 -ab 3 -ad 16 -aa 0 /home/mss/MantaRay/UnnamedProject/octrees/my_test_scene.oct | pfilt -x /4 -y /4 -r 0.7 > ~/MantaRay/UnnamedProject/images/2022_10_06_0849_29_rtpict_rendering_aa0_1500_sunny_ad8_0800_illum.hdr;echo ~/MantaRay/UnnamedProject/images/2022_10_06_0849_29_rtpict_rendering_aa0_1500_sunny_ad8_0800_illum.hdr
mkdir -p ~/MantaRay/UnnamedProject/images/
rtpict -i -w -n 9 -vf /home/lio/MantaRay/TestingRemote/views/Perspective1.vf -x 1500 -y 1000 -ab 3 -ad 16 -aa 0 /home/mss/MantaRay/UnnamedProject/octrees/my_test_scene.oct | pfilt -x /4 -y /4 -r 0.7 > ~/MantaRay/UnnamedProject/images/2022_10_06_0849_29_rtpict_rendering_aa0_1500_sunny_ad8_0900_illum.hdr;echo ~/MantaRay/UnnamedProject/images/2022_10_06_0849_29_rtpict_rendering_aa0_1500_sunny_ad8_0900_illum.hdr
mkdir -p ~/MantaRay/UnnamedProject/images/
rtpict -i -w -n 9 -vf /home/lio/MantaRay/TestingRemote/views/Perspective1.vf -x 1500 -y 1000 -ab 3 -ad 16 -aa 0 /home/mss/MantaRay/UnnamedProject/octrees/my_test_scene.oct | pfilt -x /4 -y /4 -r 0.7 > ~/MantaRay/UnnamedProject/images/2022_10_06_0849_29_rtpict_rendering_aa0_1500_sunny_ad8_1000_illum.hdr;echo ~/MantaRay/UnnamedProject/images/2022_10_06_0849_29_rtpict_rendering_aa0_1500_sunny_ad8_1000_illum.hdr
mkdir -p ~/MantaRay/UnnamedProject/images/
rtpict -i -w -n 9 -vf /home/lio/MantaRay/TestingRemote/views/Perspective1.vf -x 1500 -y 1000 -ab 3 -ad 16 -aa 0 /home/mss/MantaRay/UnnamedProject/octrees/my_test_scene.oct | pfilt -x /4 -y /4 -r 0.7 > ~/MantaRay/UnnamedProject/images/2022_10_06_0849_29_rtpict_rendering_aa0_1500_sunny_ad8_1100_illum.hdr;echo ~/MantaRay/UnnamedProject/images/2022_10_06_0849_29_rtpict_rendering_aa0_1500_sunny_ad8_1100_illum.hdr
mkdir -p ~/MantaRay/UnnamedProject/images/
rtpict -i -w -n 9 -vf /home/lio/MantaRay/TestingRemote/views/Perspective1.vf -x 1500 -y 1000 -ab 3 -ad 16 -aa 0 /home/mss/MantaRay/UnnamedProject/octrees/my_test_scene.oct | pfilt -x /4 -y /4 -r 0.7 > ~/MantaRay/UnnamedProject/images/2022_10_06_0849_29_rtpict_rendering_aa0_1500_sunny_ad8_1200_illum.hdr;echo ~/MantaRay/UnnamedProject/images/2022_10_06_0849_29_rtpict_rendering_aa0_1500_sunny_ad8_1200_illum.hdr
mkdir -p ~/MantaRay/UnnamedProject/images/
rtpict -i -w -n 9 -vf /home/lio/MantaRay/TestingRemote/views/Perspective1.vf -x 1500 -y 1000 -ab 3 -ad 16 -aa 0 /home/mss/MantaRay/UnnamedProject/octrees/my_test_scene.oct | pfilt -x /4 -y /4 -r 0.7 > ~/MantaRay/UnnamedProject/images/2022_10_06_0849_29_rtpict_rendering_aa0_1500_sunny_ad8_1300_illum.hdr;echo ~/MantaRay/UnnamedProject/images/2022_10_06_0849_29_rtpict_rendering_aa0_1500_sunny_ad8_1300_illum.hdr
mkdir -p ~/MantaRay/UnnamedProject/images/
rtpict -i -w -n 9 -vf /home/lio/MantaRay/TestingRemote/views/Perspective1.vf -x 1500 -y 1000 -ab 3 -ad 16 -aa 0 /home/mss/MantaRay/UnnamedProject/octrees/my_test_scene.oct | pfilt -x /4 -y /4 -r 0.7 > ~/MantaRay/UnnamedProject/images/2022_10_06_0849_29_rtpict_rendering_aa0_1500_sunny_ad8_1400_illum.hdr;echo ~/MantaRay/UnnamedProject/images/2022_10_06_0849_29_rtpict_rendering_aa0_1500_sunny_ad8_1400_illum.hdr
mkdir -p ~/MantaRay/UnnamedProject/images/
rtpict -i -w -n 9 -vf /home/lio/MantaRay/TestingRemote/views/Perspective1.vf -x 1500 -y 1000 -ab 3 -ad 16 -aa 0 /home/mss/MantaRay/UnnamedProject/octrees/my_test_scene.oct | pfilt -x /4 -y /4 -r 0.7 > ~/MantaRay/UnnamedProject/images/2022_10_06_0849_29_rtpict_rendering_aa0_1500_sunny_ad8_1500_illum.hdr;echo ~/MantaRay/UnnamedProject/images/2022_10_06_0849_29_rtpict_rendering_aa0_1500_sunny_ad8_1500_illum.hdr
mkdir -p ~/MantaRay/UnnamedProject/images/
rtpict -i -w -n 9 -vf /home/lio/MantaRay/TestingRemote/views/Perspective1.vf -x 1500 -y 1000 -ab 3 -ad 16 -aa 0 /home/mss/MantaRay/UnnamedProject/octrees/my_test_scene.oct | pfilt -x /4 -y /4 -r 0.7 > ~/MantaRay/UnnamedProject/images/2022_10_06_0849_29_rtpict_rendering_aa0_1500_sunny_ad8_1600_illum.hdr;echo ~/MantaRay/UnnamedProject/images/2022_10_06_0849_29_rtpict_rendering_aa0_1500_sunny_ad8_1600_illum.hdr
mkdir -p ~/MantaRay/UnnamedProject/images/
rtpict -i -w -n 9 -vf /home/lio/MantaRay/TestingRemote/views/Perspective1.vf -x 1500 -y 1000 -ab 3 -ad 16 -aa 0 /home/mss/MantaRay/UnnamedProject/octrees/my_test_scene.oct | pfilt -x /4 -y /4 -r 0.7 > ~/MantaRay/UnnamedProject/images/2022_10_06_0849_29_rtpict_rendering_aa0_1500_sunny_ad8_1700_illum.hdr;echo ~/MantaRay/UnnamedProject/images/2022_10_06_0849_29_rtpict_rendering_aa0_1500_sunny_ad8_1700_illum.hdr""",
    fireLogs=False,
    lastRunTime=0,
    suppressWarnings=False)  # -> Stdout, Stderr_, Ran
executessh_45 = ExecuteSSH(
    _SSHCommands_=flatten(overrides_53.DynamicOutput),
    Run=run_6,
    addPrefix=True,
    description="""mkdir -p ~/MantaRay/UnnamedProject/images/
rtpict -n 10 -w -vf /home/lio/MantaRay/TestingRemote/views/Perspective1.vf -x 1500 -y 1000 -ab 3 -ad 16 -aa 0 /home/mss/MantaRay/UnnamedProject/octrees/my_test_scene.oct | pfilt -x /4 -y /4 -r 0.7 > ~/MantaRay/UnnamedProject/images/2022_10_06_0849_29_rtpict_rendering_aa0_1500_sunny_ad16_ovc.hdr;echo ~/MantaRay/UnnamedProject/images/2022_10_06_0849_29_rtpict_rendering_aa0_1500_sunny_ad16_ovc.hdr
mkdir -p ~/MantaRay/UnnamedProject/images/
rtpict -n 10 -w -vf /home/lio/MantaRay/TestingRemote/views/Perspective1.vf -x 1500 -y 1000 -ab 3 -ad 16 -aa 0 /home/mss/MantaRay/UnnamedProject/octrees/my_test_scene.oct | pfilt -x /4 -y /4 -r 0.7 > ~/MantaRay/UnnamedProject/images/2022_10_06_0849_29_rtpict_rendering_aa0_1500_sunny_ad16_0800.hdr;echo ~/MantaRay/UnnamedProject/images/2022_10_06_0849_29_rtpict_rendering_aa0_1500_sunny_ad16_0800.hdr
mkdir -p ~/MantaRay/UnnamedProject/images/
rtpict -n 10 -w -vf /home/lio/MantaRay/TestingRemote/views/Perspective1.vf -x 1500 -y 1000 -ab 3 -ad 16 -aa 0 /home/mss/MantaRay/UnnamedProject/octrees/my_test_scene.oct | pfilt -x /4 -y /4 -r 0.7 > ~/MantaRay/UnnamedProject/images/2022_10_06_0849_29_rtpict_rendering_aa0_1500_sunny_ad16_0900.hdr;echo ~/MantaRay/UnnamedProject/images/2022_10_06_0849_29_rtpict_rendering_aa0_1500_sunny_ad16_0900.hdr
mkdir -p ~/MantaRay/UnnamedProject/images/
rtpict -n 10 -w -vf /home/lio/MantaRay/TestingRemote/views/Perspective1.vf -x 1500 -y 1000 -ab 3 -ad 16 -aa 0 /home/mss/MantaRay/UnnamedProject/octrees/my_test_scene.oct | pfilt -x /4 -y /4 -r 0.7 > ~/MantaRay/UnnamedProject/images/2022_10_06_0849_29_rtpict_rendering_aa0_1500_sunny_ad16_1000.hdr;echo ~/MantaRay/UnnamedProject/images/2022_10_06_0849_29_rtpict_rendering_aa0_1500_sunny_ad16_1000.hdr
mkdir -p ~/MantaRay/UnnamedProject/images/
rtpict -n 10 -w -vf /home/lio/MantaRay/TestingRemote/views/Perspective1.vf -x 1500 -y 1000 -ab 3 -ad 16 -aa 0 /home/mss/MantaRay/UnnamedProject/octrees/my_test_scene.oct | pfilt -x /4 -y /4 -r 0.7 > ~/MantaRay/UnnamedProject/images/2022_10_06_0849_29_rtpict_rendering_aa0_1500_sunny_ad16_1100.hdr;echo ~/MantaRay/UnnamedProject/images/2022_10_06_0849_29_rtpict_rendering_aa0_1500_sunny_ad16_1100.hdr
mkdir -p ~/MantaRay/UnnamedProject/images/
rtpict -n 10 -w -vf /home/lio/MantaRay/TestingRemote/views/Perspective1.vf -x 1500 -y 1000 -ab 3 -ad 16 -aa 0 /home/mss/MantaRay/UnnamedProject/octrees/my_test_scene.oct | pfilt -x /4 -y /4 -r 0.7 > ~/MantaRay/UnnamedProject/images/2022_10_06_0849_29_rtpict_rendering_aa0_1500_sunny_ad16_1200.hdr;echo ~/MantaRay/UnnamedProject/images/2022_10_06_0849_29_rtpict_rendering_aa0_1500_sunny_ad16_1200.hdr
mkdir -p ~/MantaRay/UnnamedProject/images/
rtpict -n 10 -w -vf /home/lio/MantaRay/TestingRemote/views/Perspective1.vf -x 1500 -y 1000 -ab 3 -ad 16 -aa 0 /home/mss/MantaRay/UnnamedProject/octrees/my_test_scene.oct | pfilt -x /4 -y /4 -r 0.7 > ~/MantaRay/UnnamedProject/images/2022_10_06_0849_29_rtpict_rendering_aa0_1500_sunny_ad16_1300.hdr;echo ~/MantaRay/UnnamedProject/images/2022_10_06_0849_29_rtpict_rendering_aa0_1500_sunny_ad16_1300.hdr
mkdir -p ~/MantaRay/UnnamedProject/images/
rtpict -n 10 -w -vf /home/lio/MantaRay/TestingRemote/views/Perspective1.vf -x 1500 -y 1000 -ab 3 -ad 16 -aa 0 /home/mss/MantaRay/UnnamedProject/octrees/my_test_scene.oct | pfilt -x /4 -y /4 -r 0.7 > ~/MantaRay/UnnamedProject/images/2022_10_06_0849_29_rtpict_rendering_aa0_1500_sunny_ad16_1400.hdr;echo ~/MantaRay/UnnamedProject/images/2022_10_06_0849_29_rtpict_rendering_aa0_1500_sunny_ad16_1400.hdr
mkdir -p ~/MantaRay/UnnamedProject/images/
rtpict -n 10 -w -vf /home/lio/MantaRay/TestingRemote/views/Perspective1.vf -x 1500 -y 1000 -ab 3 -ad 16 -aa 0 /home/mss/MantaRay/UnnamedProject/octrees/my_test_scene.oct | pfilt -x /4 -y /4 -r 0.7 > ~/MantaRay/UnnamedProject/images/2022_10_06_0849_29_rtpict_rendering_aa0_1500_sunny_ad16_1500.hdr;echo ~/MantaRay/UnnamedProject/images/2022_10_06_0849_29_rtpict_rendering_aa0_1500_sunny_ad16_1500.hdr
mkdir -p ~/MantaRay/UnnamedProject/images/
rtpict -n 10 -w -vf /home/lio/MantaRay/TestingRemote/views/Perspective1.vf -x 1500 -y 1000 -ab 3 -ad 16 -aa 0 /home/mss/MantaRay/UnnamedProject/octrees/my_test_scene.oct | pfilt -x /4 -y /4 -r 0.7 > ~/MantaRay/UnnamedProject/images/2022_10_06_0849_29_rtpict_rendering_aa0_1500_sunny_ad16_1600.hdr;echo ~/MantaRay/UnnamedProject/images/2022_10_06_0849_29_rtpict_rendering_aa0_1500_sunny_ad16_1600.hdr
mkdir -p ~/MantaRay/UnnamedProject/images/
rtpict -n 10 -w -vf /home/lio/MantaRay/TestingRemote/views/Perspective1.vf -x 1500 -y 1000 -ab 3 -ad 16 -aa 0 /home/mss/MantaRay/UnnamedProject/octrees/my_test_scene.oct | pfilt -x /4 -y /4 -r 0.7 > ~/MantaRay/UnnamedProject/images/2022_10_06_0849_29_rtpict_rendering_aa0_1500_sunny_ad16_1700.hdr;echo ~/MantaRay/UnnamedProject/images/2022_10_06_0849_29_rtpict_rendering_aa0_1500_sunny_ad16_1700.hdr""",
    fireLogs=False,
    lastRunTime=0,
    suppressWarnings=False)  # -> Stdout, Stderr_, Ran

# ----
# orig dimensions
panel_103 = Panel("getinfo <f>")
overrides_54 = ApplyOverrides(Input=panel_103, F=graft(executessh_44.Stdout))  # -> Output, DynamicOutput
x_6 = Number(x_2)
executessh_46 = ExecuteSSH(
    _SSHCommands_=overrides_54.DynamicOutput,
    Run=executessh_44.Ran,
    addPrefix=True,
    description="getinfo <f>",
    fireLogs=False,
    lastRunTime=0,
    suppressWarnings=False)  # -> Stdout, Stderr_, Ran
division_4 = Division(A=x_6, B=4)
python_23 = GhPythonScript(x=executessh_46.Stdout)  # -> out, org_y
# ---------- python_23: Python ----------
__author__ = "mm1013"
__version__ = "2022.08.31"

import rhinoscriptsyntax as rs

lines = x.replace("\r","").split("\n")

for l in lines:
    line = l.strip()
    if line.startswith("rtrace"):
        print "RTRACE"
        li = line.split("-y")
        
        print li[1].strip().split(" ")[0]
        org_y = int(li[1].strip().split(" ")[0])
    elif line.startswith("pfilt"):
        print "PFIlT"
        li = line.split("-y")
        
        print li[1].strip().split(" ")[0]
        org_y = org_y / float(li[1].strip().split(" ")[0].replace("/",""))
# ---------- end python_23 ----------

panel_104 = Panel("""pcond -h <hdr> <hdr-.>_exposed.hdr
ra_tiff <hdr-.>_exposed.hdr <hdr-.>_exposed.tif
convert <hdr-.>_exposed.tif <hdr-.>_exposed.png
echo <hdr-.>_exposed.png""")
panel_105 = Panel("""ra_tiff <hdr-.>.hdr <hdr-.>.tif
convert <hdr-.>.tif <hdr-.>.png
echo <hdr-.>.png""")
entwine_12 = Entwine(Branch00=panel_104, Branch01=panel_105, FlattenInputs=True)
overrides_55 = ApplyOverrides(Input=entwine_12, Hdr=graft(executessh_45.Stdout))  # -> Output, DynamicOutput
executessh_47 = ExecuteSSH(
    _SSHCommands_=overrides_55.DynamicOutput,
    Run=executessh_45.Ran,
    addPrefix=True,
    description="""pcond -h <hdr> <hdr>_exposed.hdr
ra_tiff <hdr>_exposed.hdr <hdr>_exposed.tif
convert <hdr>_exposed.tif <hdr>_exposed.png
echo <hdr>_exposed.png


- - -

ra_tiff <hdr>.hdr <hdr>.tif
convert <hdr>.tif <hdr>.png
echo <hdr>.png""",
    fireLogs=False,
    lastRunTime=0,
    suppressWarnings=False)  # -> Stdout, Stderr_, Ran
download_13 = Download(LinuxFilePaths=executessh_47.Stdout, Run=executessh_47.Ran)  # -> flatten(FilePaths), Status, Ran
item_8 = ListItem(List=download_13.FilePaths, Index=0, Wrap=True)  # -> Item, Item1

# ----
# blurring the irrad
panel_106 = Panel("pfilt -x /3 -y /3 -r 1 <file> | pfilt -1 -x <x> -y <y> > <file-.>_filteredBlur.hdr;ra_tiff <file-.>_filteredBlur.hdr <file-.>_filteredBlur.tif;echo <file-.>_filteredBlur.hdr")
overrides_56 = ApplyOverrides(Input=panel_106, File=graft(executessh_44.Stdout), X=graft(division_4), Y=graft(python_23.org_y))  # -> Output, DynamicOutput
executessh_48 = ExecuteSSH(
    _SSHCommands_=overrides_56.DynamicOutput,
    Run=executessh_44.Ran,
    addPrefix=True,
    description="pfilt -x /3 -y /3 -r 1 <file> | pfilt -1 -x 375 -y <y> > <file>_filteredBlur.hdr;ra_tiff <file>_filteredBlur.hdr <file>_filteredBlur.tif;echo <file>_filteredBlur.hdr",
    fireLogs=False,
    lastRunTime=0,
    suppressWarnings=False)  # -> Stdout, Stderr_, Ran

# ----
# FalseColor
panel_107 = Panel("""pfilt -x /2 -y /2 -r 0.7 <irrad> | falsecolor -s 2000 -l lux -lw 200 -lh 300 > <irrad-.>_fc2.hdr
ra_tiff <irrad-.>_fc2.hdr <irrad-.>_fc2.tif
convert <irrad-.>_fc2.tif <irrad-.>_fc2.png
rm <irrad-.>_fc2.hdr
rm <irrad-.>_fc2.tif
echo <irrad-.>_fc2.png""")
overrides_57 = ApplyOverrides(Input=panel_107, Irrad=graft(executessh_44.Stdout))  # -> Output, DynamicOutput
executessh_49 = ExecuteSSH(
    _SSHCommands_=overrides_57.DynamicOutput,
    Run=executessh_44.Ran,
    addPrefix=True,
    description="""pfilt -x /2 -y /2 -r 0.7 <irrad> | falsecolor -s 2000 -l lux -lw 200 -lh 300 > <irrad>_fc2.hdr
ra_tiff <irrad>_fc2.hdr <irrad>_fc2.tif
convert <irrad>_fc2.tif <irrad>_fc2.png
rm <irrad>_fc2.hdr
rm <irrad>_fc2.tif
echo <irrad>_fc2.png""",
    fireLogs=False,
    lastRunTime=0,
    suppressWarnings=False)  # -> Stdout, Stderr_, Ran
download_14 = Download(LinuxFilePaths=executessh_49.Stdout, Run=executessh_49.Ran)  # -> FilePaths, Status, Ran

# ----
# overlay illuminance falsecolor on luminance picture
panel_108 = Panel("""pcond -h <rad> | pfilt -x /2 -y /2 -r 0.7 > <rad-.>exposed_sd.hdr
pfilt -x /2 -y /2 -r 0.7 <irrad> > <irrad-.>_sd.hdr
falsecolor -s 2000 -l lux -lw 200 -lh 300 -p <rad-.>exposed_sd.hdr -i <irrad-.>_sd.hdr -cl > <rad-.>_fc.hdr
ra_tiff <rad-.>_fc.hdr <rad-.>_fc.tif
convert <rad-.>_fc.tif <rad-.>_fc.png
echo <rad-.>_fc.hdr""")
panel_109 = Panel("-log 2")
overrides_58 = ApplyOverrides(Input=panel_108, Rad=graft(executessh_45.Stdout), Irrad=graft(executessh_48.Stdout))  # -> Output, DynamicOutput
executessh_50 = ExecuteSSH(
    _SSHCommands_=overrides_58.DynamicOutput,
    Run=[executessh_44.Ran, executessh_45.Ran],
    addPrefix=True,
    description="""pcond -h <rad> | pfilt -x /2 -y /2 -r 0.7 > <rad>exposed_sd.hdr
pfilt -x /2 -y /2 -r 0.7 <irrad> > <irrad>_sd.hdr
falsecolor -s 2000 -l lux -lw 200 -lh 300 -p <rad>exposed_sd.hdr -i <irrad>_sd.hdr -cl > <rad>_fc.hdr
ra_tiff <rad>_fc.hdr <rad>_fc.tif
convert <rad>_fc.tif <rad>_fc.png
echo <rad>_fc.hdr""",
    fireLogs=False,
    lastRunTime=0,
    suppressWarnings=False)  # -> Stdout, Stderr_, Ran
download_15 = Download(LinuxFilePaths=executessh_50.Stdout, Run=executessh_50.Ran)  # -> FilePaths, Status, Ran

imageviewer_10 = LBImageViewer(ImagePath_=item_8.Item, _scale_=3, DisableClickable=False, SaveImgWithCoords=False, scale=3)  # -> ImagePath, Values, GIF
imageviewer_11 = LBImageViewer(ImagePath_=download_14.FilePaths, _scale_=2, DisableClickable=False, SaveImgWithCoords=False, scale=2)  # -> ImagePath, Values, GIF
imageviewer_12 = LBImageViewer(ImagePath_=download_15.FilePaths, _scale_=2, DisableClickable=False, SaveImgWithCoords=False, scale=2)  # -> ImagePath, Values, GIF

# ----
# Using PCOND to set automatic exposure
# and convert to PNG
# pcond -h <hdr> <hdr-.>_exposed.hdr
# ra_tiff <hdr-.>_exposed.hdr <hdr-.>_exposed.tif
# convert <hdr-.>_exposed.tif <hdr-.>_exposed.png
# echo <hdr-.>_exposed.png
# pcompos -a 15 -b 1 1 1 -s 5 <proj>/mtxs/skyRenders/skyTregenza*.hdr > <proj>/mtxs/skyRenders/all.hdr
panel_110 = Panel("pcond -h <hdr> <hdr-.>_exposed.hdr;echo <hdr-.>_exposed.hdr")
panel_111 = Panel("psign -h 15 <h> | pcompos <target> 0 0 - 570 20 > <target-.>_s.hdr;echo <target-.>_s.hdr")
hours_9 = Number(hours)
panel_112 = Panel("""pcond -h <hdr> <hdr-.>_exposed.hdr
ra_tiff <hdr-.>_exposed.hdr <hdr-.>_exposed.tif
convert <hdr-.>_exposed.tif <hdr-.>_exposed.png
echo <hdr-.>_exposed.png""")
panel_113 = Panel("""pcompos -a 3 -s 10 -b 0.2 0.2 0.2 <hdrFiles> > <proj>/images/<target>
ra_tiff <proj>/images/<target> <proj>/images/<target-.>.tif
convert <proj>/images/<target-.>.tif <proj>/images/<target-.>.png
echo <proj>/images/<target-.>.png""")
# -la for titel: pcompos -la -a 3 -s 10 -b 1 1 1 <hdrFiles> > <proj>/images/<target>
# echo <proj>/images/<target>
panel_114 = Panel("combined.hdr")

overrides_59 = ApplyOverrides(Input=panel_110, Hdr=graft(executessh_28.Stdout))  # -> Output, DynamicOutput
executessh_51 = ExecuteSSH(
    _SSHCommands_=overrides_59.DynamicOutput,
    Run=executessh_28.Ran,
    addPrefix=True,
    description="""pcond -h <hdr> <hdr>_exposed.hdr;echo <hdr>_exposed.hdr


- - -

pcond -h <hdr> <hdr>_exposed.hdr;echo <hdr>_exposed.hdr


- - -

pcond -h <hdr> <hdr>_exposed.hdr;echo <hdr>_exposed.hdr


- - -

pcond -h <hdr> <hdr>_exposed.hdr;echo <hdr>_exposed.hdr


- - -

pcond -h <hdr> <hdr>_exposed.hdr;echo <hdr>_exposed.hdr


- - -

pcond -h <hdr> <hdr>_exposed.hdr;echo <hdr>_exposed.hdr


- - -

pcond -h <hdr> <hdr>_exposed.hdr;echo <hdr>_exposed.hdr


- - -

pcond -h <hdr> <hdr>_exposed.hdr;echo <hdr>_exposed.hdr


- - -

pcond -h <hdr> <hdr>_exposed.hdr;echo <hdr>_exposed.hdr


- - -

pcond -h <hdr> <hdr>_exposed.hdr;echo <hdr>_exposed.hdr""",
    fireLogs=False,
    lastRunTime=0,
    suppressWarnings=False)  # -> Stdout, Stderr_, Ran
overrides_60 = ApplyOverrides(Input=panel_111, H=graft(hours_9), Target=graft(executessh_51.Stdout))  # -> Output, DynamicOutput
lng = ListLength(List=flatten(executessh_51.Stdout))
python_24 = GhPythonScript(cnt=lng, run=executessh_51.Ran)  # -> out, ran; inputs cnt: Int32, run: Boolean
# ---------- python_24: Python ----------
__author__ = "mm1013"
__version__ = "2022.08.30"

import rhinoscriptsyntax as rs

ran = cnt > 1 and run
# ---------- end python_24 ----------
executessh_52 = ExecuteSSH(
    _SSHCommands_=overrides_60.DynamicOutput,
    Run=python_24.ran,
    addPrefix=True,
    description="""psign -h 15 800 | pcompos <target> 0 0 - 570 20 > <target>_s.hdr;echo <target>_s.hdr


- - -

psign -h 15 900 | pcompos <target> 0 0 - 570 20 > <target>_s.hdr;echo <target>_s.hdr


- - -

psign -h 15 1000 | pcompos <target> 0 0 - 570 20 > <target>_s.hdr;echo <target>_s.hdr


- - -

psign -h 15 1100 | pcompos <target> 0 0 - 570 20 > <target>_s.hdr;echo <target>_s.hdr


- - -

psign -h 15 1200 | pcompos <target> 0 0 - 570 20 > <target>_s.hdr;echo <target>_s.hdr


- - -

psign -h 15 1300 | pcompos <target> 0 0 - 570 20 > <target>_s.hdr;echo <target>_s.hdr


- - -

psign -h 15 1400 | pcompos <target> 0 0 - 570 20 > <target>_s.hdr;echo <target>_s.hdr


- - -

psign -h 15 1500 | pcompos <target> 0 0 - 570 20 > <target>_s.hdr;echo <target>_s.hdr


- - -

psign -h 15 1600 | pcompos <target> 0 0 - 570 20 > <target>_s.hdr;echo <target>_s.hdr


- - -

psign -h 15 1700 | pcompos <target> 0 0 - 570 20 > <target>_s.hdr;echo <target>_s.hdr""",
    fireLogs=False,
    lastRunTime=0,
    suppressWarnings=False)  # -> Stdout, Stderr_, Ran
overrides_61 = ApplyOverrides(Input=panel_112, Hdr=graft(executessh_52.Stdout))  # -> Output, DynamicOutput
executessh_53 = ExecuteSSH(
    _SSHCommands_=overrides_61.DynamicOutput,
    Run=executessh_51.Ran,
    addPrefix=True,
    description="""pcond -h <hdr> <hdr>_exposed.hdr
ra_tiff <hdr>_exposed.hdr <hdr>_exposed.tif
convert <hdr>_exposed.tif <hdr>_exposed.png
echo <hdr>_exposed.png


- - -

pcond -h <hdr> <hdr>_exposed.hdr
ra_tiff <hdr>_exposed.hdr <hdr>_exposed.tif
convert <hdr>_exposed.tif <hdr>_exposed.png
echo <hdr>_exposed.png


- - -

pcond -h <hdr> <hdr>_exposed.hdr
ra_tiff <hdr>_exposed.hdr <hdr>_exposed.tif
convert <hdr>_exposed.tif <hdr>_exposed.png
echo <hdr>_exposed.png


- - -

pcond -h <hdr> <hdr>_exposed.hdr
ra_tiff <hdr>_exposed.hdr <hdr>_exposed.tif
convert <hdr>_exposed.tif <hdr>_exposed.png
echo <hdr>_exposed.png


- - -

pcond -h <hdr> <hdr>_exposed.hdr
ra_tiff <hdr>_exposed.hdr <hdr>_exposed.tif
convert <hdr>_exposed.tif <hdr>_exposed.png
echo <hdr>_exposed.png


- - -

pcond -h <hdr> <hdr>_exposed.hdr
ra_tiff <hdr>_exposed.hdr <hdr>_exposed.tif
convert <hdr>_exposed.tif <hdr>_exposed.png
echo <hdr>_exposed.png


- - -

pcond -h <hdr> <hdr>_exposed.hdr
ra_tiff <hdr>_exposed.hdr <hdr>_exposed.tif
convert <hdr>_exposed.tif <hdr>_exposed.png
echo <hdr>_exposed.png


- - -

pcond -h <hdr> <hdr>_exposed.hdr
ra_tiff <hdr>_exposed.hdr <hdr>_exposed.tif
convert <hdr>_exposed.tif <hdr>_exposed.png
echo <hdr>_exposed.png


- - -

pcond -h <hdr> <hdr>_exposed.hdr
ra_tiff <hdr>_exposed.hdr <hdr>_exposed.tif
convert <hdr>_exposed.tif <hdr>_exposed.png
echo <hdr>_exposed.png


- - -

pcond -h <hdr> <hdr>_exposed.hdr
ra_tiff <hdr>_exposed.hdr <hdr>_exposed.tif
convert <hdr>_exposed.tif <hdr>_exposed.png
echo <hdr>_exposed.png""",
    fireLogs=False,
    lastRunTime=0,
    suppressWarnings=False)  # -> Stdout, Stderr_, Ran
download_16 = Download(SftpPaths=executessh_53.Stdout, Run=executessh_53.Ran)  # -> flatten(FilePaths), Status, Ran

# ----
# PNGS
imageviewer_13 = LBImageViewer(ImagePath_=download_16.FilePaths, _scale_="2", DisableClickable=False, SaveImgWithCoords=False, scale=2)  # -> ImagePath, Values, GIF

# ----
# save pngs exposed and raw
panel_115 = Panel("""ra_tiff <hdr-.>.hdr <hdr-.>.tif
convert <hdr-.>.tif <hdr-.>.png
rm <hdr-.>.tif
echo <hdr-.>.png""")
panel_116 = Panel("""pcond -h <hdr> <hdr-.>_exposed.hdr
ra_tiff <hdr-.>_exposed.hdr <hdr-.>_exposed.tif
convert <hdr-.>_exposed.tif <hdr-.>_exposed.png
rm <hdr-.>_exposed.tif
rm <hdr-.>_exposed.hdr
echo <hdr-.>_exposed.png""")
entwine_13 = Entwine(Branch00=panel_116, Branch01=panel_115, FlattenInputs=True)

overrides_62 = ApplyOverrides(Input=entwine_13, Hdr=graft(executessh_44.Stdout))  # -> Output, DynamicOutput
executessh_54 = ExecuteSSH(
    _SSHCommands_=overrides_62.DynamicOutput,
    Run=executessh_44.Ran,
    addPrefix=True,
    description="""pcond -h <hdr> <hdr>_exposed.hdr
ra_tiff <hdr>_exposed.hdr <hdr>_exposed.tif
convert <hdr>_exposed.tif <hdr>_exposed.png
rm <hdr>_exposed.tif
rm <hdr>_exposed.hdr
echo <hdr>_exposed.png


- - -

ra_tiff <hdr>.hdr <hdr>.tif
convert <hdr>.tif <hdr>.png
rm <hdr>.tif
echo <hdr>.png""",
    fireLogs=False,
    lastRunTime=0,
    suppressWarnings=False)  # -> Stdout, Stderr_, Ran
download_17 = Download(LinuxFilePaths=executessh_54.Stdout, Run=executessh_54.Ran)  # -> flatten(FilePaths), Status, Ran

item_9 = ListItem(List=download_17.FilePaths, Index=0, Wrap=True)  # -> Item, Item1

imageviewer_14 = LBImageViewer(ImagePath_=item_9.Item, _scale_=2, DisableClickable=False, SaveImgWithCoords=False, scale=2)  # -> ImagePath, Values, GIF
imageviewer_15 = LBImageViewer(ImagePath_=item_9.Item1, _scale_=2, DisableClickable=False, SaveImgWithCoords=False, scale=2)  # -> ImagePath, Values, GIF

# ----
# False color with illuminance curves
# on top of luminance picture
panel_117 = Panel("falsecolor -s 10000 -l lux -p <rad-.>_exposed.hdr -i <irrad> -log 2 > <rad-.>_fc2.hdr;echo <rad-.>_fc2.hdr")

overrides_63 = ApplyOverrides(Input=panel_117, Rad=graft(executessh_30.Stdout), Irrad=graft(executessh_29.Stdout))  # -> Output, DynamicOutput
executessh_55 = ExecuteSSH(
    _SSHCommands_=overrides_63.DynamicOutput,
    Run=[or, executessh_29.Ran],
    addPrefix=True,
    description="falsecolor -s 10000 -l lux -p /home/mss/MantaRay/UnnamedProject/images/2022_10_06_1035_44_Perspective_render_exposed.hdr -i /home/mss/MantaRay/UnnamedProject/images/2022_09_28_1341_29_Perspective1_render_illum.hdr -log 2 > /home/mss/MantaRay/UnnamedProject/images/2022_10_06_1035_44_Perspective_render_fc2.hdr;echo /home/mss/MantaRay/UnnamedProject/images/2022_10_06_1035_44_Perspective_render_fc2.hdr",
    fireLogs=False,
    lastRunTime=5358,
    suppressWarnings=False,
    results="/home/mss/MantaRay/UnnamedProject/images/2022_09_28_1341_29_Perspective1_render_fc2.hdr",
    commands="falsecolor -s 10000 -l lux -p /home/mss/MantaRay/UnnamedProject/images/2022_09_28_1341_29_Perspective1_render_exposed.hdr -i /home/mss/MantaRay/UnnamedProject/images/2022_09_28_1341_29_Perspective1_render_illum.hdr -log 2 > /home/mss/MantaRay/UnnamedProject/images/2022_09_28_1341_29_Perspective1_render_fc2.hdr;echo /home/mss/MantaRay/UnnamedProject/images/2022_09_28_1341_29_Perspective1_render_fc2.hdr")  # -> Stdout, Stderr_, Ran
download_18 = Download(
    LinuxFilePaths=executessh_55.Stdout,
    Run=executessh_55.Ran,
    stdouts="C:\Users\mm1013\MantaRay\UnnamedProject\2022_09_28_1341_29_Perspective1_render_fc2.hdr")  # -> FilePaths, Status, Ran

imageviewer_16 = LBImageViewer(ImagePath_=download_18.FilePaths, _scale_="2", DisableClickable=False, SaveImgWithCoords=False, scale=2)  # -> ImagePath, Values, GIF

# ----
# False color with illuminance curves
# on top of luminance picture
panel_118 = Panel("falsecolor -s 10000 -pal hot -l lux -p <rad-.>_exposed.hdr -i <irrad> > <rad-.>_fc3.hdr;echo <rad-.>_fc3.hdr")

overrides_64 = ApplyOverrides(Input=panel_118, Rad=graft(executessh_30.Stdout), Irrad=graft(executessh_29.Stdout))  # -> Output, DynamicOutput
executessh_56 = ExecuteSSH(
    _SSHCommands_=overrides_64.DynamicOutput,
    Run=[or, executessh_29.Ran],
    addPrefix=True,
    description="falsecolor -s 10000 -pal hot -l lux -p /home/mss/MantaRay/UnnamedProject/images/2022_10_06_1035_44_Perspective_render_exposed.hdr -i /home/mss/MantaRay/UnnamedProject/images/2022_09_28_1341_29_Perspective1_render_illum.hdr > /home/mss/MantaRay/UnnamedProject/images/2022_10_06_1035_44_Perspective_render_fc3.hdr;echo /home/mss/MantaRay/UnnamedProject/images/2022_10_06_1035_44_Perspective_render_fc3.hdr",
    fireLogs=False,
    lastRunTime=2709,
    suppressWarnings=False,
    results="/home/mss/MantaRay/UnnamedProject/images/2022_09_28_1341_29_Perspective1_render_fc3.hdr",
    commands="falsecolor -s 10000 -pal hot -l lux -p /home/mss/MantaRay/UnnamedProject/images/2022_09_28_1341_29_Perspective1_render_exposed.hdr -i /home/mss/MantaRay/UnnamedProject/images/2022_09_28_1341_29_Perspective1_render_illum.hdr > /home/mss/MantaRay/UnnamedProject/images/2022_09_28_1341_29_Perspective1_render_fc3.hdr;echo /home/mss/MantaRay/UnnamedProject/images/2022_09_28_1341_29_Perspective1_render_fc3.hdr")  # -> Stdout, Stderr_, Ran
download_19 = Download(
    LinuxFilePaths=executessh_56.Stdout,
    Run=executessh_56.Ran,
    stdouts="C:\Users\mm1013\MantaRay\UnnamedProject\2022_09_28_1341_29_Perspective1_render_fc3.hdr")  # -> FilePaths, Status, Ran

imageviewer_17 = LBImageViewer(ImagePath_=download_19.FilePaths, _scale_="2", DisableClickable=False, SaveImgWithCoords=False, scale=2)  # -> ImagePath, Values, GIF

panel_119 = Panel(overrides_60.Output)
join_6 = TextJoin(Text=flatten(executessh_52.Stdout), Join=" ")

overrides_65 = ApplyOverrides(Input=panel_113, HdrFiles=graft(join_6), Target=graft(panel_114))  # -> Output, DynamicOutput

executessh_57 = ExecuteSSH(
    _SSHCommands_=overrides_65.Output,
    Run=executessh_52.Ran,
    addPrefix=True,
    fireLogs=False,
    lastRunTime=0,
    suppressWarnings=False)  # -> Stdout, Stderr_, Ran

# ----
# False color with illuminance curves
# on top of luminance picture
panel_120 = Panel("falsecolor -s 50 -n 10 -m 1.79 -l DF -p <rad-.>_exposed.hdr -i <irrad> -cp > <rad-.>_fc4.hdr;echo <rad-.>_fc4.hdr")

overrides_66 = ApplyOverrides(Input=panel_120, Rad=graft(executessh_30.Stdout), Irrad=graft(executessh_29.Stdout))  # -> Output, DynamicOutput
executessh_58 = ExecuteSSH(
    _SSHCommands_=overrides_66.DynamicOutput,
    Run=[or, executessh_29.Ran],
    addPrefix=True,
    description="falsecolor -s 50 -n 10 -m 1.79 -l DF -p /home/mss/MantaRay/UnnamedProject/images/2022_10_06_1035_44_Perspective_render_exposed.hdr -i /home/mss/MantaRay/UnnamedProject/images/2022_09_28_1341_29_Perspective1_render_illum.hdr -cp > /home/mss/MantaRay/UnnamedProject/images/2022_10_06_1035_44_Perspective_render_fc4.hdr;echo /home/mss/MantaRay/UnnamedProject/images/2022_10_06_1035_44_Perspective_render_fc4.hdr",
    fireLogs=False,
    lastRunTime=3169,
    suppressWarnings=False,
    results="/home/mss/MantaRay/UnnamedProject/images/2022_09_28_1341_29_Perspective1_render_fc4.hdr",
    commands="falsecolor -s 50 -n 10 -m 1.79 -l DF -p /home/mss/MantaRay/UnnamedProject/images/2022_09_28_1341_29_Perspective1_render_exposed.hdr -i /home/mss/MantaRay/UnnamedProject/images/2022_09_28_1341_29_Perspective1_render_illum.hdr -cp > /home/mss/MantaRay/UnnamedProject/images/2022_09_28_1341_29_Perspective1_render_fc4.hdr;echo /home/mss/MantaRay/UnnamedProject/images/2022_09_28_1341_29_Perspective1_render_fc4.hdr")  # -> Stdout, Stderr_, Ran
download_20 = Download(
    LinuxFilePaths=executessh_58.Stdout,
    Run=executessh_58.Ran,
    stdouts="C:\Users\mm1013\MantaRay\UnnamedProject\2022_09_28_1341_29_Perspective1_render_fc4.hdr")  # -> FilePaths, Status, Ran
download_21 = Download(
    LinuxFilePaths=executessh_29.Stdout,
    Run=executessh_58.Ran,
    stdouts="C:\Users\mm1013\MantaRay\UnnamedProject\2022_09_28_1341_29_Perspective1_render_illum.hdr")  # -> FilePaths, Status, Ran; disabled
executessh_59 = ExecuteSSH(
    _SSHCommands_=overrides_43.DynamicOutput,
    Run=executessh_58.Ran,
    addPrefix=True,
    description="""pcomb -o /home/mss/MantaRay/UnnamedProject/images/2022_09_28_1341_29_Perspective1_render_illum.hdr | pcompos -x 2 -y 2 - -811 -1370 | pvalue -h -H -df | total -if3 -m | sed -r 's/[\t]+/1/g'


- - -

pcomb -o /home/mss/MantaRay/UnnamedProject/images/2022_09_28_1341_29_Perspective1_render_illum.hdr | pcompos -x 2 -y 2 - -812 -1332 | pvalue -h -H -df | total -if3 -m | sed -r 's/[\t]+/1/g'


- - -

pcomb -o /home/mss/MantaRay/UnnamedProject/images/2022_09_28_1341_29_Perspective1_render_illum.hdr | pcompos -x 2 -y 2 - -814 -1285 | pvalue -h -H -df | total -if3 -m | sed -r 's/[\t]+/1/g'


- - -

pcomb -o /home/mss/MantaRay/UnnamedProject/images/2022_09_28_1341_29_Perspective1_render_illum.hdr | pcompos -x 2 -y 2 - -816 -1247 | pvalue -h -H -df | total -if3 -m | sed -r 's/[\t]+/1/g'


- - -

pcomb -o /home/mss/MantaRay/UnnamedProject/images/2022_09_28_1341_29_Perspective1_render_illum.hdr | pcompos -x 2 -y 2 - -816 -1202 | pvalue -h -H -df | total -if3 -m | sed -r 's/[\t]+/1/g'


- - -

pcomb -o /home/mss/MantaRay/UnnamedProject/images/2022_09_28_1341_29_Perspective1_render_illum.hdr | pcompos -x 2 -y 2 - -1312 -1532 | pvalue -h -H -df | total -if3 -m | sed -r 's/[\t]+/1/g'


- - -

pcomb -o /home/mss/MantaRay/UnnamedProject/images/2022_09_28_1341_29_Perspective1_render_illum.hdr | pcompos -x 2 -y 2 - -1308 -1494 | pvalue -h -H -df | total -if3 -m | sed -r 's/[\t]+/1/g'


- - -

pcomb -o /home/mss/MantaRay/UnnamedProject/images/2022_09_28_1341_29_Perspective1_render_illum.hdr | pcompos -x 2 -y 2 - -1305 -1453 | pvalue -h -H -df | total -if3 -m | sed -r 's/[\t]+/1/g'


- - -

pcomb -o /home/mss/MantaRay/UnnamedProject/images/2022_09_28_1341_29_Perspective1_render_illum.hdr | pcompos -x 2 -y 2 - -1305 -1426 | pvalue -h -H -df | total -if3 -m | sed -r 's/[\t]+/1/g'


- - -

pcomb -o /home/mss/MantaRay/UnnamedProject/images/2022_09_28_1341_29_Perspective1_render_illum.hdr | pcompos -x 2 -y 2 - -1299 -1394 | pvalue -h -H -df | total -if3 -m | sed -r 's/[\t]+/1/g'


- - -

pcomb -o /home/mss/MantaRay/UnnamedProject/images/2022_09_28_1341_29_Perspective1_render_illum.hdr | pcompos -x 2 -y 2 - -1627 -1590 | pvalue -h -H -df | total -if3 -m | sed -r 's/[\t]+/1/g'


- - -

pcomb -o /home/mss/MantaRay/UnnamedProject/images/2022_09_28_1341_29_Perspective1_render_illum.hdr | pcompos -x 2 -y 2 - -1619 -1560 | pvalue -h -H -df | total -if3 -m | sed -r 's/[\t]+/1/g'


- - -

pcomb -o /home/mss/MantaRay/UnnamedProject/images/2022_09_28_1341_29_Perspective1_render_illum.hdr | pcompos -x 2 -y 2 - -1614 -1532 | pvalue -h -H -df | total -if3 -m | sed -r 's/[\t]+/1/g'


- - -

pcomb -o /home/mss/MantaRay/UnnamedProject/images/2022_09_28_1341_29_Perspective1_render_illum.hdr | pcompos -x 2 -y 2 - -1608 -1500 | pvalue -h -H -df | total -if3 -m | sed -r 's/[\t]+/1/g'


- - -

pcomb -o /home/mss/MantaRay/UnnamedProject/images/2022_09_28_1341_29_Perspective1_render_illum.hdr | pcompos -x 2 -y 2 - -132 -1979 | pvalue -h -H -df | total -if3 -m | sed -r 's/[\t]+/1/g'""",
    fireLogs=False,
    lastRunTime=1755,
    suppressWarnings=False,
    results=["24.125124.125124.125", "21.5625121.5625121.5625", "17.875117.875117.875", "14.953125114.953125114.953125", "54.625154.625154.625", "23123123", "19.625119.625119.625", "16.5116.5116.5", "24.7578125124.7578125124.7578125", "55.625155.625155.625", "21.15625121.15625121.15625", "20.1875120.1875120.1875", "19119119", "17.59375117.59375117.59375", "55.625155.625155.625"],
    commands=["pcomb -o /home/mss/MantaRay/UnnamedProject/images/2022_09_28_1341_29_Perspective1_render_illum.hdr | pcompos -x 2 -y 2 - -811 -470 | pvalue -h -H -df | total -if3 -m | sed -r 's/[\t]+/1/g'", "pcomb -o /home/mss/MantaRay/UnnamedProject/images/2022_09_28_1341_29_Perspective1_render_illum.hdr | pcompos -x 2 -y 2 - -812 -432 | pvalue -h -H -df | total -if3 -m | sed -r 's/[\t]+/1/g'", "pcomb -o /home/mss/MantaRay/UnnamedProject/images/2022_09_28_1341_29_Perspective1_render_illum.hdr | pcompos -x 2 -y 2 - -1627 -690 | pvalue -h -H -df | total -if3 -m | sed -r 's/[\t]+/1/g'", "pcomb -o /home/mss/MantaRay/UnnamedProject/images/2022_09_28_1341_29_Perspective1_render_illum.hdr | pcompos -x 2 -y 2 - -1308 -594 | pvalue -h -H -df | total -if3 -m | sed -r 's/[\t]+/1/g'", "pcomb -o /home/mss/MantaRay/UnnamedProject/images/2022_09_28_1341_29_Perspective1_render_illum.hdr | pcompos -x 2 -y 2 - -1614 -632 | pvalue -h -H -df | total -if3 -m | sed -r 's/[\t]+/1/g'", "pcomb -o /home/mss/MantaRay/UnnamedProject/images/2022_09_28_1341_29_Perspective1_render_illum.hdr | pcompos -x 2 -y 2 - -132 -1079 | pvalue -h -H -df | total -if3 -m | sed -r 's/[\t]+/1/g'", "pcomb -o /home/mss/MantaRay/UnnamedProject/images/2022_09_28_1341_29_Perspective1_render_illum.hdr | pcompos -x 2 -y 2 - -1305 -553 | pvalue -h -H -df | total -if3 -m | sed -r 's/[\t]+/1/g'", "pcomb -o /home/mss/MantaRay/UnnamedProject/images/2022_09_28_1341_29_Perspective1_render_illum.hdr | pcompos -x 2 -y 2 - -816 -347 | pvalue -h -H -df | total -if3 -m | sed -r 's/[\t]+/1/g'", "pcomb -o /home/mss/MantaRay/UnnamedProject/images/2022_09_28_1341_29_Perspective1_render_illum.hdr | pcompos -x 2 -y 2 - -1305 -526 | pvalue -h -H -df | total -if3 -m | sed -r 's/[\t]+/1/g'", "pcomb -o /home/mss/MantaRay/UnnamedProject/images/2022_09_28_1341_29_Perspective1_render_illum.hdr | pcompos -x 2 -y 2 - -816 -302 | pvalue -h -H -df | total -if3 -m | sed -r 's/[\t]+/1/g'"])  # -> Stdout, Stderr_, Ran

imageviewer_18 = LBImageViewer(ImagePath_=download_20.FilePaths, _scale_="2", DisableClickable=False, SaveImgWithCoords=False, scale=2)  # -> ImagePath, Values, GIF

python_25 = GhPythonScript(val=executessh_59.Stdout)  # -> x, y, z, ln
# ---------- python_25: Python ----------
__author__ = "mm1013"
__version__ = "2022.09.28"

import rhinoscriptsyntax as rs

length = int(len(val)/3.0)
x = val[0:length]
y = val[length:2*length]
z = val[2*length:3*length]
ln = length
# ---------- end python_25 ----------
panel_121 = Panel(executessh_59.Stdout)
imageviewer_19 = LBImageViewer(ImagePath_=download_21.FilePaths, _scale_="2", DisableClickable=False, SaveImgWithCoords=False, scale=2)  # -> ImagePath, Values, GIF
panel_122 = Panel(imageviewer_18.Values)

# ==== cluster DefaultMSS
default_value_flattened = ClusterInput()
data = ClusterInput()
data_2 = Data(data)
merge = Merge(Data1=flatten(data_2), Data2="0")  # -> flatten(Result)
default_value_flattened_2 = Data(flatten(default_value_flattened))
lng = ListLength(List=merge)
equals = Equality(FirstNumber=lng, SecondNumber="1")  # -> Equality, Inequality
cull = CullPattern(List=data_2, CullPattern=invert(equals.Equality))
panel = Panel(equals.Equality)
cull_2 = CullPattern(List=default_value_flattened_2, CullPattern=equals.Equality)
data_3 = Data([cull, cull_2])
data_4 = ClusterOutput(data_3)

# ==== cluster MeshIt2: Meshes everything in the input. Graft the input if you want to make several meshes, otherwise returns a joined mesh.
mesh_brep = ClusterInput()
mesh_brep_2 = Geometry(simplify(mesh_brep))
tmatch = MatchText(Text=mesh_brep_2, RegEx="(mesh)", Case=False)
tmatch_2 = MatchText(Text=mesh_brep_2, RegEx="(brep)|(polysurface)|(surface)|(extrusion)", Case=False)
group = Group(Objects=mesh_brep_2)
cull = CullPattern(List=mesh_brep_2, CullPattern=tmatch_2)
mesh = MeshBrep(
    Brep=cull,
    Settings={GridMaxCount=0, GridMinCount=16, JaggedSeams=False, MaxEdgeLength=0, MinEdgeLength=0.0001, MinTolerance=0, Refine=True, RefineAngle=0, RelativeTolerance=0.65, SimplePlanes=True, Tolerance=0})  # -> simplify(Mesh)
cull_2 = CullPattern(List=mesh_brep_2, CullPattern=tmatch)  # -> simplify(List)

# ----
# Fix invalid mesh
panel = Panel("Invalid Mesh")  # disabled
mesh_2 = Mesh(mesh)  # disabled
tmatch_3 = MatchText(Text=mesh_2, RegEx=panel, Case=False)  # disabled
unweave = Unweave(List=mesh_2, UnweavePattern=tmatch_3)  # -> Data0, Data1; disabled
explode = MeshExplode(Mesh=unweave.Data1, Interpolate=False)  # -> simplify(Faces); disabled
abc_a = ABC(data=explode)  # disabled
panel_2 = Panel("0")  # disabled
num = Number(panel_2)  # disabled
area = MeshArea(Mesh=abc_a)  # -> Area, Centroid; disabled
equals = Equality(FirstNumber=area.Area, SecondNumber=num)  # -> Equality, Inequality; disabled
cull_3 = CullPattern(List=abc_a, CullPattern=equals.Inequality)  # disabled
mjoin = MeshJoin(Meshes=[cull_3, unweave.Data0])  # disabled

# ----
# Fix invalid mesh
panel_3 = Panel("Invalid Mesh")  # disabled
mesh_3 = Mesh(cull_2)  # disabled
tmatch_4 = MatchText(Text=mesh_3, RegEx=panel_3, Case=False)  # disabled
unweave_2 = Unweave(List=mesh_3, UnweavePattern=tmatch_4)  # -> Data0, Data1; disabled
explode_2 = MeshExplode(Mesh=unweave_2.Data1, Interpolate=False)  # -> simplify(Faces); disabled
abc_a_2 = ABC(data=explode_2)  # disabled
panel_4 = Panel("0")  # disabled
num_2 = Number(panel_4)  # disabled
area_2 = MeshArea(Mesh=abc_a_2)  # -> Area, Centroid; disabled
equals_2 = Equality(FirstNumber=area_2.Area, SecondNumber=num_2)  # -> Equality, Inequality; disabled
cull_4 = CullPattern(List=abc_a_2, CullPattern=equals_2.Inequality)  # disabled
mjoin_2 = MeshJoin(Meshes=[cull_4, unweave_2.Data0])  # disabled

mjoin_3 = MeshJoin(Meshes=[mesh, cull_2])
c_script = CSharpScript(mesh=mjoin_3)  # -> A; inputs mesh: Mesh
# ---------- c_script: C# ----------
    mesh.Faces.CullDegenerateFaces();
    A = mesh;
# ---------- end c_script ----------
abc_a_3 = ABC(data=mjoin)  # disabled
abc_a_4 = ABC(data=mjoin_2)  # disabled
clean = CleanTree(RemoveNulls=True, RemoveInvalid=True, RemoveEmpty=False, Tree=[abc_a_3, abc_a_4])  # disabled
mjoin_4 = MeshJoin(Meshes=clean)  # disabled
unflatten = UnflattenTree(Tree=c_script, Guide=group)
mesh_explode = MeshExplode(m=mjoin_4)  # -> out, simplify(A); disabled
# ---------- mesh_explode: VB ----------
    Component.Params.Input(0).Name = "Mesh"
    Component.Params.Input(0).Description = "Open or closed mesh"

    Component.Params.Output(1).Name = "Mesh"
    Component.Params.Output(1).Description = "If successful, a valid mesh"

    If m IsNot Nothing Then
      Dim pts As Rhino.Geometry.Collections.MeshVertexList
      Dim faces As Rhino.Geometry.Collections.MeshFaceList
      Dim clrs As Rhino.Geometry.Collections.MeshVertexColorList
      Dim i As Integer
      Dim mshs As New list(Of mesh)

      faces = m.Faces
      pts = m.Vertices
      If m.VertexColors.count() = 0 Then m.VertexColors.CreateMonotoneMesh(color.FromArgb(100, 100, 100))
      clrs = m.VertexColors

      For i = 0 To faces.count() - 1 Step 1
        Dim fc As New meshFace
        Dim face As New MeshFace
        Dim ptList As New list(Of point3d)
        Dim clrList As New list(Of color)
        Dim msh As New mesh

        face = faces(i)

        ptList.add(New point3d(pts(face.A)))
        ptList.add(New point3d(pts(face.B)))
        ptList.add(New point3d(pts(face.C)))
        If face.IsQuad Then ptList.add(New point3d(pts(face.D)))

        clrList.add(clrs(face.A))
        clrList.add(clrs(face.B))
        clrList.add(clrs(face.C))
        If face.IsQuad Then clrList.add(clrs(face.D))

        If face.IsQuad Then fc = New meshFace(0, 1, 2, 3) Else fc = New meshface(0, 1, 2)

        msh.Vertices.AddVertices(ptList.toarray())
        msh.Faces.AddFace(fc)
        msh.VertexColors.SetColors(clrList.toarray())
        mshs.add(msh)
      Next

      A = mshs
    End If
# ---------- end mesh_explode ----------
c_script_2 = CSharpScript(mesh=mjoin_4)  # -> A; inputs mesh: Mesh; disabled; same code as c_script
c_script_3 = CSharpScript(mesh=mesh_explode.A)  # -> out, A; inputs mesh: list of Mesh; disabled
# ---------- c_script_3: C# ----------
    List<bool> isValid = new List<bool>();
    for (int i = 0; i < mesh.Count; i++)
    {
      isValid.Add(mesh[i].IsValid);
    }
    
    A = isValid;
# ---------- end c_script_3 ----------
mesh_joined = Mesh(unflatten)
cullf = CullFaces(Mesh=mjoin_4, Pattern=invert(c_script_3.A))  # disabled
mesh_joined_2 = ClusterOutput(mesh_joined)

# ==== cluster LargestBREP
window_breps = ClusterInput()
window_breps_2 = Brep(window_breps)
debrep = DeconstructBrep(Brep=window_breps_2)  # -> Faces, Edges, Vertices
area = Area(Geometry=debrep.Faces)  # -> Area, Centroid
sort = SortList(Keys=area.Area, ValuesA=debrep.Faces)  # -> Keys, ValuesA
item = ListItem(List=sort.ValuesA, Index=-1, Wrap=True)
group = Group(Objects=flatten(item))
grouped = ClusterOutput(group)

# ==== cluster Cluster
L = ClusterInput()
lng = ListLength(List=L)
default = DefaultMSS(data=flatten(lng), default_value_flattened=flatten("0"))
bool = Boolean(default)
bool_2 = ClusterOutput(bool)

# ==== cluster ABC
data = ClusterInput()
data_2 = Data(data)
path_mapper = PathMapper(
    data_2,
    source=["{A;B;C;D;E;F;G}", "{A;B;C;D;E;F}", "{A;B;C;D;E}", "{A;B;C;D}", "{A;B;C}", "{A;B}", "{A}"],
    target=["{A}", "{A}", "{A}", "{A}", "{A}", "{A}", "{A}"])
data_3 = Data(path_mapper)
data_4 = ClusterOutput(data_3)
